# Dynamo graph 1-10_5_(Pythonによる名前変更).dyn (Dynamo 2.12.0.5650)

categories = Categories("OST_Doors")
categories_2 = Categories("OST_Windows")
list_create = List.Create(item0=categories, item1=categories_2)
all_elements_of_category = ElementsOfCategory(Category=list_create)
flatten = List.Flatten(list=all_elements_of_category)
elementType = Element.ElementType(element=flatten)
family = FamilyType.Family(familyType=elementType)
uniqueItems = List.UniqueItems(list=family)
code_block = CodeBlock { ["Name1","Name2"]; }
python_script = Python(IN[0]=uniqueItems, IN[1]=code_block)  # CPython3
# ---------- python_script.python (37 lines) ----------
# Python 標準ライブラリおよび DesignScript ライブラリをロード
import sys
import clr
clr.AddReference('ProtoGeometry')
from Autodesk.DesignScript.Geometry import *

# Common Language Runtime モデュール
import clr
clr.AddReference('RevitAPI')
clr.AddReference('RevitServices')

# Revit と Dynamo モデュール
from Autodesk.Revit.DB import FilteredElementCollector,Element, Family,FamilySymbol,FamilyInstance
from RevitServices.Persistence import DocumentManager
from RevitServices.Transactions import TransactionManager

doc = DocumentManager.Instance.CurrentDBDocument
# INの入力を設定
search = IN[0]
rename = IN[1]
#名前を変更
type_name = []
collector = FilteredElementCollector(doc).OfClass(Family)
TransactionManager.Instance.EnsureInTransaction(doc)
for element in collector.ToElements():
    for idx, searched in enumerate(search):
        if searched.Name == element.Name:
            element.Name = rename[idx]
            print(element.Name)
            type_name.append(element.Name)
TransactionManager.Instance.ForceCloseTransaction()

# OUTをつくる
OUT = type_name

# OUTをつくる
#OUT = type_name
# ----------------------------------------
code_block_2 = CodeBlock()
# ---------- code_block_2.designscript (37 lines) ----------
"
# Common Language Runtime モデュール
# Python 標準ライブラリおよび DesignScript ライブラリをロード
import sys
import clr
clr.AddReference('ProtoGeometry')
from Autodesk.DesignScript.Geometry import *

# Common Language Runtime モデュール
import clr
clr.AddReference('RevitAPI')
clr.AddReference('RevitServices')

# Revit と Dynamo モデュール
from Autodesk.Revit.DB import FilteredElementCollector,Element, Family,FamilySymbol,FamilyInstance
from RevitServices.Persistence import DocumentManager
from RevitServices.Transactions import TransactionManager

doc = DocumentManager.Instance.CurrentDBDocument
# INの入力を設定
search = IN[0]
rename = IN[1]
#名前を変更
type_name = []
collector = FilteredElementCollector(doc).OfClass(Family)
TransactionManager.Instance.EnsureInTransaction(doc)
for element in collector.ToElements():
    for idx, searched in enumerate(search):
        if searched.Name == element.Name:
            element.Name = rename[idx]
            print(element.Name)
            type_name.append(element.Name)
TransactionManager.Instance.ForceCloseTransaction()

# OUTをつくる
OUT = type_name
";
# ----------------------------------------
python_script_from_string = PythonStringNode(script=code_block_2, IN[0]=uniqueItems, IN[1]=code_block)  # CPython3
family_types = FamilyTypes("親子:w0900h2000")
code_block_3 = CodeBlock { "NewName"; }
python_script_2 = Python(IN[0]=family_types, IN[1]=code_block_3)  # CPython3
# ---------- python_script_2.python (17 lines) ----------
import clr
clr.AddReference("RevitServices")
import RevitServices
from RevitServices.Persistence import DocumentManager
from RevitServices.Transactions import TransactionManager
doc = DocumentManager.Instance.CurrentDBDocument

TransactionManager.Instance.EnsureInTransaction(doc)
#IN[0]にファミリタイプ
familyType = UnwrapElement(IN[0])
#IN[1]にファミリタイプの新しい名前を指定
familyType.Name = IN[1]
output = familyType 
TransactionManager.Instance.TransactionTaskDone()

#アウトにファミリタイプ
OUT = output
# ----------------------------------------
code_block_4 = CodeBlock()
# ---------- code_block_4.designscript (19 lines) ----------
"
import clr
clr.AddReference('RevitAPI')
clr.AddReference('RevitServices')
from RevitServices.Persistence import DocumentManager
from RevitServices.Transactions import TransactionManager
doc = DocumentManager.Instance.CurrentDBDocument

TransactionManager.Instance.EnsureInTransaction(doc)
#IN[0]にファミリタイプ
familyType = UnwrapElement(IN[0])
#IN[1]にファミリタイプの新しい名前を指定
familyType.Name = IN[1]
output = familyType
TransactionManager.Instance.TransactionTaskDone()

#アウトにファミリタイプ
OUT = output
";
# ----------------------------------------
python_script_from_string_2 = PythonStringNode(script=code_block_4, IN[0]=family_types, IN[1]=code_block_3)  # CPython3
