# Dynamo graph 1-3_Sphere.dyn (Dynamo 2.12.0.5650)

byCoordinates = Point.ByCoordinates()
number_slider = DoubleSlider(72.5, range=0..100 step 0.1)
byCenterPointRadius = Sphere.ByCenterPointRadius(centerPoint=byCoordinates, radius=number_slider)
