# Dynamo graph 1-4_ParametricColumn.dyn (Dynamo 2.12.0.5650)

number_slider = DoubleSlider(53.9, range=20..100 step 0.1)
byCenterPointRadius = Circle.ByCenterPointRadius(radius=number_slider)
integer_slider = IntegerSlider(6, range=3..10 step 1)
regularPolygon = Polygon.RegularPolygon(circle=byCenterPointRadius, numberSides=integer_slider)
ZAxis = Vector.ZAxis()
code_block = CodeBlock { 180; }
code_block_2 = CodeBlock(end=code_block) { 0..end..#10; }
translate = Geometry.Translate(geometry=regularPolygon, direction=ZAxis, distance=code_block_2)
XY = Plane.XY()
rotate = Geometry.Rotate(geometry=translate, basePlane=XY, degrees=code_block_2)
byLoft = Solid.ByLoft(crossSections=rotate)
XZ = Plane.XZ()
mirror = Geometry.Mirror(geometry=byLoft, mirrorPlane=XZ)
list_create = List.Create(item0=byLoft, item1=mirror)
byUnion = Solid.ByUnion(solids=list_create)
