# Dynamo graph 1-6-1_DirectShapeから床を配置.dyn (Dynamo 2.12.0.5650)

code_block = CodeBlock { 5000; }
byCenterPointRadius = Circle.ByCenterPointRadius(radius=code_block)
integer_slider = IntegerSlider(10, range=3..10 step 1)
regularPolygon = Polygon.RegularPolygon(circle=byCenterPointRadius, numberSides=integer_slider)
code_block_2 = CodeBlock { 200; }
extrudeAsSolid = Curve.ExtrudeAsSolid(curve=regularPolygon, distance=code_block_2)
code_block_3 = CodeBlock { "床"; }
byName = Category.ByName(name=code_block_3)
code_block_4 = CodeBlock { "コンクリート - 現場打ちコンクリート"; }
byName_2 = Material.ByName(name=code_block_4)
byGeometry = DirectShape.ByGeometry(geometry=extrudeAsSolid, category=byName, material=byName_2)
