# Dynamo graph 1-6-1_植栽ファミリの配置.dyn (Dynamo 2.12.0.5650)

family_types = FamilyTypes("RPC 木 - 落葉樹:グレー バーチ - 3.1 メートル")
code_block = CodeBlock { 0..360..#10; 20000; }
remapRange = Math.RemapRange(numbers=code_block.out0, newMax=code_block.out1)
sin = Math.Sin(angle=code_block.out0)
code_block_2 = CodeBlock(a=sin) { a*2000; }
byCoordinates = Point.ByCoordinates(x=remapRange, y=code_block_2)
byPoint = FamilyInstance.ByPoint(familyType=family_types, point=byCoordinates)
