# Dynamo graph 1-6-3_DynamoPlayer.dyn (Dynamo 2.12.0.5650)

family_types = FamilyTypes("RPC 木 - 落葉樹:グレー バーチ - 3.1 メートル")  # graph input
end = DoubleSlider(720, range=360..720 step 0.1)  # graph input
number = DoubleSlider(5, range=5..5 step 1)  # graph input
max = DoubleSlider(2000, range=2000..300000 step 1)  # graph input
code_block = CodeBlock(end=end, num=number, max=max) { 0..end..#num; max; }
remapRange = Math.RemapRange(numbers=code_block.out0, newMax=code_block.max)
sin = Math.Sin(angle=code_block.out0)
min = DoubleSlider(2000, range=2000..300000 step 1)  # graph input
code_block_2 = CodeBlock(a=sin, scale=min) { a*scale; }
byCoordinates = Point.ByCoordinates(x=remapRange, y=code_block_2)
byPoint = FamilyInstance.ByPoint(familyType=family_types, point=byCoordinates)
