# Dynamo graph 1-6-3_パラメータの値を取得・変更dyn.dyn (Dynamo 2.12.0.5650)

categories = Categories("OST_Walls")
all_elements_of_category = ElementsOfCategory(Category=categories)
code_block = CodeBlock { "タイプ"; }
code_block_2 = CodeBlock { "標準-200mm"; }
byName = WallType.ByName(name=code_block_2)
setParameterByName = Element.SetParameterByName(element=all_elements_of_category, parameterName=code_block, value=byName)
getParameterValueByName = Element.GetParameterValueByName(element=all_elements_of_category, parameterName=code_block)
