# Dynamo graph 1-7-2_.Listの基礎操作.dyn (Dynamo 2.12.0.5650)

# note: List.Count
code_block = CodeBlock { 0..10; }
count = List.Count(list=code_block)
# note: List.GetItemAtIndex
code_block_2 = CodeBlock { 0..50..10; }
code_block_3 = CodeBlock { 1; }
getItemAtIndex = List.GetItemAtIndex(list=code_block_2, index=code_block_3)
# note: List.FilterByBooleanMask
code_block_4 = CodeBlock { 0..50..10; }
code_block_5 = CodeBlock { [false, true, false,true,false,true,false]; }
filterByBoolMask = List.FilterByBoolMask(list=code_block_4, mask=code_block_5)
watch = Watch(filterByBoolMask.in)
watch_2 = Watch(filterByBoolMask.out)
# note: List.Reverse
code_block_6 = CodeBlock { 0..50..10; }
reverse = List.Reverse(list=code_block_6)
