# Dynamo graph 1-7-2_.Listの基礎操作dyn.dyn (Dynamo 2.12.0.5650)

code_block = CodeBlock { 0..10; }
count = List.Count(list=code_block)
code_block_2 = CodeBlock { 0..50..10; }
code_block_3 = CodeBlock { 1; }
getItemAtIndex = List.GetItemAtIndex(list=code_block_2, index=code_block_3)
code_block_4 = CodeBlock { 0..50..10; }
boolean = BoolSelector(false)
boolean_2 = BoolSelector(true)
list_create = List.Create(item0=boolean, item1=boolean_2)
count_2 = List.Count(list=code_block_4)
code_block_5 = CodeBlock { 2; }
div = count_2 / code_block_5
ofRepeatedItem = List.OfRepeatedItem(item=list_create, amount=div)
flatten = List.Flatten(list=ofRepeatedItem)
filterByBoolMask = List.FilterByBoolMask(list=code_block_4, mask=flatten)
watch = Watch(filterByBoolMask.in)
watch_2 = Watch(filterByBoolMask.out)
code_block_6 = CodeBlock { 0..50..10; }
code_block_7 = CodeBlock { [false, true, false,true,false,true,false]; }
filterByBoolMask_2 = List.FilterByBoolMask(list=code_block_6, mask=code_block_7)
watch_3 = Watch(filterByBoolMask_2.in)
watch_4 = Watch(filterByBoolMask_2.out)
code_block_8 = CodeBlock { 0..50..10; }
reverse = List.Reverse(list=code_block_8)
code_block_9 = CodeBlock { [[0..50..10],[0..20..5]]; }
flatten_2 = List.Flatten(list=code_block_9)
watch_5 = Watch(flatten_2)
code_block_10 = CodeBlock { [0..50..10,0..20..5]; }
transpose = List.Transpose(lists=code_block_10)
code_block_11 = CodeBlock { 0..50..10; }
code_block_12 = CodeBlock { 3; }
chop = List.Chop(list=code_block_11, lengths=code_block_12)
code_block_13 = CodeBlock { [0..50..10,0..20..5]; }
count_3 = List.Count()  # unwired: list
map = List.Map(list=code_block_13, function=count_3)
combine = List.Combine()  # unwired: combineFunction, list0, list1
