# Dynamo graph 1-7-3_.List構造の基礎操作.dyn (Dynamo 2.12.0.5650)

# note: List.Chop
code_block = CodeBlock { 0..50..10; }
code_block_2 = CodeBlock { 3; }
chop = List.Chop(list=code_block, lengths=code_block_2)
# note: List.Map
code_block_3 = CodeBlock { [0..50..10,0..20..5]; }
count = List.Count()  # unwired: list
map = List.Map(list=code_block_3, function=count)
# note: List.Transpose
code_block_4 = CodeBlock { [0..50..10,0..20..5]; }
transpose = List.Transpose(lists=code_block_4)
# note: List.Flatten
code_block_5 = CodeBlock { [[0..50..10],[0..20..5]]; }
flatten = List.Flatten(list=code_block_5)
watch = Watch(flatten)
# note: List.Join
code_block_6 = CodeBlock { 0..5..1; }
code_block_7 = CodeBlock { 0..50..10; }
join = List.Join(list0=code_block_6, list1=code_block_7)
