# Dynamo graph 1-7-4_Listの作り方.dyn (Dynamo 2.12.0.5650)

code_block = CodeBlock { a = [1,2,3]; b = [40,50,60]; [[0,2,4]]; [a,b]; }
# note: Manual Input
watch = Watch(code_block.a)
watch_2 = Watch(code_block.b)
watch_3 = Watch(code_block.out2)
watch_4 = Watch(code_block.out3)
# note: List.Create
code_block_2 = CodeBlock { 3; }
code_block_3 = CodeBlock { 0..50..10; }
list_create = List.Create(item0=code_block_2, item1=code_block_3)
# note: List.Shuffle
code_block_4 = CodeBlock { 0..100..10; }
shuffle = List.Shuffle(list=code_block_4)
# note: List.Cycle
code_block_5 = CodeBlock { 0..50..10; }
code_block_6 = CodeBlock { 2; }
cycle = List.Cycle(list=code_block_5, amount=code_block_6)
# note: List.SetIntersection
code_block_7 = CodeBlock { 0..30..3; }
code_block_8 = CodeBlock { 0..30..4; }
setIntersection = List.SetIntersection(list1=code_block_7, list2=code_block_8)
