# Dynamo graph 1-7-5_Box Grid.dyn (Dynamo 2.12.0.5650)

code_block = CodeBlock { 0..100..#10; }
byCoordinates = Point.ByCoordinates(x=code_block, y=code_block, lacing=CrossProduct)
code_block_2 = CodeBlock { 5; }
byLengths = Cuboid.ByLengths(origin=byCoordinates, width=code_block_2, length=code_block_2, height=code_block_2)
