# Dynamo graph 1-7-6_Listの編集.dyn (Dynamo 2.12.0.5650)

# note: List.RemoveItemAtIndex
code_block = CodeBlock { 0..50..10; }
code_block_2 = CodeBlock { 3; }
removeItemAtIndex = List.RemoveItemAtIndex(list=code_block, indices=code_block_2)
# note: List.ShiftIndices
code_block_3 = CodeBlock { 0..50..10; }
code_block_4 = CodeBlock { 3; }
shiftIndices = List.ShiftIndices(list=code_block_3, amount=code_block_4)
# note: List.AddItemToFront
code_block_5 = CodeBlock { 3; }
code_block_6 = CodeBlock { 0..50..10; }
addItemToFront = List.AddItemToFront(item=code_block_5, list=code_block_6)
# note: List.AddItemToEnd
code_block_7 = CodeBlock { 3; }
code_block_8 = CodeBlock { 0..50..10; }
addItemToEnd = List.AddItemToEnd(item=code_block_7, list=code_block_8)
# note: List.Slice
code_block_9 = CodeBlock { 0..100..10; }
code_block_10 = CodeBlock { 2; }
code_block_11 = CodeBlock { 8; }
code_block_12 = CodeBlock { 2; }
slice = List.Slice(list=code_block_9, start=code_block_10, end=code_block_11, step=code_block_12)
code_block_13 = CodeBlock { 0; 4; }
code_block_14 = CodeBlock { a = List.Cycle(0,5); b = List.Cycle(4,5); [a,b]; }
code_block_15 = CodeBlock { 150; 300; }
mapTo = Math.MapTo(rangeMin=code_block_13.out0, rangeMax=code_block_13.out1, inputValue=code_block_14.out2, targetRangeMin=code_block_15.out0, targetRangeMax=code_block_15.out1)
watch = Watch(mapTo)
# note: Math.RemapRange
code_block_16 = CodeBlock { 0..100..#10; }
code_block_17 = CodeBlock { 15; 50; }
remapRange = Math.RemapRange(numbers=code_block_16, newMin=code_block_17.out0, newMax=code_block_17.out1)
watch_2 = Watch(remapRange)
# note: Math.Map
code_block_18 = CodeBlock { 0; 100; }
code_block_19 = CodeBlock { 0..100..#10; }
map = Math.Map(rangeMin=code_block_18.out0, rangeMax=code_block_18.out1, inputValue=code_block_19)
watch_3 = Watch(map)
# note: Mapping
code_block_20 = CodeBlock { 0; 100; }
code_block_21 = CodeBlock { 0..100..#10; }
code_block_22 = CodeBlock { 150; 300; }
mapTo_2 = Math.MapTo(rangeMin=code_block_20.out0, rangeMax=code_block_20.out1, inputValue=code_block_21, targetRangeMin=code_block_22.out0, targetRangeMax=code_block_22.out1)
watch_4 = Watch(mapTo_2)
code_block_23 = CodeBlock { a = List.Cycle(0,5); b = List.Cycle(4,5); [a,b]; }
code_block_24 = CodeBlock { 15; 50; }
remapRange_2 = Math.RemapRange(numbers=code_block_23.out2, newMin=code_block_24.out0, newMax=code_block_24.out1)
watch_5 = Watch(remapRange_2)
watch_6 = Watch(code_block_23.out2)
