# Dynamo graph 1-7-6_（Color Gradient）.dyn (Dynamo 2.12.0.5650)

code_block = CodeBlock { 0..100..#10; }
byCoordinates = Point.ByCoordinates(x=code_block, y=code_block, lacing=CrossProduct)
code_block_2 = CodeBlock { 5; }
byLengths = Cuboid.ByLengths(origin=byCoordinates, width=code_block_2, length=code_block_2, height=code_block_2)
code_block_3 = CodeBlock { 0; 100; }
X = Point.X(point=byCoordinates)
code_block_4 = CodeBlock { 150; 255; }
mapTo = Math.MapTo(rangeMin=code_block_3.out0, rangeMax=code_block_3.out1, inputValue=X, targetRangeMin=code_block_4.out0, targetRangeMax=code_block_4.out1)
Y = Point.Y(point=byCoordinates)
mapTo_2 = Math.MapTo(rangeMin=code_block_3.out0, rangeMax=code_block_3.out1, inputValue=Y, targetRangeMin=code_block_4.out0, targetRangeMax=code_block_4.out1)
byARGB = Color.ByARGB(red=mapTo, green=mapTo_2, blue=mapTo_2)
byGeometryColor = Modifiers.GeometryColor.ByGeometryColor(geometry=byLengths, color=byARGB)
