# Dynamo graph 1-7-7_(BoxRotate).dyn (Dynamo 2.12.0.5650)

code_block = CodeBlock { 10; }
rotate = Geometry.Rotate()  # unwired: geometry, basePlane, degrees
code_block_2 = CodeBlock { 0..100..#10; }
byCoordinates = Point.ByCoordinates(x=code_block_2, y=code_block_2, lacing=CrossProduct)
code_block_3 = CodeBlock { 5; }
byLengths = Cuboid.ByLengths(origin=byCoordinates, width=code_block_3, length=code_block_3, height=code_block_3)
centroid = Solid.Centroid(solid=byLengths)
ZAxis = Vector.ZAxis()
byOriginNormal = Plane.ByOriginNormal(origin=centroid, normal=ZAxis)
code_block_4 = CodeBlock { 0..180..#10; }
code_block_5 = CodeBlock { 10; }
cycle = List.Cycle(amount=code_block_5)  # unwired: list
map = List.Map(list=code_block_4, function=cycle)
combine = List.Combine(combineFunction=rotate, list0=byLengths, list1=byOriginNormal, list2=map)
code_block_6 = CodeBlock { 0; 100; }
X = Point.X(point=byCoordinates)
code_block_7 = CodeBlock { 150; 255; }
mapTo = Math.MapTo(rangeMin=code_block_6.out0, rangeMax=code_block_6.out1, inputValue=X, targetRangeMin=code_block_7.out0, targetRangeMax=code_block_7.out1)
Y = Point.Y(point=byCoordinates)
mapTo_2 = Math.MapTo(rangeMin=code_block_6.out0, rangeMax=code_block_6.out1, inputValue=Y, targetRangeMin=code_block_7.out0, targetRangeMax=code_block_7.out1)
byARGB = Color.ByARGB(red=mapTo, green=mapTo_2, blue=mapTo_2)
byGeometryColor = Modifiers.GeometryColor.ByGeometryColor(geometry=combine, color=byARGB)
