# Dynamo graph 1-7-7_トップダウン階層.dyn (Dynamo 2.12.0.5650)

code_block = CodeBlock { 0..100..#10; }
code_block_2 = CodeBlock { 0..100..#5; }
byCoordinates = Point.ByCoordinates(x=code_block, y=code_block_2, lacing=CrossProduct)
code_block_3 = CodeBlock { 5; }
byLengths = Cuboid.ByLengths(origin=byCoordinates, width=code_block_3, length=code_block_3, height=code_block_3)
code_block_4 = CodeBlock { 0; }
getItemAtIndex = List.GetItemAtIndex(list=byLengths@L2, index=code_block_4)
code_block_5 = CodeBlock(list=byLengths) { list[1]; }
code_block_6 = CodeBlock(list=byLengths) { list[0][1]; }
