# Dynamo custom node 1-8-2_CustomNodeSample.dyf "sample" (Dynamo 2.12.0.5650)
# category: GEL

curve = Input(curve: Autodesk.DesignScript.Geometry.Curve)
startPoint = Curve.StartPoint(curve=curve)
Point = Output(startPoint)
endPoint = Curve.EndPoint(curve=curve)
Point_2 = Output(endPoint)  # "Point"
length = Curve.Length(curve=curve)
double = Output(length)
