# Dynamo graph 1-8-2_既存のグラフから新規作成.dyn (Dynamo 2.12.0.5650)

byCoordinates = Point.ByCoordinates()
XAxis = Vector.XAxis()
code_block = CodeBlock { 1000; }
byStartPointDirectionLength = Line.ByStartPointDirectionLength(startPoint=byCoordinates, direction=XAxis, length=code_block)
endPoint = Curve.EndPoint(curve=byStartPointDirectionLength)
watch = Watch(endPoint)
length = Curve.Length(curve=byStartPointDirectionLength)
watch_2 = Watch(length)
startPoint = Curve.StartPoint(curve=byStartPointDirectionLength)
watch_3 = Watch(startPoint)
