# Dynamo graph 1-8-2_既存のグラフから新規作成_End.dyn (Dynamo 2.12.0.5650)

byCoordinates = Point.ByCoordinates()
XAxis = Vector.XAxis()
code_block = CodeBlock { 1000; }
byStartPointDirectionLength = Line.ByStartPointDirectionLength(startPoint=byCoordinates, direction=XAxis, length=code_block)
startEndLength = Custom[StartEndLength](curve=byStartPointDirectionLength)
watch = Watch(startEndLength.Point0)
watch_2 = Watch(startEndLength.double)
watch_3 = Watch(startEndLength.Point1)
