# Dynamo graph 15カスタムノードとは.dyn "custonmode" (Dynamo 2.10.1.3976)

byCoordinates = Point.ByCoordinates()
XAxis = Vector.XAxis()
code_block = CodeBlock { 1000; }
byStartPointDirectionLength = Line.ByStartPointDirectionLength(startPoint=byCoordinates, direction=XAxis, length=code_block)
startEndPoint = Custom[StartEndPoint](curve=byStartPointDirectionLength)  # Get Curve's Start and End Point. Also Length
watch = Watch(startEndPoint.Point0)
watch_2 = Watch(startEndPoint.Point1)
watch_3 = Watch(startEndPoint.double)
startPoint = Curve.StartPoint()  # unwired: curve
endPoint = Curve.EndPoint()  # unwired: curve
length = Curve.Length()  # unwired: curve
