# Dynamo custom node StartEndLength.dyf (Dynamo 2.12.0.5650)
# category: GEL

curve = Input(curve: Autodesk.DesignScript.Geometry.Curve)
length = Curve.Length(curve=curve)
double = Output(length)
endPoint = Curve.EndPoint(curve=curve)
Point = Output(endPoint)
startPoint = Curve.StartPoint(curve=curve)
Point_2 = Output(startPoint)  # "Point"
