# Dynamo graph 1-9-1_GeniusLoci.dyn (Dynamo 2.12.0.5650)
# packages: Genius Loci 2022.1.5

code_block = CodeBlock { "ダイニングテーブル"; }
byName = Family.ByName(name=code_block)
all_elements_of_family = Custom[All Elements of Family](family=byName)  # package Genius Loci; Get the family instances of the given loadable family.
