# Dynamo graph FloorFinish.dyn (Dynamo 2.12.0.5650)
# packages: Genius Loci 2021.11.10

# group: Preview
code_block = CodeBlock {  }

# group: Parameter
code_block_2 = CodeBlock {  }

# group: Tranform
code_block_3 = CodeBlock {  }

# group: Generate
code_block_4 = CodeBlock {  }

# group: Process
code_block_5 = CodeBlock {  }

# group: Input
code_block_6 = CodeBlock {  }

# group: レベル1の部屋を取得
categories = Categories("OST_Rooms")
views = Views("レベル 1")
all_elements_of_category_in_view = ElementsOfCategoryInView(Category=categories, View=views)

# group: 部屋の面積でフィルタリング
area = Room.Area(room=all_elements_of_category_in_view)
code_block_7 = CodeBlock { 0; }
gt = area > code_block_7
filterByBoolMask = List.FilterByBoolMask(list=all_elements_of_category_in_view, mask=gt)

# group: 部屋のジオメトリをサーフェスへ分解
geometry = Element.Geometry(element=filterByBoolMask.in)
explode = Geometry.Explode(geometry=geometry)

# group: 部屋の外形を取得
normalAtParameter = Surface.NormalAtParameter(surface=explode)
code_block_8 = CodeBlock(vector=normalAtParameter) { vector.Z ==-1? true:false; }
filterByBoolMask_2 = List.FilterByBoolMask(list=explode, mask=code_block_8)

# group: パラメータを取得
code_block_9 = CodeBlock { "仕上 床"; }
getParameterValueByName = Element.GetParameterValueByName(element=filterByBoolMask.in, parameterName=code_block_9)

# group: 床をつくる
perimeterCurves = Surface.PerimeterCurves(surface=filterByBoolMask_2.in)
byName = FloorType.ByName(name=getParameterValueByName)
view_level = Custom[View Level](view=views)  # package Genius Loci; Returns the level to which a view is associated.
byOutlineTypeAndLevel = Floor.ByOutlineTypeAndLevel(outlineCurves=perimeterCurves@L2, floorType=byName@L1, level=view_level)
