# Dynamo graph MakeOpening.dyn (Dynamo 2.12.0.5650)
# packages: spring nodes 204.1.0

# group: 床と天井を取得
categories = Categories("OST_Floors")
categories_2 = Categories("OST_Ceilings")
list_create = List.Create(item0=categories, item1=categories_2)
all_elements_of_category = ElementsOfCategory(Category=list_create)
flatten = List.Flatten(list=all_elements_of_category)

# group: 四角を選択
select_model_elements = DSModelElementsSelection()  # 4 picked in the model
geometry = Element.Geometry(element=select_model_elements)
flatten_2 = List.Flatten(list=geometry)

# group: 円を選択
select_model_elements_2 = DSModelElementsSelection()  # 3 picked in the model
geometry_2 = Element.Geometry(element=select_model_elements_2)
flatten_3 = List.Flatten(list=geometry_2)

# group: リストの整理
list_create_2 = List.Create(item0=flatten_2)
list_create_3 = List.Create(item0=list_create_2, item1=flatten_3)

# group: 開口をつくる
ꟿ_opening_infloorbycurves = Custom[ꟿ Opening.InFloorByCurves](host=flatten, curves=list_create_3@L3, lacing=CrossProduct)  # package spring nodes; Create hosted floor opeinngs through the input floors. The second input is a list of sub-lists of the boundary curves.

# group: Preview
code_block = CodeBlock {  }

# group: Parameter
code_block_2 = CodeBlock {  }

# group: Tranform
code_block_3 = CodeBlock {  }

# group: Generate
code_block_4 = CodeBlock {  }

# group: Process
code_block_5 = CodeBlock {  }

# group: Input
code_block_6 = CodeBlock {  }
