# Dynamo graph OSM.dyn (Dynamo 2.12.0.5650)
# packages: GIS2BIM for Dynamo 2.x 0.11.23, Elk 1.1.0

# group: Revitから位置を取得
# note: GIS2BIM
GIS2BIM_GetRevitSiteLocation = Custom[GIS2BIM_GetRevitSiteLocation]()  # package GIS2BIM for Dynamo 2.x; Gets the properties of the current Site Location of the active Revit Project

# group: OSMデータをダウンロード
toNumber = String.ToNumber(string=GIS2BIM_GetRevitSiteLocation.Lat)
toNumber_2 = String.ToNumber(string=GIS2BIM_GetRevitSiteLocation.Lon)
code_block = CodeBlock { 300; }
# note: GIS2BIM
GIS2BIM_CreateBoundingBoxLATLONG = Custom[GIS2BIM_CreateBoundingBoxLATLONG](Latitude=toNumber, Longitude=toNumber_2, WidthMeters=code_block)  # package GIS2BIM for Dynamo 2.x; create boundingbox with from lat/long coordinate in degrees
code_block_2 = CodeBlock { "C:/temp"; }
GIS2BIM_DownloadOSM = Custom[GIS2BIM_DownloadOSM](West=GIS2BIM_CreateBoundingBoxLATLONG.West, East=GIS2BIM_CreateBoundingBoxLATLONG.East, North=GIS2BIM_CreateBoundingBoxLATLONG.North, South=GIS2BIM_CreateBoundingBoxLATLONG.South, DirectoryLocation=code_block_2)  # package GIS2BIM for Dynamo 2.x; Download OSM data within a boundingbox

# group: OSMからBuildingデータを取得
# note: Elk
features = Elk.OSM.Features()
code_block_3 = CodeBlock(features=features) { features[5]; 10; }
subFeatures = Elk.OSM.SubFeatures(feature=code_block_3.out0, subIndexes=code_block_3.out1)

# group: OSMデータから建物形状と情報を取得
# note: Elk
location = Elk.OSM.Location(filePath=GIS2BIM_DownloadOSM.Location)
OSMData = Elk.OSM.OSMData(OSM=location.OSM, File=location.XML, featureType=code_block_3.out0, subTypes=subFeatures.all)

# group: メートルからミリメートルへ変換
code_block_4 = CodeBlock(point=OSMData.Points) { x = point.X*1000; y = point.Y*1000; newPt = Point.ByCoordinates(x,y,0); }

# group: OSMの建物高さ情報からソリッドをつくる
# note: GIS2BIM
GIS2BIM_OSM3DBuilding = Custom[GIS2BIM_OSM3DBuilding](OSMBuildingpoints=code_block_4.newPt, OSMBuildingKeys=OSMData.Keys)  # package GIS2BIM for Dynamo 2.x; Filter OSM-data and look for buildings with 'height' parameter and create 3D solid

# group: 高さ情報のない点からポリゴンを作る
pruneDuplicates = Point.PruneDuplicates(points=code_block_4.newPt)
byPoints = Polygon.ByPoints(points=pruneDuplicates@L2)
code_block_5 = CodeBlock { ":"; }
split = String.Split(string=OSMData.Keys, separator0=code_block_5)
code_block_6 = CodeBlock { "height"; }
eq = split@@L1 == code_block_6
allFalse = List.AllFalse(list=eq, lacing=Longest)
filterByBoolMask = List.FilterByBoolMask(list=byPoints, mask=allFalse)

# group: 任意の高さでソリッドをつくる
ZAxis = Vector.ZAxis()
code_block_7 = CodeBlock { 15000; }
extrudeAsSolid = Curve.ExtrudeAsSolid(curve=filterByBoolMask.in, direction=ZAxis, distance=code_block_7)

# group: リストを整理
list_create = List.Create(item0=GIS2BIM_OSM3DBuilding, item1=extrudeAsSolid)
flatten = List.Flatten(list=list_create)

# group: DirectShapeをつくる
categories = Categories("OST_Mass")
code_block_8 = CodeBlock { "周辺建物"; }
byName = Material.ByName(name=code_block_8)
byGeometry = DirectShape.ByGeometry(geometry=flatten, category=categories, material=byName, name=code_block_8)

# group: Preview
code_block_9 = CodeBlock {  }

# group: Parameter
code_block_10 = CodeBlock {  }

# group: Tranform
code_block_11 = CodeBlock {  }

# group: Generate
code_block_12 = CodeBlock {  }

# group: Input
code_block_13 = CodeBlock {  }

# group: Process
code_block_14 = CodeBlock {  }
