# Dynamo graph AutoCad.dyn (Dynamo 2.12.0.5650)
# packages: bimorphNodes 4.1.0, spring nodes 204.1.0, Genius Loci 2021.11.10

# group: CADからCurves、Block、Textを取得
select_model_element = DSModelElementSelection()  # 1 picked in the model
code_block = CodeBlock { ["通り芯","木"]; "文字"; }
# note: BimorphNodes
curvesFromCADLayers = CAD.CurvesFromCADLayers(importInstance=select_model_element, layerNames=code_block.out0)
fromLayers = CADTextData.FromLayers(importInstance=select_model_element, layerNames=code_block.out1)
# note: GeniusLoci
cad_block = Custom[CAD Block](importInstance=select_model_element)  # package Genius Loci; Get the location point, name and layer of the CAD blocks / XRefs from a CAD link or import. Please note : The non-uniform scaling of blocks is not supported (The X, Y and Z values ​​of the Block Scale must be the same).

# group: 通り芯のベースCurveの方向によって２つに分ける
code_block_2 = CodeBlock(list=curvesFromCADLayers.Curve) { list[0]; list[1]; }
direction = Line.Direction(line=code_block_2.out0)
XAxis = Vector.XAxis()
dot = Vector.Dot(vector=direction, vec=XAxis)
code_block_3 = CodeBlock(dot=dot) { dot ==0? true:false; }
filterByBoolMask = List.FilterByBoolMask(list=code_block_2.out0, mask=code_block_3)

# group: Y方向カーブを左から右に並び替え
endPoint = Curve.EndPoint(curve=filterByBoolMask.in)
X = Point.X(point=endPoint)
sortByKey = List.SortByKey(list=filterByBoolMask.in, keys=X)

# group: Y方向の通り芯をつくる
byLine = Grid.ByLine(line=sortByKey.sortedList)
code_block_4 = CodeBlock(grid=byLine) { "名前"; 1..#List.Count(grid)..1; }
string_from_object = FromObject(object=code_block_4.out1)
setParameterByName = Element.SetParameterByName(element=byLine, parameterName=code_block_4.out0, value=string_from_object)

# group: 植栽Blockと一番近いTextの基点を探す
# note: BimorphNodes
originPoint = CADTextData.OriginPoint(cADTextData=fromLayers.CADTextData)
# note: Springs
ꟿ_geometry_indexbydistance = Custom[ꟿ Geometry.IndexByDistance](geometry=cad_block.OriginPoint, other=originPoint, lacing=CrossProduct)  # package spring nodes; Provides the index of the closest or farthest geometry. Should prove faster than getting the geometry and finding its index in two separate operations.

# group: Text情報をListを植栽Blockに合わせて並べる
# note: BimorphNodes
textValue = CADTextData.TextValue(cADTextData=fromLayers.CADTextData)
flatten = List.Flatten(list=textValue)
flatten_2 = List.Flatten(list=ꟿ_geometry_indexbydistance.index)
getItemAtIndex = List.GetItemAtIndex(list=flatten, index=flatten_2)

# group: 植栽のファミリを配置
byName = FamilyType.ByName(name=getItemAtIndex)
code_block_5 = CodeBlock(points=cad_block.OriginPoint) { points; }
byPoint = FamilyInstance.ByPoint(familyType=byName@L1, point=code_block_5, lacing=Shortest)

# group: Preview
code_block_6 = CodeBlock {  }

# group: Parameter
code_block_7 = CodeBlock {  }

# group: Tranform
code_block_8 = CodeBlock {  }

# group: Generate
code_block_9 = CodeBlock {  }

# group: Process
code_block_10 = CodeBlock {  }

# group: Input
code_block_11 = CodeBlock {  }

# group: X方向カーブを下から上に並び替え
endPoint_2 = Curve.EndPoint(curve=filterByBoolMask.out)
Y = Point.Y(point=endPoint_2)
sortByKey_2 = List.SortByKey(list=filterByBoolMask.out, keys=Y)

# group: X方向の通り芯をつくる
reverse = List.Reverse(list=sortByKey_2.sortedList)
byLine_2 = Grid.ByLine(line=reverse)
code_block_12 = CodeBlock { "名前"; }
code_block_13 = CodeBlock(grid=byLine_2) { "名前"; "A"..#List.Count(grid)..1; }
setParameterByName_2 = Element.SetParameterByName(element=byLine_2, parameterName=code_block_12, value=code_block_13.out1)
