# Dynamo graph DeleteUnplacedRoom.dyn (Dynamo 2.12.0.5650)

rooms_by_status = RoomsByStatus()
list_create = List.Create(item0=rooms_by_status.UnplacedRooms, item1=rooms_by_status.NotEnclosedRooms, item2=rooms_by_status.RedundantRooms)
delete = Element.Delete(element=list_create)
