# Dynamo graph DeleteOverlappingElements.dyn (Dynamo 2.12.0.5650)

# group: 家具と特殊設備の要素を取得
categories = Categories("OST_Furniture")
categories_2 = Categories("OST_SpecialityEquipment")
list_create = List.Create(item0=categories, item1=categories_2)
all_elements_of_category = ElementsOfCategory(Category=list_create)
flatten = List.Flatten(list=all_elements_of_category)

# group: ファミリタイプ名と位置でグルーピング
string_from_object = FromObject(object=flatten)
groupByKey = List.GroupByKey(list=flatten, keys=string_from_object)
getLocation = Element.GetLocation(element=groupByKey.groups)
string_from_object_2 = FromObject(object=getLocation)
groupByKey_2 = List.GroupByKey(list=groupByKey.groups@L2, keys=string_from_object_2@L2)

# group: 重複する要素をフィルタリング
count = List.Count(list=groupByKey_2.groups@L2)
code_block = CodeBlock { 1; }
gt = count > code_block
filterByBoolMask = List.FilterByBoolMask(mask=gt)  # unwired: list
map = List.Map(list=groupByKey_2.groups, function=filterByBoolMask.in)

# group: 要素を消去
code_block_2 = CodeBlock { 1; }
dropItems = List.DropItems(list=map@L2, amount=code_block_2)
delete = Element.Delete(element=dropItems)

# group: Preview
code_block_3 = CodeBlock {  }

# group: Parameter
code_block_4 = CodeBlock {  }

# group: Tranform
code_block_5 = CodeBlock {  }

# group: Generate
code_block_6 = CodeBlock {  }

# group: Process
code_block_7 = CodeBlock {  }

# group: Input
code_block_8 = CodeBlock {  }
