# Dynamo graph CheckDoorsAndWindows.dyn "CheckFlippedDoorsAndWindows" (Dynamo 2.12.0.5650)
# packages: Genius Loci 2021.11.10

# group: ドアと窓の要素
categories = Categories("OST_Doors")
categories_2 = Categories("OST_Windows")
list_create = List.Create(item0=categories, item1=categories_2)
all_elements_of_category = ElementsOfCategory(Category=list_create)

# group: Views
views = Views("HiddenElements")

# group: 非表示の要素
get_hidden_element = Custom[Get Hidden Element](element=all_elements_of_category, view=views, lacing=Longest)  # package Genius Loci; Reports the hidden elements in the given view.
watch = Watch(get_hidden_element.Hidden_element)

# group: フリップした要素
get_flipped_element = Custom[Get Flipped Element](element=all_elements_of_category, lacing=Longest)  # package Genius Loci; Gets the flipped wall, hand flipped (hinge side) and facing flipped (interior wall side) doors.
watch_2 = Watch(get_flipped_element.Flipped_element)

# group: Preview
code_block = CodeBlock {  }

# group: Parameter
code_block_2 = CodeBlock {  }

# group: Tranform
code_block_3 = CodeBlock {  }

# group: Generate
code_block_4 = CodeBlock {  }

# group: Process
code_block_5 = CodeBlock {  }

# group: Input
code_block_6 = CodeBlock {  }
