# Dynamo graph 2_10_平面図を作る.dyn "10_平面図をつくる" (Dynamo 2.10.1.3976)

number = DoubleInput(8000)
string = StringInput("3F")
byElevationAndName = Level.ByElevationAndName(elevation=number, name=string)
byLevel = FloorPlanView.ByLevel(level=byElevationAndName)

# group: 主要ノード
byElevationAndName_2 = Level.ByElevationAndName()  # unwired: elevation, name
byLevel_2 = FloorPlanView.ByLevel()  # unwired: level
