# Dynamo graph 2_11_天井伏図を作る.dyn "11_天井伏図をつくる" (Dynamo 2.10.1.3976)

number = DoubleInput(8000)
string = StringInput("3F")
byElevationAndName = Level.ByElevationAndName(elevation=number, name=string)
byLevel = CeilingPlanView.ByLevel(level=byElevationAndName)

# group: 主要ノード
byLevel_2 = CeilingPlanView.ByLevel()  # unwired: level
