# Dynamo graph 2_12_断面図を作る.dyn "12_断面図をつくる" (Dynamo 2.10.1.3976)

select_model_element = DSModelElementSelection()  # 1 picked in the model
geometry = Element.Geometry(element=select_model_element)
explode = Geometry.Explode(geometry=geometry)
normalAtParameter = Surface.NormalAtParameter(surface=explode)
ZAxis = Vector.ZAxis()
reverse = Vector.Reverse(vector=ZAxis)
equals = List.Equals(objectA=normalAtParameter@L1, objectB=reverse)
filterByBoolMask = List.FilterByBoolMask(list=explode@L2, mask=equals)
watch_3d = Watch3D(filterByBoolMask.in)
perimeterCurves = Surface.PerimeterCurves(surface=filterByBoolMask.in)
flatten = List.Flatten(list=perimeterCurves)
code_block = CodeBlock(list=flatten) { list[0]; list[1]; }
startPoint = Curve.StartPoint(curve=code_block.out0)
direction = Line.Direction(line=code_block.out0)
ZAxis_2 = Vector.ZAxis()
direction_2 = Line.Direction(line=code_block.out1)
byOriginVectors = CoordinateSystem.ByOriginVectors(origin=startPoint, xAxis=direction, yAxis=ZAxis_2, zAxis=direction_2)
code_block_2 = CodeBlock { 200; }
length = Curve.Length(curve=code_block.out1)
code_block_3 = CodeBlock(wallwidth=code_block_2, zlehgth=length) { -wallwidth; -zlehgth/2; }
min = Point.ByCoordinates(x=code_block_3.out0, z=code_block_3.out1)
length_2 = Curve.Length(curve=code_block.out0)
code_block_4 = CodeBlock(xlength=length_2, wallwidth=code_block_2) { xlength+wallwidth; wallwidth; }
levels = Levels("レベル 2")
elevation = Level.Elevation(level=levels)
levels_2 = Levels("レベル 1")
elevation_2 = Level.Elevation(level=levels_2)
sub = elevation - elevation_2
max = Point.ByCoordinates(x=code_block_4.out0, y=sub, z=code_block_4.wallwidth)
byCoordinateSystemMinPointMaxPoint = SectionView.ByCoordinateSystemMinPointMaxPoint(cs=byOriginVectors, minPoint=min, maxPoint=max)

# group: 主要ノード
byOriginVectors_2 = CoordinateSystem.ByOriginVectors()
byCoordinateSystemMinPointMaxPoint_2 = SectionView.ByCoordinateSystemMinPointMaxPoint()  # unwired: cs, minPoint, maxPoint
