# Dynamo graph 2_1_壁を作る.dyn (Dynamo 2.12.0.5650)

byCoordinates = Point.ByCoordinates()
number_slider = DoubleSlider(7350, range=0..7350 step 0.1)
byCoordinates_2 = Point.ByCoordinates(y=number_slider)
number_slider_2 = DoubleSlider(2350, range=0..7350 step 0.1)
byCoordinates_3 = Point.ByCoordinates(x=number_slider_2, y=number_slider)
byCoordinates_4 = Point.ByCoordinates(x=number_slider_2)
list_create = List.Create(item0=byCoordinates, item1=byCoordinates_2, item2=byCoordinates_3, item3=byCoordinates_4)
boolean = BoolSelector(true)
byPoints = PolyCurve.ByPoints(points=list_create, connectLastToFirst=boolean)
curves = PolyCurve.Curves(polyCurve=byPoints)
levels = Levels("レベル 1")
levels_2 = Levels("レベル 2")
wall_types = WallTypes("標準-150mm")
byCurveAndLevels = Wall.ByCurveAndLevels(curve=curves, startLevel=levels, endLevel=levels_2, wallType=wall_types)

# group: 主要ノード
wall_types_2 = WallTypes()  # nothing selected
byCurveAndLevels_2 = Wall.ByCurveAndLevels()  # unwired: curve, startLevel, endLevel, wallType
