# Dynamo graph 2_3_屋根を作る.dyn (Dynamo 2.12.0.5650)

byCoordinates = Point.ByCoordinates()
number_slider = DoubleSlider(7350, range=0..7350 step 0.1)
byCoordinates_2 = Point.ByCoordinates(y=number_slider)
number_slider_2 = DoubleSlider(2350, range=0..7350 step 0.1)
byCoordinates_3 = Point.ByCoordinates(x=number_slider_2, y=number_slider)
byCoordinates_4 = Point.ByCoordinates(x=number_slider_2)
list_create = List.Create(item0=byCoordinates, item1=byCoordinates_2, item2=byCoordinates_3, item3=byCoordinates_4)
boolean = BoolSelector(true)
byPoints = PolyCurve.ByPoints(points=list_create, connectLastToFirst=boolean)
curves = PolyCurve.Curves(polyCurve=byPoints)
levels = Levels("レベル 1")
levels_2 = Levels("レベル 2")
wall_types = WallTypes("標準-150mm")
byCurveAndLevels = Wall.ByCurveAndLevels(curve=curves, startLevel=levels, endLevel=levels_2, wallType=wall_types)
floor_types = FloorTypes("一般 150 mm")
byOutlineTypeAndLevel = Floor.ByOutlineTypeAndLevel(outline=byPoints, floorType=floor_types, level=levels)
roof_types = RoofTypes("コンクリート-200mm")
byOutlineTypeAndLevel_2 = Roof.ByOutlineTypeAndLevel(outline=byPoints, roofType=roof_types, level=levels_2)

# group: 主要ノード
roof_types_2 = RoofTypes()  # nothing selected
byOutlineTypeAndLevel_3 = Roof.ByOutlineTypeAndLevel()  # unwired: outline, roofType, level
