# Dynamo graph 2_4_部屋を作る.dyn (Dynamo 2.12.0.5650)

byCoordinates = Point.ByCoordinates()
number_slider = DoubleSlider(7350, range=0..7350 step 0.1)
byCoordinates_2 = Point.ByCoordinates(y=number_slider)
number_slider_2 = DoubleSlider(2350, range=0..7350 step 0.1)
byCoordinates_3 = Point.ByCoordinates(x=number_slider_2, y=number_slider)
byCoordinates_4 = Point.ByCoordinates(x=number_slider_2)
list_create = List.Create(item0=byCoordinates, item1=byCoordinates_2, item2=byCoordinates_3, item3=byCoordinates_4)
boolean = BoolSelector(true)
byPoints = PolyCurve.ByPoints(points=list_create, connectLastToFirst=boolean)
curves = PolyCurve.Curves(polyCurve=byPoints)
levels = Levels("レベル 1")
levels_2 = Levels("レベル 2")
wall_types = WallTypes("標準-150mm")
byCurveAndLevels = Wall.ByCurveAndLevels(curve=curves, startLevel=levels, endLevel=levels_2, wallType=wall_types)
floor_types = FloorTypes("一般 150 mm")
byOutlineTypeAndLevel = Floor.ByOutlineTypeAndLevel(outline=byPoints, floorType=floor_types, level=levels)
roof_types = RoofTypes("コンクリート-200mm")
byOutlineTypeAndLevel_2 = Roof.ByOutlineTypeAndLevel(outline=byPoints, roofType=roof_types, level=levels_2)
byPoints_2 = Polygon.ByPoints(points=list_create)
center = Polygon.Center(polygon=byPoints_2)
code_block = CodeBlock { "子供部屋"; "1"; }
byLocation = Room.ByLocation(level=levels, location=center, name=code_block.out0, number=code_block.out1)

# group: 主要ノード
byPoints_3 = Polygon.ByPoints()  # unwired: points
byLocation_2 = Room.ByLocation()  # unwired: level, location
center_2 = Polygon.Center()  # unwired: polygon
