# Dynamo graph 2_5_レベル線を作る.dyn (Dynamo 2.12.0.5650)

number = DoubleInput(8000)
string = StringInput("3F")
byElevationAndName = Level.ByElevationAndName(elevation=number, name=string)

# group: 主要ノード
byElevationAndName_2 = Level.ByElevationAndName()  # unwired: elevation, name
