# Dynamo graph 2_6_通芯を作る.dyn (Dynamo 2.12.0.5650)

code_block = CodeBlock { -3000; 5000; 5; }
code_block_2 = CodeBlock(step=code_block.out2, span=code_block.out1) { 0..#step..span; }
byCoordinates = Point.ByCoordinates(x=code_block_2, y=code_block.out0)
code_block_3 = CodeBlock(step=code_block.out2, span=code_block.out1) { step*span; }
byCoordinates_2 = Point.ByCoordinates(x=code_block_2, y=code_block_3)
byStartPointEndPoint = Line.ByStartPointEndPoint(startPoint=byCoordinates, endPoint=byCoordinates_2)
code_block_4 = CodeBlock(step=code_block.out2, span=code_block.out1) { 0..#step..span; }
byCoordinates_3 = Point.ByCoordinates(x=code_block.out0, y=code_block_4)
byCoordinates_4 = Point.ByCoordinates(x=code_block_3, y=code_block_4)
byStartPointEndPoint_2 = Line.ByStartPointEndPoint(startPoint=byCoordinates_3, endPoint=byCoordinates_4)
list_create = List.Create(item0=byStartPointEndPoint, item1=byStartPointEndPoint_2)
byLine = Grid.ByLine(line=list_create)
code_block_5 = CodeBlock { "名前"; }
code_block_6 = CodeBlock { ["X", "Y"]; }
count = List.Count(list=list_create@L2)
code_block_7 = CodeBlock(listlen=count) { 1..#listlen..1; }
string_from_object = FromObject(object=code_block_7)
add = code_block_6 + string_from_object
setParameterByName = Element.SetParameterByName(element=byLine, parameterName=code_block_5, value=add)

# group: 主要ノード
byLine_2 = Grid.ByLine()  # unwired: line
setParameterByName_2 = Element.SetParameterByName()  # unwired: element, parameterName, value
