# Dynamo graph 2_7_柱を作る.dyn (Dynamo 2.12.0.5650)

family_types = FamilyTypes("RC柱-角:400x400")
code_block = CodeBlock { -3000; 5000; 5; }
code_block_2 = CodeBlock(step=code_block.out2, span=code_block.out1) { 0..#step..span; }
byCoordinates = Point.ByCoordinates(x=code_block_2, y=code_block.out0)
code_block_3 = CodeBlock(step=code_block.out2, span=code_block.out1) { step*span; }
byCoordinates_2 = Point.ByCoordinates(x=code_block_2, y=code_block_3)
byStartPointEndPoint = Line.ByStartPointEndPoint(startPoint=byCoordinates, endPoint=byCoordinates_2)
code_block_4 = CodeBlock(step=code_block.out2, span=code_block.out1) { 0..#step..span; }
byCoordinates_3 = Point.ByCoordinates(x=code_block.out0, y=code_block_4)
byCoordinates_4 = Point.ByCoordinates(x=code_block_3, y=code_block_4)
byStartPointEndPoint_2 = Line.ByStartPointEndPoint(startPoint=byCoordinates_3, endPoint=byCoordinates_4)
intersectAll = Geometry.IntersectAll(geometry=byStartPointEndPoint, others=byStartPointEndPoint_2, lacing=CrossProduct)
levels = Levels("レベル 1")
byPointAndLevel = FamilyInstance.ByPointAndLevel(familyType=family_types, point=intersectAll, level=levels)

# group: 主要ノード
family_types_2 = FamilyTypes()  # nothing selected
byPointAndLevel_2 = FamilyInstance.ByPointAndLevel()  # unwired: familyType, point, level
