# Dynamo graph 2_8_梁を作る.dyn (Dynamo 2.12.0.5650)

code_block = CodeBlock { -3000; 5000; 5; }
code_block_2 = CodeBlock(step=code_block.out2, span=code_block.out1) { 0..#step..span; }
byCoordinates = Point.ByCoordinates(x=code_block_2, y=code_block.out0)
code_block_3 = CodeBlock(step=code_block.out2, span=code_block.out1) { step*span; }
byCoordinates_2 = Point.ByCoordinates(x=code_block_2, y=code_block_3)
byStartPointEndPoint = Line.ByStartPointEndPoint(startPoint=byCoordinates, endPoint=byCoordinates_2)
code_block_4 = CodeBlock(step=code_block.out2, span=code_block.out1) { 0..#step..span; }
byCoordinates_3 = Point.ByCoordinates(x=code_block.out0, y=code_block_4)
byCoordinates_4 = Point.ByCoordinates(x=code_block_3, y=code_block_4)
byStartPointEndPoint_2 = Line.ByStartPointEndPoint(startPoint=byCoordinates_3, endPoint=byCoordinates_4)
intersectAll = Geometry.IntersectAll(geometry=byStartPointEndPoint, others=byStartPointEndPoint_2, lacing=CrossProduct)
flatten = List.Flatten(list=intersectAll@L3)
byPoints = PolyCurve.ByPoints(points=flatten)
transpose = List.Transpose(lists=flatten)
byPoints_2 = PolyCurve.ByPoints(points=transpose)
list_create = List.Create(item0=byPoints, item1=byPoints_2)
ZAxis = Vector.ZAxis()
code_block_5 = CodeBlock { 4000; }
translate = Geometry.Translate(geometry=list_create, direction=ZAxis, distance=code_block_5)
explode = Geometry.Explode(geometry=translate)
levels = Levels("レベル 2")
structural_framing_types = StructuralFramingTypes("400 x 800mm")
beamByCurve = StructuralFraming.BeamByCurve(curve=explode, level=levels, structuralFramingType=structural_framing_types)

# group: 主要ノード
beamByCurve_2 = StructuralFraming.BeamByCurve()  # unwired: curve, level, structuralFramingType
family_types = FamilyTypes()  # nothing selected
