# Dynamo graph 2_9_家具を配置する.dyn (Dynamo 2.12.0.5650)

select_model_element = DSModelElementSelection()  # 1 picked in the model
geometry = Element.Geometry(element=select_model_element)
explode = Geometry.Explode(geometry=geometry)
normalAtParameter = Surface.NormalAtParameter(surface=explode)
ZAxis = Vector.ZAxis()
reverse = Vector.Reverse(vector=ZAxis)
equals = List.Equals(object=normalAtParameter@L1, otherObject=reverse)
filterByBoolMask = List.FilterByBoolMask(list=explode@L2, mask=equals)
watch_3d = Watch3D(filterByBoolMask.in)
family_types = FamilyTypes("ダイニングセット:W1800XD900")
code_block = CodeBlock { 0.5; }
pointAtParameter = Surface.PointAtParameter(surface=filterByBoolMask.in, u=code_block, v=code_block)
byPoint = FamilyInstance.ByPoint(familyType=family_types, point=pointAtParameter)

# group: 主要ノード
byPoint_2 = FamilyInstance.ByPoint()  # unwired: familyType, point
family_types_2 = FamilyTypes()  # nothing selected
