# Dynamo graph 3-1-1_(データ型).dyn "基礎練習" (Dynamo 2.10.1.3976)

family_types = FamilyTypes("RC柱-角:400x400")
select_model_element = DSModelElementSelection()  # 1 picked in the model
geometry = Element.Geometry(element=select_model_element)
code_block = CodeBlock { 10; }
pointsAtEqualChordLength = Curve.PointsAtEqualChordLength(curve=geometry, divisions=code_block)
parameterAtPoint = Curve.ParameterAtPoint(curve=geometry, point=pointsAtEqualChordLength)
pointAtParameter = Curve.PointAtParameter(curve=geometry, param=parameterAtPoint)
levels = Levels("レベル 1")
byPointAndLevel = FamilyInstance.ByPointAndLevel(familyType=family_types, point=pointAtParameter, level=levels)
tangentAtParameter = Curve.TangentAtParameter(curve=geometry, param=parameterAtPoint)
XAxis = Vector.XAxis()
ZAxis = Vector.ZAxis()
angleAboutAxis = Vector.AngleAboutAxis(vector=tangentAtParameter, otherVector=XAxis, rotationAxis=ZAxis)
setRotation = FamilyInstance.SetRotation(familyInstance=byPointAndLevel, degree=angleAboutAxis)
