# Dynamo graph 3-1-2_数学関連処理.dyn (Dynamo 2.12.0.5650)

code_block = CodeBlock { -2; }
abs = Math.Abs(number=code_block)
code_block_2 = CodeBlock { 1..10; }
average = Math.Average(numbers=code_block_2)
code_block_3 = CodeBlock { 1..10; }
sum = Math.Sum(values=code_block_3)
number_slider = DoubleSlider(3.893, range=0..10 step 0.001)
ceiling = Math.Ceiling(number=number_slider)
watch = Watch(ceiling)
number_slider_2 = DoubleSlider(3.893, range=0..10 step 0.001)
floor = Math.Floor(number=number_slider_2)
watch_2 = Watch(floor)
number_slider_3 = DoubleSlider(3.893, range=0..10 step 0.001)
code_block_4 = CodeBlock { 1; }
round = Math.Round(number=number_slider_3, digits=code_block_4)
watch_3 = Watch(round)
number_slider_4 = DoubleSlider(3.893, range=0..10 step 0.001)
round_2 = Math.Round(number=number_slider_4)
watch_4 = Watch(round_2)
number_slider_5 = DoubleSlider(3.893, range=0..10 step 0.001)
code_block_5 = CodeBlock { 2; }
round_3 = Math.Round(number=number_slider_5, digits=code_block_5)
watch_5 = Watch(round_3)
code_block_6 = CodeBlock { 45; }
cos = Math.Cos(angle=code_block_6)
watch_6 = Watch(cos)
code_block_7 = CodeBlock { 90; }
sin = Math.Sin(angle=code_block_7)
watch_7 = Watch(sin)
code_block_8 = CodeBlock { 45; }
tan = Math.Tan(angle=code_block_8)
watch_8 = Watch(tan)
code_block_9 = CodeBlock { 80.12; 80.28; }
min = Math.Min(int1=code_block_9.out0, int2=code_block_9.out1)
watch_9 = Watch(min)
code_block_10 = CodeBlock { 100; 80; }
code_block_11 = CodeBlock { 100; 80; }
max = Math.Max(int1=code_block_11.out0)  # unwired: int2
watch_10 = Watch(max)
code_block_12 = CodeBlock { 1..10; }
code_block_13 = CodeBlock { 5; }
min_2 = Math.Min(value1=code_block_12, value2=code_block_13)
watch_11 = Watch(min_2)
code_block_14 = CodeBlock { 1..10; }
code_block_15 = CodeBlock { 5; }
max_2 = Math.Max(value1=code_block_14, value2=code_block_15)
watch_12 = Watch(max_2)
code_block_16 = CodeBlock { 1..10; }
maximumItem = List.MaximumItem(list=code_block_16)
code_block_17 = CodeBlock { 1..10; }
minimumItem = List.MinimumItem(list=code_block_17)
code_block_18 = CodeBlock { Math.PI; }
watch_13 = Watch(code_block_18)
PI = Math.PI()
watch_14 = Watch(PI)
piTimes2 = Math.PiTimes2()
watch_15 = Watch(piTimes2)
code_block_19 = CodeBlock { 2; }
sqrt = Math.Sqrt(number=code_block_19)
watch_16 = Watch(sqrt)
code_block_20 = CodeBlock { 2; 3; }
pow = Math.Pow(number=code_block_20.out0, power=code_block_20.out1)
watch_17 = Watch(pow)
mapTo = Math.MapTo()  # unwired: rangeMin, rangeMax, inputValue, targetRangeMin, targetRangeMax
map = Math.Map()  # unwired: rangeMin, rangeMax, inputValue
remapRange = Math.RemapRange()  # unwired: numbers
