# Dynamo graph 3-2-2_(SinCosの3DWave).dyn (Dynamo 2.12.0.5650)

number_slider = DoubleSlider(5, range=4..10 step 1)
code_block = CodeBlock(period=number_slider) { 0..period*Math.PI..#100; }
number_slider_2 = DoubleSlider(5000, range=100..5000 step 1)
remapRange = Math.RemapRange(numbers=code_block, newMax=number_slider_2)
byCoordinates = Point.ByCoordinates(x=remapRange, y=remapRange, lacing=CrossProduct)
flatten = List.Flatten(list=byCoordinates)
ZAxis = Vector.ZAxis()
code_block_2 = CodeBlock(pt=flatten) { x= pt.X; y = pt.Y; }
minimumItem = List.MinimumItem(list=code_block)
maximumItem = List.MaximumItem(list=code_block)
remapRange_2 = Math.RemapRange(numbers=code_block_2.x, newMin=minimumItem, newMax=maximumItem)
radiansToDegrees = Math.RadiansToDegrees(radians=remapRange_2)
sin = Math.Sin(angle=radiansToDegrees)
remapRange_3 = Math.RemapRange(numbers=code_block_2.y, newMin=minimumItem, newMax=maximumItem)
radiansToDegrees_2 = Math.RadiansToDegrees(radians=remapRange_3)
cos = Math.Cos(angle=radiansToDegrees_2)
mul = sin * cos
number_slider_3 = DoubleSlider(300, range=100..5000 step 1)
mul_2 = mul * number_slider_3
translate = Geometry.Translate(geometry=flatten, direction=ZAxis, distance=mul_2)
number_slider_4 = DoubleSlider(5, range=4..10 step 1)
code_block_3 = CodeBlock(period=number_slider_4) { 0..period*Math.PI..#100; }
number_slider_5 = DoubleSlider(5000, range=100..5000 step 1)
remapRange_4 = Math.RemapRange(numbers=code_block_3, newMax=number_slider_5)
byCoordinates_2 = Point.ByCoordinates(x=remapRange_4, y=remapRange_4, lacing=CrossProduct)
flatten_2 = List.Flatten(list=byCoordinates_2)
ZAxis_2 = Vector.ZAxis()
code_block_4 = CodeBlock(pt=flatten_2) { x= pt.X; y = pt.Y; }
minimumItem_2 = List.MinimumItem(list=code_block_3)
maximumItem_2 = List.MaximumItem(list=code_block_3)
remapRange_5 = Math.RemapRange(numbers=code_block_4.x, newMin=minimumItem_2, newMax=maximumItem_2)
radiansToDegrees_3 = Math.RadiansToDegrees(radians=remapRange_5)
sin_2 = Math.Sin(angle=radiansToDegrees_3)
remapRange_6 = Math.RemapRange(numbers=code_block_4.y, newMin=minimumItem_2, newMax=maximumItem_2)
radiansToDegrees_4 = Math.RadiansToDegrees(radians=remapRange_6)
cos_2 = Math.Cos(angle=radiansToDegrees_4)
mul_3 = sin_2 * cos_2
number_slider_6 = DoubleSlider(300, range=100..5000 step 1)
mul_4 = mul_3 * number_slider_6
translate_2 = Geometry.Translate(geometry=flatten_2, direction=ZAxis_2, distance=mul_4)
