# Dynamo graph 3-2-2_(Sinカーブ).dyn (Dynamo 2.12.0.5650)

number_slider = DoubleSlider(5, range=0..100 step 0.1)
code_block = CodeBlock(period=number_slider) { 0..period*Math.PI..#100; }
number_slider_2 = DoubleSlider(3000, range=0..3000 step 0.1)
remapRange = Math.RemapRange(numbers=code_block, newMax=number_slider_2)
radiansToDegrees = Math.RadiansToDegrees(radians=code_block)
sin = Math.Sin(angle=radiansToDegrees)
number_slider_3 = DoubleSlider(300, range=0..300 step 0.1)
mul = sin * number_slider_3
byCoordinates = Point.ByCoordinates(x=remapRange, y=mul)
