# Dynamo graph 3-3-3_(条件分岐).dyn "3-3-3_条件分岐" (Dynamo 2.12.0.5650)

code_block = CodeBlock { "チェア"; }
byName = Family.ByName(name=code_block)
types = Family.Types(family=byName)
select_model_element = DSModelElementSelection()  # 1 picked in the model
geometry = Element.Geometry(element=select_model_element)
startPoint = Curve.StartPoint(curve=geometry)
integer_slider = IntegerSlider(5, range=3..8 step 1)
pointsAtEqualSegmentLength = Curve.PointsAtEqualSegmentLength(curve=geometry, divisions=integer_slider)
addItemToFront = List.AddItemToFront(item=startPoint@L1, list=pointsAtEqualSegmentLength@L2)
indexOf = List.IndexOf(list=addItemToFront, element=addItemToFront, lacing=Longest)
count = List.Count(list=types)
mod = indexOf % count
getItemAtIndex = List.GetItemAtIndex(list=types, index=mod)
byPoint = FamilyInstance.ByPoint(familyType=getItemAtIndex, point=addItemToFront)
centerPoint = Circle.CenterPoint(circle=geometry)
byTwoPoints = Vector.ByTwoPoints(start=addItemToFront, end=centerPoint)
YAxis = Vector.YAxis()
ZAxis = Vector.ZAxis()
angleAboutAxis = Vector.AngleAboutAxis(vector=byTwoPoints, otherVector=YAxis, rotationAxis=ZAxis)
setRotation = FamilyInstance.SetRotation(familyInstance=byPoint, degree=angleAboutAxis)
