# Dynamo graph 3-4-1_文字列をつなげる.dyn (Dynamo 2.12.0.5650)

code_block = CodeBlock { ["Family","ふぁみり","1ファミリ","ファミリ","ファミリ2"]; }
code_block_2 = CodeBlock { "ファミリ"; }
startsWith = String.StartsWith(string=code_block, searchFor=code_block_2)
contains = String.Contains(string=code_block, searchFor=code_block_2)
equals = List.Equals(object=code_block, otherObject=code_block_2, lacing=Longest)
byCoordinates = Point.ByCoordinates()
code_block_3 = CodeBlock { 5; }
byCenterPointRadius = Circle.ByCenterPointRadius(centerPoint=byCoordinates, radius=code_block_3)
# note: オブジェクトをそれ自体の文字説明に変換します。
string_from_object = FromObject(object=byCenterPointRadius)
watch = Watch(string_from_object)
code_block_4 = CodeBlock { "("; ")"; " "; "="; ","; }
# note: 1 つまたは複数の区切り文字を指定して文字列を分割します。
split = String.Split(string=watch, separator0=code_block_4.out0, separator1=code_block_4.out1, separator2=code_block_4.out2, separator3=code_block_4.out3, separator4=code_block_4.out4)
watch_2 = Watch(split)
code_block_5 = CodeBlock { "."; }
# note: 文字列に別の文字列が含まれているかどうかを確認します。
contains_2 = String.Contains(string=watch_2, searchFor=code_block_5)
watch_3 = Watch(contains_2)
# note: Code Block で "" マークを使用して文字列を指定するか、文字列ノードに指定します。
code_block_6 = CodeBlock { "こんにちは！GELの石津です。本日もよろしくお願いします。"; }
string = StringInput(" - Mark Twain")
# note: 文字列の大文字/小文字を変更
toUpper = String.ToUpper(string=string)
watch_4 = Watch(toUpper)
# note: 2 つの文字列を 1 つにアタッチすることを「連結する」または「連結」と呼びます。
concat = String.Concat(string0=code_block_6, string1=watch_4)
watch_5 = Watch(concat)
code_block_7 = CodeBlock { "本日"; }
code_block_8 = CodeBlock { "今日"; }
# note: 大きい文字列内にある文字列のインスタンスを置き換えます。
replace = String.Replace(string=watch_5, searchFor=code_block_7, replaceWith=code_block_8)
watch_6 = Watch(replace)
code_block_9 = CodeBlock { "の"; }
# note: より長い文字列内で特定の文字列の出現位置を検出します。
indexOf = String.IndexOf(string=watch_6, searchFor=code_block_9)
watch_7 = Watch(indexOf)
# note: 文字列の文字の合計数を求めます。
length = String.Length(string=watch_6)
watch_8 = Watch(length)
sub = watch_8 - watch_7
# note: 文字列から特定数の文字を削除します。
remove = String.Remove(string=watch_6, startIndex=watch_7, count=sub)
watch_9 = Watch(remove)
code_block_10 = CodeBlock { "GEL"; }
# note: 長い文字列内での文字列の出現回数をカウントします。
countOccurrences = String.CountOccurrences(string=watch_9, searchFor=code_block_10)
watch_10 = Watch(countOccurrences)
code_block_11 = CodeBlock { ["こんにちは、","おはようございます、","こんばんは！"]; }
# note: 文字列
# 次の一連のサンプルでは、文字列の操作に使用できるいくつかの機能を紹介します。その他の機能は Core/String ライブラリにあります。
concat_2 = String.Concat(string0=code_block_11)
code_block_12 = CodeBlock { ","; ["こんにちは","おはようございます","こんばんは"]; }
join = String.Join(separator=code_block_12.out0, string0=code_block_12.out1)
code_block_13 = CodeBlock { "こんにちは!"; "よろしくお願い致します"; }
concat_3 = String.Concat(string0=code_block_13.out0, string1=code_block_13.out1)
code_block_14 = CodeBlock { 0..10; }
byCoordinates_2 = Point.ByCoordinates(x=code_block_14)
string_from_array = FromArray(array=byCoordinates_2)
watch_11 = Watch(string_from_array)
string_from_object_2 = FromObject(object=byCoordinates_2)
watch_12 = Watch(string_from_object_2)
code_block_15 = CodeBlock { "/"; "Category"; "FamilyName"; }
join_2 = String.Join(separator=code_block_15.out0, string0=code_block_15.out1, string1=code_block_15.out2)
code_block_16 = CodeBlock { "Furniture-Desk-Office-Small"; }
code_block_17 = CodeBlock { "-"; }
allIndicesOf = String.AllIndicesOf(string=code_block_16, searchFor=code_block_17)
countOccurrences_2 = String.CountOccurrences()  # unwired: string, searchFor
endsWith = String.EndsWith()  # unwired: string, searchFor
code_block_18 = CodeBlock { ["Family","ふぁみり","1ファミリ","ファミリ","ファミリ2"]; }
length_2 = String.Length(string=code_block_18)
startsWith_2 = String.StartsWith()  # unwired: string, searchFor
code_block_19 = CodeBlock { "ファミリ1234ファミリ"; }
code_block_20 = CodeBlock { 8; "56"; }
insert = String.Insert(string=code_block_19, index=code_block_20.out0, toInsert=code_block_20.out1)
code_block_21 = CodeBlock { "ファミリ1234ファミリ"; }
code_block_22 = CodeBlock { 4; 4; }
remove_2 = String.Remove(string=code_block_21, startIndex=code_block_22.out0, count=code_block_22.out1)
code_block_23 = CodeBlock { "ファミリ1234ファミリ"; }
code_block_24 = CodeBlock { "ファミリ"; ""; }
replace_2 = String.Replace(string=code_block_23, searchFor=code_block_24.out0, replaceWith=code_block_24.out1)
code_block_25 = CodeBlock { "ファミリ1234ファミリ"; }
code_block_26 = CodeBlock { 4; 4; }
substring = String.Substring(string=code_block_25, startIndex=code_block_26.out0, length=code_block_26.out1)
code_block_27 = CodeBlock { 0..10; }
byCoordinates_3 = Point.ByCoordinates(x=code_block_27)
string_from_object_3 = FromObject(object=byCoordinates_3)
code_block_28 = CodeBlock { "("; ")"; " "; "="; ","; }
split_2 = String.Split(string=string_from_object_3, separator0=code_block_28.out0, separator1=code_block_28.out1, separator2=code_block_28.out2, separator3=code_block_28.out3, separator4=code_block_28.out4)
watch_13 = Watch(split_2)
code_block_29 = CodeBlock { ["こんにちは","おはようございます","こんばんは"]; ","; }
split_3 = String.Split(string=code_block_29.out0, separator0=code_block_29.out1)
watch_14 = Watch(split_3)
code_block_30 = CodeBlock { ["Family","ふぁみり","1ファミリ","ファミリ","ファミリ2"]; }
code_block_31 = CodeBlock { "ファミリ"; }
indexOf_2 = String.IndexOf(string=code_block_30, searchFor=code_block_31)
contains_3 = String.Contains()  # unwired: string, searchFor
code_block_32 = CodeBlock { "100"; }
toNumber = String.ToNumber(string=code_block_32)
endsWith_2 = String.EndsWith(string=code_block, searchFor=code_block_2)
code_block_33 = CodeBlock { "Furniture-Desk-Office-Small"; }
code_block_34 = CodeBlock { "-"; }
indexOf_3 = String.IndexOf(string=code_block_33, searchFor=code_block_34)
contains_4 = List.Contains()  # unwired: list, item
categories = Categories("OST_Windows")
views = Views("DynamoView")
all_elements_of_category_in_view = ElementsOfCategoryInView(Category=categories, View=views)
getFamily = FamilyInstance.GetFamily(familyInstance=all_elements_of_category_in_view)
code_block_35 = CodeBlock { 2; }
cycle = List.Cycle(list=getFamily@L1, amount=code_block_35)
transpose = List.Transpose(lists=cycle)
name = Family.Name(family=getFamily)
code_block_36 = CodeBlock { ["すべり","引違い"]; }
contains_5 = String.Contains(string=name, searchFor=code_block_36, lacing=CrossProduct)
transpose_2 = List.Transpose(lists=contains_5)
filterByBoolMask = List.FilterByBoolMask(list=transpose, mask=transpose_2, lacing=Longest)
watch_15 = Watch(filterByBoolMask.in)
categories_2 = Categories("OST_Windows")
views_2 = Views("DynamoView")
all_elements_of_category_in_view_2 = ElementsOfCategoryInView(Category=categories_2, View=views_2)
getFamily_2 = FamilyInstance.GetFamily(familyInstance=all_elements_of_category_in_view_2)
code_block_37 = CodeBlock { 2; }
cycle_2 = List.Cycle(list=getFamily_2@L1, amount=code_block_37)
transpose_3 = List.Transpose(lists=cycle_2)
name_2 = Family.Name(family=getFamily_2)
code_block_38 = CodeBlock { ["すべり","引違い"]; }
contains_6 = String.Contains(string=name_2, searchFor=code_block_38, lacing=CrossProduct)
transpose_4 = List.Transpose(lists=contains_6)
filterByBoolMask_2 = List.FilterByBoolMask(list=transpose_3, mask=transpose_4, lacing=Longest)
watch_16 = Watch(filterByBoolMask_2.in)
