# Dynamo graph 3-4-5_(文字列).dyn "3-4-5_文字列" (Dynamo 2.12.0.5650)

categories = Categories("OST_Windows")
views = Views("DynamoView")
all_elements_of_category_in_view = ElementsOfCategoryInView(Category=categories, View=views)
getFamily = FamilyInstance.GetFamily(familyInstance=all_elements_of_category_in_view)
code_block = CodeBlock { 2; }
cycle = List.Cycle(list=getFamily@L1, amount=code_block)
transpose = List.Transpose(lists=cycle)
name = Family.Name(family=getFamily)
code_block_2 = CodeBlock { ["すべり","引違い"]; }
contains = String.Contains(string=name, searchFor=code_block_2, lacing=CrossProduct)
transpose_2 = List.Transpose(lists=contains)
filterByBoolMask = List.FilterByBoolMask(list=transpose, mask=transpose_2, lacing=Longest)
watch = Watch(filterByBoolMask.in)
