# Dynamo graph 3-4_文字列を操作する.dyn (Dynamo 2.12.0.5650)

# note: 3-4-5 文字列の検索と判定
code_block = CodeBlock { ["Family","ふぁみり","1ファミリ","ファミリ","ファミリ2"]; }
code_block_2 = CodeBlock { "ファミリ"; }
startsWith = String.StartsWith(string=code_block, searchFor=code_block_2)
contains = String.Contains(string=code_block, searchFor=code_block_2)
equals = List.Equals(object=code_block, otherObject=code_block_2, lacing=Longest)
# note: Concat
# note: 3-4-1 文字列をつなげる
code_block_3 = CodeBlock { ["こんにちは、","おはようございます、","こんばんは！"]; }
concat = String.Concat(string0=code_block_3)
# note: Join
code_block_4 = CodeBlock { ","; ["こんにちは","おはようございます","こんばんは"]; }
join = String.Join(separator=code_block_4.out0, string0=code_block_4.out1)
code_block_5 = CodeBlock { "こんにちは!"; "よろしくお願い致します"; }
concat_2 = String.Concat(string0=code_block_5.out0, string1=code_block_5.out1)
# note: 3-4-2 文字列を変換する
code_block_6 = CodeBlock { 0..10; }
byCoordinates = Point.ByCoordinates(x=code_block_6)
string_from_array = FromArray(array=byCoordinates)
watch = Watch(string_from_array)
string_from_object = FromObject(object=byCoordinates)
watch_2 = Watch(string_from_object)
code_block_7 = CodeBlock { "/"; "Category"; "FamilyName"; }
join_2 = String.Join(separator=code_block_7.out0, string0=code_block_7.out1, string1=code_block_7.out2)
code_block_8 = CodeBlock { "Furniture-Desk-Office-Small"; }
code_block_9 = CodeBlock { "-"; }
allIndicesOf = String.AllIndicesOf(string=code_block_8, searchFor=code_block_9)
# note: 3-4-4 文字列の構造
code_block_10 = CodeBlock { ["Family","ふぁみり","1ファミリ","ファミリ","ファミリ2"]; }
length = String.Length(string=code_block_10)
code_block_11 = CodeBlock { "ファミリ1234ファミリ"; }
code_block_12 = CodeBlock { 8; "56"; }
insert = String.Insert(string=code_block_11, index=code_block_12.out0, toInsert=code_block_12.out1)
# note: 3-4-3 文字列を編集する
code_block_13 = CodeBlock { "ファミリ1234ファミリ"; }
code_block_14 = CodeBlock { 4; 4; }
remove = String.Remove(string=code_block_13, startIndex=code_block_14.out0, count=code_block_14.out1)
code_block_15 = CodeBlock { "ファミリ1234ファミリ"; }
code_block_16 = CodeBlock { "ファミリ"; ""; }
replace = String.Replace(string=code_block_15, searchFor=code_block_16.out0, replaceWith=code_block_16.out1)
code_block_17 = CodeBlock { "ファミリ1234ファミリ"; }
code_block_18 = CodeBlock { 4; 4; }
substring = String.Substring(string=code_block_17, startIndex=code_block_18.out0, length=code_block_18.out1)
code_block_19 = CodeBlock { 0..10; }
byCoordinates_2 = Point.ByCoordinates(x=code_block_19)
string_from_object_2 = FromObject(object=byCoordinates_2)
code_block_20 = CodeBlock { "("; ")"; " "; "="; ","; }
split = String.Split(string=string_from_object_2, separator0=code_block_20.out0, separator1=code_block_20.out1, separator2=code_block_20.out2, separator3=code_block_20.out3, separator4=code_block_20.out4)
watch_3 = Watch(split)
code_block_21 = CodeBlock { ["こんにちは","おはようございます","こんばんは"]; ","; }
split_2 = String.Split(string=code_block_21.out0, separator0=code_block_21.out1)
watch_4 = Watch(split_2)
code_block_22 = CodeBlock { ["Family","ふぁみり","1ファミリ","ファミリ","ファミリ2"]; }
code_block_23 = CodeBlock { "ファミリ"; }
indexOf = String.IndexOf(string=code_block_22, searchFor=code_block_23)
code_block_24 = CodeBlock { "100"; }
toNumber = String.ToNumber(string=code_block_24)
endsWith = String.EndsWith(string=code_block, searchFor=code_block_2)
code_block_25 = CodeBlock { "Furniture-Desk-Office-Small"; }
code_block_26 = CodeBlock { "-"; }
indexOf_2 = String.IndexOf(string=code_block_25, searchFor=code_block_26)
