# Dynamo graph 3-5-2_(Dynamoで2Dパターンを作る).dyn (Dynamo 2.12.0.5650)

code_block = CodeBlock { -5..5..~0.75; 5; }
code_block_2 = CodeBlock(x=code_block.out0, y=code_block.out1) { Point.ByCoordinates(x,y); }
code_block_3 = CodeBlock { Point.ByCoordinates(0,0); }
code_block_4 = CodeBlock { x = Vector.XAxis(); y = Vector.YAxis(); z= Vector.ZAxis(); }
code_block_5 = CodeBlock { [0,90,180,270]; }
rotate = Geometry.Rotate(geometry=code_block_2@L1, origin=code_block_3, axis=code_block_4.z, degrees=code_block_5)
number_slider = DoubleSlider(2.8, range=0..5 step 0.1)
number_slider_2 = DoubleSlider(2.8, range=0..5 step 0.1)
code_block_6 = CodeBlock(x=number_slider, y=number_slider_2) { Point.ByCoordinates(x,y); }
byStartPointEndPoint = Line.ByStartPointEndPoint(startPoint=rotate, endPoint=code_block_6)
code_block_7 = CodeBlock(list=byStartPointEndPoint) { List.Flatten(list); }
code_block_8 = CodeBlock { 0..#10..10; }
translate = Geometry.Translate(geometry=code_block_7, direction=code_block_4.x, distance=code_block_8, lacing=CrossProduct)
translate_2 = Geometry.Translate(geometry=translate, direction=code_block_4.y, distance=code_block_8, lacing=CrossProduct)
code_block_9 = CodeBlock(list=translate_2) { List.Flatten(list); }
code_block_10 = CodeBlock()
# ---------- code_block_10.designscript (5 lines) ----------
a = Color.ByARGB(25,100,100,100);
b = Color.ByARGB(255,250,250,250);
colors = [a,b];
count = List.Count(colors);
0..1..#count;
# ----------------------------------------
length = Curve.Length(curve=code_block_9)
remapRange = Math.RemapRange(numbers=length)
color_range = ColorRange(colors=code_block_10.colors, indices=code_block_10.out4, value=remapRange)
byGeometryColor = Modifiers.GeometryColor.ByGeometryColor(geometry=code_block_9, color=color_range)
