# Dynamo graph 4-10_共有パラメータ プロジェクトパラメータの追加.dyn "10共有パラメータ プロジェクトパラメータの追加" (Dynamo 2.10.1.3976)

# group: 全てのカテゴリにプロジェクトパラメータを追加
code_block = CodeBlock { "GEL-ALLCat"; "Sample"; }
select_parameter_type = ParameterType("Text")
select_builtin_parameter_group = BuiltInParameterGroup("PG_DATA")
boolean = BoolSelector(true)
createProjectParameterForAllCategories = Parameter.CreateProjectParameterForAllCategories(parameterName=code_block.out0, groupName=code_block.out1, type=select_parameter_type, group=select_builtin_parameter_group, instance=boolean)  # frozen

# group: 指定のカテゴリにプロジェクトパラメータを追加
code_block_2 = CodeBlock { "GEL-DoorCat"; "Sample"; }
select_parameter_type_2 = ParameterType("Text")
select_builtin_parameter_group_2 = BuiltInParameterGroup("PG_DATA")
boolean_2 = BoolSelector(true)
categories = Categories("OST_Doors")
# note: 他のコンポーネントをフリーズさせてから実行する
createProjectParameter = Parameter.CreateProjectParameter(parameterName=code_block_2.out0, groupName=code_block_2.out1, type=select_parameter_type_2, group=select_builtin_parameter_group_2, instance=boolean_2, categoryList=categories)  # frozen

# group: 共有パラメータの情報取得
sharedParameterFile = Parameter.SharedParameterFile()

# group: 共有パラメータを更新 全てのカテゴリにプロジェクトパラメータを追加
code_block_3 = CodeBlock { "GEL-AllCatType"; "SampleGroup"; }
select_parameter_type_3 = ParameterType("Text")
select_builtin_parameter_group_3 = BuiltInParameterGroup("PG_DATA")
boolean_3 = BoolSelector(false)
# note: 他のコンポーネントをフリーズさせてから実行する
createSharedParameterForAllCategories = Parameter.CreateSharedParameterForAllCategories(parameterName=code_block_3.out0, groupName=code_block_3.out1, type=select_parameter_type_3, group=select_builtin_parameter_group_3, instance=boolean_3)  # frozen

# group: 共有パラメータ更新 指定のカテゴリにプロジェクトパラメータを追加
code_block_4 = CodeBlock { "GEL-DoorType"; "SampleGroup"; }
select_parameter_type_4 = ParameterType("Text")
select_builtin_parameter_group_4 = BuiltInParameterGroup("PG_DATA")
boolean_4 = BoolSelector(false)
# note: 他のコンポーネントをフリーズさせてから実行する
categories_2 = Categories("OST_Doors")
createSharedParameter = Parameter.CreateSharedParameter(parameterName=code_block_4.out0, groupName=code_block_4.out1, type=select_parameter_type_4, group=select_builtin_parameter_group_4, instance=boolean_4, categoryList=categories_2)

# group: Transform
code_block_5 = CodeBlock {  }
