# Dynamo graph 4-1_カテゴリごとに要素を取得.dyn "01カテゴリごとに要素を取得" (Dynamo 2.10.1.3976)

# group: 名前による指定
code_block = CodeBlock { "ドア"; }
byName = Category.ByName(name=code_block)

# group: カテゴリ指定
categories = Categories("OST_Windows")

# group: 要素の取得
all_elements_of_category = ElementsOfCategory(Category=categories)
getFamily = FamilyInstance.GetFamily(familyInstance=all_elements_of_category)

# group: カウント
count = List.Count(list=getFamily)
watch = Watch(count)

# group: カテゴリ指定
categories_2 = Categories("OST_Windows")

# group: ビュー指定
views = Views("レベル 2")

# group: 要素の取得
all_elements_of_category_in_view = ElementsOfCategoryInView(Category=categories_2, View=views)
getFamily_2 = FamilyInstance.GetFamily(familyInstance=all_elements_of_category_in_view)

# group: カウント
count_2 = List.Count(list=getFamily_2)
watch_2 = Watch(count_2)

# group: カテゴリ指定
categories_3 = Categories("OST_Doors")
categories_4 = Categories("OST_Windows")

# group: ビュー指定
views_2 = Views("レベル 1")

# group: 要素の取得
list_create = List.Create(item0=categories_3, item1=categories_4)
all_elements_of_category_in_view_2 = ElementsOfCategoryInView(Category=list_create, View=views_2)
getFamily_3 = FamilyInstance.GetFamily(familyInstance=all_elements_of_category_in_view_2)

# group: カウント
count_3 = List.Count(list=getFamily_3@L2)
watch_3 = Watch(count_3)

# group: Input
code_block_2 = CodeBlock {  }

# group: Transform
code_block_3 = CodeBlock {  }

# group: Preview
code_block_4 = CodeBlock {  }
