# Dynamo graph 4-2_ファミリタイプごとに要素を取得.dyn "02ファミリタイプごとに要素を取得" (Dynamo 2.10.1.3976)

# group: 選択リストから指定
family_types = FamilyTypes("GEL-Chair-一般オフィスチェア:GEL-Chair-一般オフィスチェア")

# group: 名前による指定
code_block = CodeBlock { "GEL-Chair-一般オフィスチェア"; }
byName = FamilyType.ByName(name=code_block)

# group: 選択リストから指定
family_types_2 = FamilyTypes("GEL-Chair-一般オフィスチェア:GEL-Chair-一般オフィスチェア")

# group: 要素の取得
all_elements_of_family_type = ElementsOfFamilyType(Family_Type=family_types_2)

# group: カウント
count = List.Count(list=all_elements_of_family_type)
watch = Watch(count)

# group: 名前による指定
code_block_2 = CodeBlock { "GEL-Chair-一般オフィスチェア"; }
byName_2 = FamilyType.ByName(name=code_block_2)

# group: 要素の取得
all_elements_of_family_type_2 = ElementsOfFamilyType(Family_Type=byName_2)

# group: カウント
count_2 = List.Count(list=all_elements_of_family_type_2)
watch_2 = Watch(count_2)

# group: 選択リストから指定
family_types_3 = FamilyTypes("GEL-Chair-一般オフィスチェア:GEL-Chair-一般オフィスチェア")
family_types_4 = FamilyTypes("GEL-Table-一般オフィスデスク:GEL-Table-一般オフィスデスク")

# group: 要素の取得
list_create = List.Create(item0=family_types_3, item1=family_types_4)
all_elements_of_family_type_3 = ElementsOfFamilyType(Family_Type=list_create)

# group: カウント
count_3 = List.Count(list=all_elements_of_family_type_3@L2)
watch_3 = Watch(count_3)

# group: Input
code_block_3 = CodeBlock {  }

# group: Transform
code_block_4 = CodeBlock {  }

# group: Preview
code_block_5 = CodeBlock {  }
