# Dynamo graph 4-3_エレメントタイプごとに要素を選択.dyn "03エレメントタイプごとに要素を選択" (Dynamo 2.10.1.3976)

# group: 選択リストから指定
element_types = ElementTypes("ViewPlan")

# group: 名前による指定
code_block = CodeBlock { "ViewPlan"; }
byName = ElementType.ByName(name=code_block)

# group: 名前による指定
code_block_2 = CodeBlock { "壁"; }
byName_2 = ElementType.ByName(name=code_block_2)
all_elements_of_type = ElementsOfType(element_type=byName_2)

# group: 平面図/天伏図
element_types_2 = ElementTypes("ViewPlan")
all_elements_of_type_2 = ElementsOfType(element_type=element_types_2)

# group: 立面図/断面図
element_types_3 = ElementTypes("ViewSection")
all_elements_of_type_3 = ElementsOfType(element_type=element_types_3)

# group: シート
element_types_4 = ElementTypes("ViewSheet")
all_elements_of_type_4 = ElementsOfType(element_type=element_types_4)

# group: 集計表 ViewSchedule
element_types_5 = ElementTypes("ViewSchedule")
all_elements_of_type_5 = ElementsOfType(element_type=element_types_5)

# group: 集計表 ScheduleSheetInstance
element_types_6 = ElementTypes("Segment")
all_elements_of_type_6 = ElementsOfType(element_type=element_types_6)

# group: 選択リストから指定
element_types_7 = ElementTypes("ViewPlan")
element_types_8 = ElementTypes("ViewSection")

# group: 要素の取得
list_create = List.Create(item0=element_types_7, item1=element_types_8)
all_elements_of_type_7 = ElementsOfType(element_type=list_create)

# group: Input
code_block_3 = CodeBlock {  }

# group: Transform
code_block_4 = CodeBlock {  }
