# Dynamo graph 4-4-2_(ファミリタイプを変更).dyn (Dynamo 2.12.0.5650)

# group: カテゴリを指定
categories = Categories("OST_Doors")

# group: 要素を取得
all_elements_of_category = ElementsOfCategory(Category=categories)
code_block = CodeBlock { "タイプ"; }
getFamily = FamilyInstance.GetFamily(familyInstance=all_elements_of_category)
types = Family.Types(family=getFamily)
code_block_2 = CodeBlock { 0; }
getItemAtIndex = List.GetItemAtIndex(list=types@L2, index=code_block_2)

# group: パラメータを変更
setParameterByName = Element.SetParameterByName(element=all_elements_of_category, parameterName=code_block, value=getItemAtIndex)
