# Dynamo graph 4-4_インスタンスパラメータの取得・変更.dyn "04インスタンスパラメータの取得・変更" (Dynamo 2.10.1.3976)

# group: カテゴリを指定
categories = Categories("OST_Doors")

# group: 要素を取得
all_elements_of_category = ElementsOfCategory(Category=categories)
parameters = Element.Parameters(element=all_elements_of_category)

# group: パラメータを取得
watch = Watch(parameters)

# group: カテゴリを指定
categories_2 = Categories("OST_Doors")

# group: 要素を取得
all_elements_of_category_2 = ElementsOfCategory(Category=categories_2)
parameters_2 = Element.Parameters(element=all_elements_of_category_2)

# group: パラメータを取得
value = Parameter.Value(parameter=parameters_2)

# group: カテゴリを指定
categories_3 = Categories("OST_Doors")

# group: 要素を取得
all_elements_of_category_3 = ElementsOfCategory(Category=categories_3)
parameters_3 = Element.Parameters(element=all_elements_of_category_3)

# group: パラメータを取得
value_2 = Parameter.Value(parameter=parameters_3)
storageType = Parameter.StorageType(parameter=parameters_3)

# group: カテゴリを指定
categories_4 = Categories("OST_Doors")

# group: 要素を取得
all_elements_of_category_4 = ElementsOfCategory(Category=categories_4)
code_block = CodeBlock { "コメント"; }
getParameterValueByName = Element.GetParameterValueByName(element=all_elements_of_category_4, parameterName=code_block)

# group: パラメータを取得
watch_2 = Watch(getParameterValueByName)

# group: カテゴリを指定
categories_5 = Categories("OST_Doors")

# group: 要素を取得
all_elements_of_category_5 = ElementsOfCategory(Category=categories_5)
code_block_2 = CodeBlock { "コメント"; }
code_block_3 = CodeBlock { "パラメータを変更しました。"; }
setParameterByName = Element.SetParameterByName(element=all_elements_of_category_5, parameterName=code_block_2, value=code_block_3)

# group: パラメータを取得
watch_3 = Watch(setParameterByName)

# group: カテゴリを指定
categories_6 = Categories("OST_Doors")

# group: 要素を取得
all_elements_of_category_6 = ElementsOfCategory(Category=categories_6)
code_block_4 = CodeBlock { "タイプ"; }
getFamily = FamilyInstance.GetFamily(familyInstance=all_elements_of_category_6)
types = Family.Types(family=getFamily)
code_block_5 = CodeBlock { 0; }
getItemAtIndex = List.GetItemAtIndex(list=types@L2, index=code_block_5)

# group: パラメータを変更
setParameterByName_2 = Element.SetParameterByName(element=all_elements_of_category_6, parameterName=code_block_4, value=getItemAtIndex)

# group: Input
code_block_6 = CodeBlock {  }

# group: Transform
code_block_7 = CodeBlock {  }
