# Dynamo graph 4-5-2_(タイプパラメータを変更する).dyn (Dynamo 2.12.0.5650)

# group: カテゴリを指定
categories = Categories("OST_Windows")

# group: 要素を取得
all_elements_of_category = ElementsOfCategory(Category=categories)
code_block = CodeBlock { "タイプ"; }
getParameterValueByName = Element.GetParameterValueByName(element=all_elements_of_category, parameterName=code_block)
uniqueItems = List.UniqueItems(list=getParameterValueByName)

# group: パラメータの取得
parameters = Element.Parameters(element=uniqueItems)
name = Parameter.Name(parameter=parameters)
code_block_2 = CodeBlock { ["サッシ見附","サッシの幅"]; }

# group: パラメータの判定
contains = String.Contains(string=name@@L1, searchFor=code_block_2)
transpose = List.Transpose(lists=contains@@L3)
allFalse = List.AllFalse(list=transpose@@L2)
allTrue = List.AllTrue(list=allFalse@L2)
not_ = Not(x=allTrue)

# group: パラメータの変更
filterByBoolMask = List.FilterByBoolMask(list=uniqueItems, mask=not_)
code_block_3 = CodeBlock { [45,90]; }
setParameterByName = Element.SetParameterByName(element=filterByBoolMask.in@L2, parameterName=code_block_2@L1, value=code_block_3@L1, lacing=Longest)
