# Dynamo graph 4-5_タイプパラメータの取得・変更.dyn "05タイプパラメータの取得・変更" (Dynamo 2.10.1.3976)

# group: パラメータの取得
family_types = FamilyTypes("片開き:w600h2000")
parameters = Element.Parameters(element=family_types)

# group: カテゴリの指定
categories = Categories("OST_Windows")

# group: パラメータの取得
all_elements_of_category = ElementsOfCategory(Category=categories)
code_block = CodeBlock { "タイプ"; }
getParameterValueByName = Element.GetParameterValueByName(element=all_elements_of_category, parameterName=code_block)
uniqueItems = List.UniqueItems(list=getParameterValueByName)

# group: パラメータの取得
family_types_2 = FamilyTypes("片開き:w600h2000")
parameters_2 = Element.Parameters(element=family_types_2)
value = Parameter.Value(parameter=parameters_2)

# group: パラメータの取得
family_types_3 = FamilyTypes()  # nothing selected
parameters_3 = Element.Parameters(element=family_types_3)
value_2 = Parameter.Value(parameter=parameters_3)
storageType = Parameter.StorageType(parameter=parameters_3)

# group: カテゴリの指定
categories_2 = Categories("OST_Doors")

# group: 名前を取得
all_elements_of_category_2 = ElementsOfCategory(Category=categories_2)
name = Family.Name(family=all_elements_of_category_2)

# group: パラメータを取得
byName = FamilyType.ByName(name=name)
code_block_2 = CodeBlock { a= "幅"; b="高さ"; [a,b]; }
getParameterValueByName_2 = Element.GetParameterValueByName(element=byName, parameterName=code_block_2.out2)

# group: カテゴリを指定
categories_3 = Categories("OST_Doors")

# group: 名前を取得
all_elements_of_category_3 = ElementsOfCategory(Category=categories_3)
name_2 = Family.Name(family=all_elements_of_category_3)

# group: パラメータを変更
byName_2 = FamilyType.ByName(name=name_2)
uniqueItems_2 = List.UniqueItems(list=byName_2)
code_block_3 = CodeBlock { "厚さ"; 25; }
setParameterByName = Element.SetParameterByName(element=uniqueItems_2, parameterName=code_block_3.out0, value=code_block_3.out1)

# group: カテゴリを指定
categories_4 = Categories("OST_Windows")

# group: 要素を取得
all_elements_of_category_4 = ElementsOfCategory(Category=categories_4)
code_block_4 = CodeBlock { "タイプ"; }
getParameterValueByName_3 = Element.GetParameterValueByName(element=all_elements_of_category_4, parameterName=code_block_4)
uniqueItems_3 = List.UniqueItems(list=getParameterValueByName_3)

# group: パラメータの取得
parameters_4 = Element.Parameters(element=uniqueItems_3)
name_3 = Parameter.Name(parameter=parameters_4)
code_block_5 = CodeBlock { ["サッシ見附","サッシの幅"]; }

# group: パラメータの判定
contains = String.Contains(str=name_3@@L1, searchFor=code_block_5)
transpose = List.Transpose(lists=contains@@L3)
allFalse = List.AllFalse(list=transpose@@L2)
allTrue = List.AllTrue(list=allFalse@L2)
not_ = Not(x=allTrue)

# group: パラメータの変更
filterByBoolMask = List.FilterByBoolMask(list=uniqueItems_3, mask=not_)
code_block_6 = CodeBlock { [45,90]; }
setParameterByName_2 = Element.SetParameterByName(element=filterByBoolMask.in@L2, parameterName=code_block_5@L1, value=code_block_6@L1, lacing=Longest)

# group: カテゴリを指定
categories_5 = Categories("OST_Windows")

# group: 要素を取得
all_elements_of_category_5 = ElementsOfCategory(Category=categories_5)
code_block_7 = CodeBlock { "タイプ"; }
getParameterValueByName_4 = Element.GetParameterValueByName(element=all_elements_of_category_5, parameterName=code_block_7)
uniqueItems_4 = List.UniqueItems(list=getParameterValueByName_4)

# group: パラメータを取得
parameters_5 = Element.Parameters(element=uniqueItems_4)
name_4 = Parameter.Name(parameter=parameters_5)
code_block_8 = CodeBlock { ["サッシ枠見附","サッシ枠見込"]; }

# group: パラメータの判定
contains_2 = String.Contains(str=name_4@@L1, searchFor=code_block_8)
transpose_2 = List.Transpose(lists=contains_2@@L3)
allFalse_2 = List.AllFalse(list=transpose_2@@L2)
allTrue_2 = List.AllTrue(list=allFalse_2@L2)
not_2 = Not(x=allTrue_2)

# group: パラメータの変更
filterByBoolMask_2 = List.FilterByBoolMask(list=uniqueItems_4, mask=not_2)
code_block_9 = CodeBlock { [40,70]; }
setParameterByName_3 = Element.SetParameterByName(element=filterByBoolMask_2.in@L2, parameterName=code_block_8@L1, value=code_block_9@L1, lacing=Longest)

# group: Input
code_block_10 = CodeBlock {  }

# group: Transform
code_block_11 = CodeBlock {  }
