# Dynamo graph 4-6-4_(新しいファミリタイプを作成する).dyn (Dynamo 2.12.0.5650)

# group: 新しいパラメータを指定
code_block = CodeBlock { " x "; " "; " mm"; "シングル"; }
code_block_2 = CodeBlock { 1000; }
string_from_object = FromObject(object=code_block_2)
code_block_3 = CodeBlock { 2000; }
string_from_object_2 = FromObject(object=code_block_3)
join = String.Join(separator=code_block.out0, string0=string_from_object, string1=string_from_object_2)
concat = String.Concat(string0=join, string1=code_block.out2)
join_2 = String.Join(separator=code_block.out1, string0=concat, string1=code_block.out3)
code_block_4 = CodeBlock(a=code_block_2, b=code_block_3) { ["幅","奥行き"]; [a,b]; }

# group: ファミリタイプを複製
family_types = FamilyTypes("ベッド:1200 x 2000 mm セミダブル")
duplicate = ElementType.Duplicate(elementType=family_types, name=join_2)

# group: パラメータの変更
setParameterByName = Element.SetParameterByName(element=duplicate, parameterName=code_block_4.out0@L1, value=code_block_4.out1@L1)
