# Dynamo graph 4-6_タイプの複製・削除・名前変更.dyn "06タイプの複製・削除・名前変更" (Dynamo 2.10.1.3976)

# group: 新しい名前に変更
family_types = FamilyTypes("固定:0610 x 1220mm")
code_block = CodeBlock { "800 x 2000 mm スモール"; }
duplicate = ElementType.Duplicate(elementType=family_types, name=code_block)

# group: 削除できるか判定
family_types_2 = FamilyTypes("ベッド:1000 x 2000 mm シングル")
canBeDeleted = ElementType.CanBeDeleted(elementType=family_types_2)

# group: 削除できるか判定
canBeDeleted_2 = ElementType.CanBeDeleted()  # unwired: elementType
family_types_3 = FamilyTypes("固定:0610 x 1220mm")

# group: ファミリタイプを削除
code_block_2 = CodeBlock { ""; }
if_ = If(test=canBeDeleted_2, true=family_types_3, false=code_block_2)
delete = Element.Delete(element=if_)

# group: Pythonを用いた名前の変更
family_types_4 = FamilyTypes("ベッド:800×2000 mm スモール")
code_block_3 = CodeBlock { "800 × 2000 mm シングル"; }
python_script = Python(IN[0]=family_types_4, IN[1]=code_block_3)  # CPython3
# ---------- python_script.python (17 lines) ----------
import clr
clr.AddReference("RevitServices")
import RevitServices
from RevitServices.Persistence import DocumentManager
from RevitServices.Transactions import TransactionManager
doc = DocumentManager.Instance.CurrentDBDocument

TransactionManager.Instance.EnsureInTransaction(doc)
#IN[0]にファミリタイプ
familyType = UnwrapElement(IN[0])
#IN[1]にファミリタイプの新しい名前を指定
familyType.Name = IN[1]
output = familyType 
TransactionManager.Instance.TransactionTaskDone()

#アウトにファミリタイプ
OUT = output
# ----------------------------------------

# group: 新しいパラメータを指定
code_block_4 = CodeBlock { " x "; " "; " mm"; "シングル"; }
code_block_5 = CodeBlock { 1000; }
string_from_object = FromObject(object=code_block_5)
code_block_6 = CodeBlock { 2000; }
string_from_object_2 = FromObject(object=code_block_6)
join = String.Join(separator=code_block_4.out0, string0=string_from_object, string1=string_from_object_2)
concat = String.Concat(string0=join, string1=code_block_4.out2)
join_2 = String.Join(separator=code_block_4.out1, string0=concat, string1=code_block_4.out3)
code_block_7 = CodeBlock(a=code_block_5, b=code_block_6) { ["幅","奥行き"]; [a,b]; }

# group: ファミリタイプを複製
family_types_5 = FamilyTypes("ベッド:1200 x 2000 mm セミダブル")
duplicate_2 = ElementType.Duplicate(elementType=family_types_5, name=join_2)

# group: パラメータの変更
setParameterByName = Element.SetParameterByName(element=duplicate_2, parameterName=code_block_7.out0@L1, value=code_block_7.out1@L1)

# group: 名前変更できるか判定
family_types_6 = FamilyTypes("ベッド:1000 x 2000 mm シングル")
canBeRenamed = ElementType.CanBeRenamed(elementType=family_types_6)

# group: Input
code_block_8 = CodeBlock {  }

# group: Transform
code_block_9 = CodeBlock {  }
