# Dynamo graph 4-7_ファミリインスタンスの位置と角度の取得・変更.dyn "07ファミリインスタンスの位置と角度の取得・変更" (Dynamo 2.10.1.3976)

# group: 位置情報の取得
select_model_element = DSModelElementSelection()  # 1 picked in the model
getLocation = Element.GetLocation(element=select_model_element)

# group: 可視化
watch = Watch(getLocation)

# group: 位置情報を取得
select_model_element_2 = DSModelElementSelection()  # 1 picked in the model
getLocation_2 = Element.GetLocation(element=select_model_element_2)
YAxis = Vector.YAxis()
code_block = CodeBlock { 100; }

# group: 新しい位置の指定
translate = Geometry.Translate(geometry=getLocation_2, direction=YAxis, distance=code_block)
setLocation = Element.SetLocation(element=select_model_element_2, geometry=translate)

# group: 位置情報を取得
select_model_element_3 = DSModelElementSelection()  # 1 picked in the model
XAxis = Vector.XAxis()
code_block_2 = CodeBlock { 1000; }
scale = Vector.Scale(vector=XAxis, scale_factor=code_block_2)

# group: 要素を移動
moveByVector = Element.MoveByVector(element=select_model_element_3, vector=scale)

# group: 位置情報を取得
select_model_element_4 = DSModelElementSelection()  # 1 picked in the model
facingOrientation = FamilyInstance.FacingOrientation(familyInstance=select_model_element_4)
YAxis_2 = Vector.YAxis()
reverse = Vector.Reverse(vector=YAxis_2)
ZAxis = Vector.ZAxis()

# group: 方向を指定
angleAboutAxis = Vector.AngleAboutAxis(vector=facingOrientation, otherVector=reverse, rotationAxis=ZAxis)

# group: 可視化
watch_2 = Watch(angleAboutAxis)

# group: 位置情報を取得
select_model_element_5 = DSModelElementSelection()  # 1 picked in the model
code_block_3 = CodeBlock { 90; }
getLocation_3 = Element.GetLocation(element=select_model_element_5)

# group: 新しい角度を指定
setRotation = FamilyInstance.SetRotation(familyInstance=select_model_element_5, degree=code_block_3)

# group: エレメントを回転
setLocation_2 = Element.SetLocation(element=setRotation, geometry=getLocation_3)

# group: Transform
code_block_4 = CodeBlock {  }

# group: Preview
code_block_5 = CodeBlock {  }
