# Dynamo graph 4-8_ファミリドキュメントにパラメータを追加.dyn (Dynamo 2.12.0.5650)

# group: ファミリドキュメントを取得
code_block = CodeBlock { "ソファ－I型"; }
byName = Family.ByName(name=code_block)
familyDocument = Family.FamilyDocument(family=byName)

# group: パラメータを取得
parameters = FamilyDocument.Parameters(familyDocument=familyDocument)

# group: ファミリドキュメントを取得
code_block_2 = CodeBlock { "ソファ－I型"; }
byName_2 = Family.ByName(name=code_block_2)
familyDocument_2 = Family.FamilyDocument(family=byName_2)

# group: ファミリドキュメントを取得
code_block_3 = CodeBlock { "ソファ－I型"; }
byName_3 = Family.ByName(name=code_block_3)
familyDocument_3 = Family.FamilyDocument(family=byName_3)

# group: パラメータを取得
parameters_2 = FamilyDocument.Parameters(familyDocument=familyDocument_3)

# group: パラメータのグループを取得
group = FamilyParameter.Group(familyParameter=parameters_2)

# group: ファミリのドキュメントを取得
code_block_4 = CodeBlock { "ソファ－I型"; }
byName_4 = Family.ByName(name=code_block_4)
familyDocument_4 = Family.FamilyDocument(family=byName_4)

# group: パラメータを取得
parameters_3 = FamilyDocument.Parameters(familyDocument=familyDocument_4)

# group: ファミリタイプを取得
parameterType = FamilyParameter.ParameterType(familyParameter=parameters_3)

# group: パラメータのグループを取得
group_2 = FamilyParameter.Group(familyParameter=parameters_3)

# group: ファミリのドキュメントを取得
code_block_5 = CodeBlock { "ソファ－I型"; }
byName_5 = Family.ByName(name=code_block_5)
familyDocument_5 = Family.FamilyDocument(family=byName_5)

# group: パラメータを追加
code_block_6 = CodeBlock { "新しいパラメータ3"; }
code_block_7 = CodeBlock { "PG_DATA"; }
code_block_8 = CodeBlock { "Text"; }
boolean = BoolSelector(true)
addParameter = FamilyDocument.AddParameter(familyDocument=familyDocument_5, parameterName=code_block_6, parameterGroup=code_block_7, parameterType=code_block_8, isInstance=boolean)

select_builtin_parameter_group = BuiltInParameterGroup()  # nothing selected
select_parameter_type = ParameterType()  # nothing selected

# group: パラメータを追加するPythonプログラム
family_types = FamilyTypes("ソファ－I型:900 x 750mm")
code_block_9 = CodeBlock { "新しいパラメータ"; }
boolean_2 = BoolSelector(true)
python_script = Python(IN[0]=family_types, IN[1]=code_block_9, IN[2]=boolean_2)  # IronPython2
# ---------- python_script.python (53 lines) ----------
import clr
clr.AddReference("RevitServices")
from RevitServices.Persistence import DocumentManager
from RevitServices.Transactions import TransactionManager
clr.AddReference("RevitAPI")
from Autodesk.Revit.DB import *
# 結果用のリスト
result = []
familyType = UnwrapElement(IN[0])
# プロジェクトの現在のドキュメント
doc = DocumentManager.Instance.CurrentDBDocument
# ファミリシンボルのエレメントを取り出す
allcollector = FilteredElementCollector(doc).OfClass(FamilySymbol)
fam_symb_lst = allcollector.ToElements()
# ファミリシンボルのfamilyTypeと同じファミリシンボルを取り出す
filter_symbol = [x for x in fam_symb_lst if x.Id == familyType.Id][0]
# ファミリシンボルからファミリ要素を取得
family = filter_symbol.Family
# プロジェクトファイル内のファミリファイルの上書き設定用のクラス
class FamOpt1(IFamilyLoadOptions):
    def __init__(self): pass
    def OnFamilyFound(self, familyInUse, overwriteParameterValues):
        return True
    def OnSharedFamilyFound(self, familyInUse, source,overwriteParameterValues): return True
   
# パラメータ名、パラメータタイプ、パラメータグループ、インスタンスかどうか
par_name = IN[1]
par_type = ParameterType.Text
par_grp = BuiltInParameterGroup.PG_DATA
inst_or_typ = IN[2]
# トランザクションを作る
trans1 = TransactionManager.Instance
trans1.ForceCloseTransaction()
# ファミリドキュメントを取得
famdoc = doc.EditFamily(family)
# トランザクションを開始
try:
    trans1.EnsureInTransaction(famdoc)
     # ファミリにパラメータを追加
    famdoc.FamilyManager.AddParameter(par_name, par_grp, par_type,inst_or_typ)
    trans1.ForceCloseTransaction()
    # ファミリをロードする
    famdoc.LoadFamily(doc, FamOpt1())
    # 結果を追加
    result.append(True)
except:
    trans1.ForceCloseTransaction()
    # 結果を追加
    result.append(False)
    
# ファミリドキュメントを閉じる
famdoc.Close(False)
OUT = result
# ----------------------------------------

# group: パラメータを追加するPythonプログラム
family_types_2 = FamilyTypes("ソファ－I型:900 x 750mm")
code_block_10 = CodeBlock { "新しいパラメータ_New"; }
boolean_3 = BoolSelector(true)
python_script_2 = Python(IN[0]=family_types_2, IN[1]=code_block_10, IN[2]=boolean_3)  # IronPython2
# ---------- python_script_2.python (53 lines) ----------
import clr
clr.AddReference("RevitServices")
from RevitServices.Persistence import DocumentManager
from RevitServices.Transactions import TransactionManager
clr.AddReference("RevitAPI")
from Autodesk.Revit.DB import *
# 結果用のリスト
result = []
familyType = UnwrapElement(IN[0])
# プロジェクトの現在のドキュメント
doc = DocumentManager.Instance.CurrentDBDocument
# ファミリシンボルのエレメントを取り出す
allcollector = FilteredElementCollector(doc).OfClass(FamilySymbol)
fam_symb_lst = allcollector.ToElements()
# ファミリシンボルのfamilyTypeと同じファミリシンボルを取り出す
filter_symbol = [x for x in fam_symb_lst if x.Id == familyType.Id][0]
# ファミリシンボルからファミリ要素を取得
family = filter_symbol.Family
# プロジェクトファイル内のファミリファイルの上書き設定用のクラス
class FamOpt1(IFamilyLoadOptions):
    def __init__(self): pass
    def OnFamilyFound(self, familyInUse, overwriteParameterValues):
        return True
    def OnSharedFamilyFound(self, familyInUse, source,overwriteParameterValues): return True
   
# パラメータ名、パラメータタイプ、パラメータグループ、インスタンスかどうか
par_name = IN[1]
par_specId = SpecTypeId.String.Text
par_grp = GroupTypeId.Data
inst_or_typ = IN[2]
# トランザクションを作る
trans1 = TransactionManager.Instance
trans1.ForceCloseTransaction()
# ファミリドキュメントを取得
famdoc = doc.EditFamily(family)
# トランザクションを開始
try:
    trans1.EnsureInTransaction(famdoc)
     # ファミリにパラメータを追加
    famdoc.FamilyManager.AddParameter(par_name,par_grp,par_specId,inst_or_typ)
    trans1.ForceCloseTransaction()
    # ファミリをロードする
    famdoc.LoadFamily(doc, FamOpt1())
    # 結果を追加
    result.append(True)
except:
    trans1.ForceCloseTransaction()
    # 結果を追加
    result.append(False)
    
# ファミリドキュメントを閉じる
famdoc.Close(False)
OUT = result
# ----------------------------------------
