# Dynamo graph 4-9_プロジェクトドキュメントの情報を取得・変更.dyn "09プロジェクトドキュメントの情報を取得・変更" (Dynamo 2.10.1.3976)

# group: アクティブビューの情報を取得
current = Document.Current()
activeView = Document.ActiveView(document=current)

# group: ファイルパスを取得
current_2 = Document.Current()
filePath = Document.FilePath(document=current_2)

# group: ワークシェアリングのパスを取得
current_3 = Document.Current()
worksharingPath = Document.WorksharingPath(document=current_3)

# group: ファミリドキュメントか判定
current_4 = Document.Current()
isFamilyDocument = Document.IsFamilyDocument(document=current_4)

# group: プロジェクト設定の位置情報を取得
current_5 = Document.Current()
location = Document.Location(document=current_5)

# group: ファミリを指定のフォルダに保存
current_6 = Document.Current()
code_block = CodeBlock { "ダイニングテーブル"; }
byName = Family.ByName(name=code_block)
directory_path = Directory("C:\Users\rhagi\Desktop")
saveFamilyToFolder = Document.SaveFamilyToFolder(document=current_6, family=byName, directoryPath=directory_path)

# group: Transform
code_block_2 = CodeBlock {  }
