# Dynamo graph 5-1_CSVに書き込む.dyn (Dynamo 2.12.0.5650)

# group: CSVで書き出す
file_path = Filename("5-1\FamilyData.csv")
code_block = CodeBlock { a = ["Name", "Age", "Email"]; b = ["Mark","23","mark@ooo.com"]; c = ["Emily","33","emily@ooo.com"]; data = [a,b,c]; }
exportCSV = Data.ExportCSV(filePath=file_path, data=code_block.data)

# group: データの可視化
watch = Watch(code_block.data)

# group: 要素を指定して取り出す
categories = Categories("OST_IOSModelGroups")
views = Views("DynamoView")
all_elements_of_category_in_view = ElementsOfCategoryInView(Category=categories, View=views)
name = Element.Name(element=all_elements_of_category_in_view)
code_block_2 = CodeBlock { "DeskSet"; }
eq = name == code_block_2
filterByBoolMask = List.FilterByBoolMask(list=all_elements_of_category_in_view, mask=eq)

# group: モデルグループの情報を取得
id = Element.Id(element=filterByBoolMask.in)
location = Group.Location(group=filterByBoolMask.in)
code_block_3 = CodeBlock(points=location) { points; }
code_block_4 = CodeBlock(pt=code_block_3) { pt.X; pt.Y; pt.Z; }

# group: モデルグループの角度を計測
getMembers = Group.GetMembers(group=filterByBoolMask.in)
code_block_5 = CodeBlock { 1; }
getItemAtIndex = List.GetItemAtIndex(list=getMembers@L2, index=code_block_5)
facingOrientation = FamilyInstance.FacingOrientation(familyInstance=getItemAtIndex)
YAxis = Vector.YAxis()
ZAxis = Vector.ZAxis()
angleAboutAxis = Vector.AngleAboutAxis(vector=facingOrientation, otherVector=YAxis, rotationAxis=ZAxis)

# group: 部屋のジオメトリ情報を取得
categories_2 = Categories("OST_Rooms")
views_2 = Views("レベル 1")
all_elements_of_category_in_view_2 = ElementsOfCategoryInView(Category=categories_2, View=views_2)
name_2 = Room.Name(room=all_elements_of_category_in_view_2)
geometry = Element.Geometry(element=all_elements_of_category_in_view_2)

# group: 底面のSurfaceを取り出す
explode = Geometry.Explode(geometry=geometry)
code_block_6 = CodeBlock(surfaces=explode) { surfaces; }
normalAtParameter = Surface.NormalAtParameter(surface=explode)
Z = Vector.Z(vector=normalAtParameter)
code_block_7 = CodeBlock { -1; }
eq_2 = Z == code_block_7
filterByBoolMask_2 = List.FilterByBoolMask(list=code_block_6, mask=eq_2)
code_block_8 = CodeBlock(surfaces=filterByBoolMask_2.in) { surfaces; }

# group: モデルグループの位置を判別
code_block_9 = CodeBlock(points=location) { points; }
perimeterCurves = Surface.PerimeterCurves(surface=code_block_8)
startPoint = Curve.StartPoint(curve=perimeterCurves)
byPoints = Polygon.ByPoints(points=startPoint)
flatten = List.Flatten(list=byPoints)
containmentTest = Polygon.ContainmentTest(polygon=flatten, point=code_block_9)

# group: 部屋のデータを作成
code_block_10 = CodeBlock(roomname=name_2) { roomname; }
count = List.Count(list=code_block_9)
ofRepeatedItem = List.OfRepeatedItem(item=code_block_10, amount=count)
transpose = List.Transpose(lists=ofRepeatedItem@L3)
filterByBoolMask_3 = List.FilterByBoolMask(list=transpose@L1, mask=containmentTest@L1)
flatten_2 = List.Flatten(list=filterByBoolMask_3.in)

# group: ヘッダーの追加
code_block_11 = CodeBlock { ["ID","x","y","z","angle","room"]; }
list_create = List.Create(item0=id, item1=code_block_4.out0, item2=code_block_4.out1, item3=code_block_4.out2, item4=angleAboutAxis, item5=flatten_2)
transpose_2 = List.Transpose(lists=list_create)
addItemToFront = List.AddItemToFront(item=code_block_11, list=transpose_2)

# group: データのエクスポート
file_path_2 = Filename("5-1\DeskData.csv")
exportCSV_2 = Data.ExportCSV(filePath=file_path_2, data=addItemToFront)
