# Dynamo graph 5-2_CSVを読み込む.dyn "02CSVを読み込む" (Dynamo 2.10.1.3976)
# packages: Elements.Rotate 1.3.0

file_path = Filename("C:\Users\rhagi\Downloads\FamiyData.csv")
code_block = CodeBlock { a = ["Name", "Age", "Email"]; b = ["Mark","23","mark@ooo.com"]; c = ["Emily","33","emily@ooo.com"]; data = [a,b,c]; }
exportCSV = Data.ExportCSV(filePath=file_path, data=code_block.data)
watch = Watch(code_block.data)
file_path_2 = Filename("C:\Users\rhagi\Downloads\FamiyData.csv")
boolean = BoolSelector(true)
importCSV = Data.ImportCSV(filePath=file_path_2, transpose=boolean)
file_path_3 = Filename("C:\Users\rhagi\Downloads\FamiyData.csv")
boolean_2 = BoolSelector(false)
importCSV_2 = Data.ImportCSV(filePath=file_path_3, transpose=boolean_2)
file_path_4 = Filename("C:\Users\rhagi\Downloads\FamiyData.csv")
boolean_3 = BoolSelector(true)
importCSV_3 = Data.ImportCSV(filePath=file_path_4, transpose=boolean_3)
deconstruct = List.Deconstruct(list=importCSV_3)
watch_2 = Watch(deconstruct.first)
watch_3 = Watch(deconstruct.rest)
file_path_5 = Filename("..\..\DeskData.csv")
boolean_4 = BoolSelector(true)
importCSV_4 = Data.ImportCSV(filePath=file_path_5, transpose=boolean_4)
deconstruct_2 = List.Deconstruct(list=importCSV_4)
code_block_2 = CodeBlock { [1,2,5]; }
getItemAtIndex = List.GetItemAtIndex(list=deconstruct_2.rest@L2, index=code_block_2)
transpose = List.Transpose(lists=getItemAtIndex)
code_block_3 = CodeBlock(list=transpose) { list[0]; list[1]; }
levels = Levels("レベル 2")
elevation = Level.Elevation(level=levels)
byCoordinates = Point.ByCoordinates(x=code_block_3.out0, y=code_block_3.out1, z=elevation)
code_block_4 = CodeBlock { "DeskSet"; }
byName = ElementType.ByName(name=code_block_4)
placeInstance = Group.PlaceInstance(location=byCoordinates, groupType=byName)
code_block_5 = CodeBlock(list=transpose) { list[2]; }
code_block_6 = CodeBlock(x=code_block_5) { x*(-1); }
degreesToRadians = Math.DegreesToRadians(degrees=code_block_6)
ZAxis = Vector.ZAxis()
rotate = Custom[Elements.Rotate](elements=byName, angles=degreesToRadians, vector=ZAxis, lacing=Longest)  # package Elements.Rotate; Rotates Element(s) over axis (Vector) by list of angles (radian and counterclockwise)
setLocation = Element.SetLocation(element=rotate, geometry=byCoordinates)  # frozen
watch_4 = Watch(deconstruct_2.first)
