# Dynamo graph 5-3_Excelに書き込む.dyn (Dynamo 2.12.0.5650)

# group: Excelに書き出す
file_path = Filename(".\Export_Simple.xlsx")
code_block = CodeBlock { "Sheet1"; }
code_block_2 = CodeBlock { 2; 3; }
code_block_3 = CodeBlock { a= ["Name", "X", "Y"]; b = ["1","5000","-12000"]; c = ["2","6000","-7000"]; list = [a,b,c]; }
boolean = BoolSelector(false)
exportExcel = Data.ExportExcel(filePath=file_path, sheetName=code_block, startRow=code_block_2.out0, startColumn=code_block_2.out1, data=code_block_3.list, overWrite=boolean)

# group: 通芯を指定
categories = Categories("OST_Grids")
all_elements_of_category = ElementsOfCategory(Category=categories)
name = Element.Name(element=all_elements_of_category)
curve = Grid.Curve(grid=all_elements_of_category)

# group: 位置データを整理
startPoint = Curve.StartPoint(curve=curve)
code_block_4 = CodeBlock(pt=startPoint) { pt.X; pt.Y; }
endPoint = Curve.EndPoint(curve=curve)
code_block_5 = CodeBlock(pt=endPoint) { pt.X; pt.Y; }
list_create = List.Create(item0=name, item1=code_block_4.out0, item2=code_block_4.out1, item3=code_block_5.out0, item4=code_block_5.out1)
transpose = List.Transpose(lists=list_create)

# group: Excelに書き出す
file_path_2 = Filename(".\Excel_Export_Start.xlsx")
code_block_6 = CodeBlock { "Sheet1"; }
code_block_7 = CodeBlock { 3; 1; }
boolean_2 = BoolSelector(false)
exportExcel_2 = Data.ExportExcel(filePath=file_path_2, sheetName=code_block_6, startRow=code_block_7.out0, startColumn=code_block_7.out1, data=transpose, overWrite=boolean_2)

# group: Input
code_block_8 = CodeBlock {  }

# group: Transform
code_block_9 = CodeBlock {  }

# group: Preview
code_block_10 = CodeBlock {  }
