# Dynamo graph 5-4_Excelを読み込む.dyn "04Excelを読み込む" (Dynamo 2.10.1.3976)

# group: Excelを読み込む
file_path = Filename("C:\Users\rhagi\Downloads\Export_Simple.xlsx.xlsx")
file_from_path = FileObject(path=file_path)
code_block = CodeBlock { "Sheet1"; }
boolean = BoolSelector(true)
boolean_2 = BoolSelector(true)
importExcel = Data.ImportExcel(file=file_from_path, sheetName=code_block, readAsStrings=boolean, showExcel=boolean_2)

# group: データの可視化
watch = Watch(importExcel)

# group: Excelを読み込む
file_path_2 = Filename("..\..\Excel_Export_End.xlsx")
file_from_path_2 = FileObject(path=file_path_2)
code_block_2 = CodeBlock { "Sheet2"; }
boolean_3 = BoolSelector(false)
boolean_4 = BoolSelector(false)
importExcel_2 = Data.ImportExcel(file=file_from_path_2, sheetName=code_block_2, readAsStrings=boolean_3, showExcel=boolean_4)
watch_2 = Watch(importExcel_2)

# group: 位置データを整理
code_block_3 = CodeBlock { 2; }
dropItems = List.DropItems(list=watch_2, amount=code_block_3)
watch_3 = Watch(dropItems)
transpose = List.Transpose(lists=watch_3)

# group: Gridの基準を作成
code_block_4 = CodeBlock(data=transpose) { data[0]; data[1]; data[2]; data[3]; data[4]; }
byCoordinates = Point.ByCoordinates(x=code_block_4.out1, y=code_block_4.out2)
byCoordinates_2 = Point.ByCoordinates(x=code_block_4.out3, y=code_block_4.out4)
byStartPointEndPoint = Line.ByStartPointEndPoint(startPoint=byCoordinates, endPoint=byCoordinates_2)
watch_4 = Watch(code_block_4.out0)

# group: 数値を文字列に変換
string_from_object = FromObject(object=watch_4)
code_block_5 = CodeBlock { "."; }
split = String.Split(str=string_from_object, separator0=code_block_5)
transpose_2 = List.Transpose(lists=split)
code_block_6 = CodeBlock(list=transpose_2) { list[0]; }

# group: 名前を変換
byLine = Grid.ByLine(line=byStartPointEndPoint)
code_block_7 = CodeBlock { "名前"; }
setParameterByName = Element.SetParameterByName(element=byLine, parameterName=code_block_7, value=code_block_6)

# group: Input
code_block_8 = CodeBlock {  }

# group: Transform
code_block_9 = CodeBlock {  }

# group: Generate
code_block_10 = CodeBlock {  }

# group: Preview
code_block_11 = CodeBlock {  }
