# Dynamo graph 5-5_パスの操作.dyn (Dynamo 2.12.0.5650)

# group: 複数のPathを組み合わせる
directory_path = Directory("C:\")
code_block = CodeBlock { "Test"; }
combinePath = FileSystem.CombinePath(string0=directory_path, string1=code_block)
watch = Watch(combinePath)

# group: Pathをファイル名に分解
directory_path_2 = Directory("C:\")
string = StringInput("\")
split = String.Split(string=directory_path_2, separator0=string)

# group: PathからFileを作成
directory_path_3 = Directory("G:\My Drive\BNN\RevitDynamoData\配布用\Chapter5\5-5\SubDirectionary\SubSubDirectionary")
file_from_path = FileObject(path=directory_path_3)
watch_2 = Watch(file_from_path)

# group: DirectoryからFileを作成
directory_path_4 = Directory("C:\Users\rhagi\Desktop\Subdirectory\SubSubdirectory")
directory_from_path = DirectoryObject(path=directory_path_4)
watch_3 = Watch(directory_from_path)

# group: PathからFileの拡張子を選択
file_path = Filename("5-5\SubDirectionary\SubSubDirectionary\SubSubDirectionary.txt")
fileExtension = FileSystem.FileExtension(path=file_path)

# group: PathからFileの名前を返す
file_path_2 = Filename("5-5\SubDirectionary\SubSubDirectionary\SubSubDirectionary.txt")
fileName = FileSystem.FileName(path=file_path_2)
watch_4 = Watch(fileName)

# group: PathからFileの名前を返す（拡張子なし）
file_path_3 = Filename("5-5\SubDirectionary\SubSubDirectionary\SubSubDirectionary.txt")
boolean = BoolSelector(false)
fileName_2 = FileSystem.FileName(path=file_path_3, withExtension=boolean)
watch_5 = Watch(fileName_2)

# group: PathからDirectoryの名前を返す
file_path_4 = Filename("5-5\SubDirectionary\SubSubDirectionary\SubSubDirectionary.txt")
directoryName = FileSystem.DirectoryName(path=file_path_4)
watch_6 = Watch(directoryName)

# group: ディレクトリの場所を可視化
directory_path_5 = Directory("C:\")
watch_7 = Watch(directory_path_5)

# group: 絶対パス
file_path_5 = Filename("5-5\SubDirectionary\SubSubDirectionary\SubSubDirectionary.txt")
watch_8 = Watch(file_path_5)

# group: 絶対パス
file_path_6 = Filename("5-5\SubDirectionary\SubSubDirectionary\SubSubDirectionary.txt")
watch_9 = Watch(file_path_6)

# group: 相対パス
string_2 = StringInput(".\Sample.txt")
file_from_path_2 = FileObject(path=string_2)
watch_10 = Watch(file_from_path_2)

# group: 相対パス
string_3 = StringInput("..\Sample2.txt")
file_from_path_3 = FileObject(path=string_3)
watch_11 = Watch(file_from_path_3)

# group: ファイルの場所を可視化
file_path_7 = Filename("5-5\Test\Test.txt")
watch_12 = Watch(file_path_7)
