# Dynamo graph 5-6_ディレクトリの操作.dyn (Dynamo 2.12.0.5650)

# group: PathからDirectoryを作成
code_block = CodeBlock { "C://Test//Subdirectory"; }
directory_from_path = DirectoryObject(path=code_block)
watch = Watch(directory_from_path)

# group: Directoryを移動
code_block_2 = CodeBlock { "C://Test//Subdirectory//SubSubdirectory//Move"; }
code_block_3 = CodeBlock { "C://Test//Subdirectory//Move"; }
boolean = BoolSelector(true)
moveDirectory = FileSystem.MoveDirectory(path=code_block_2, newPath=code_block_3, overwriteFiles=boolean)

# group: Directoryを複製
code_block_4 = CodeBlock { "C://Test//Subdirectory//Move"; }
code_block_5 = CodeBlock { "C://Test//Subdirectory//SubSubdirectory//Move"; }
boolean_2 = BoolSelector(true)
copyDirectory = FileSystem.CopyDirectory(directory=code_block_4, destinationPath=code_block_5, overwriteFiles=boolean_2)

# group: 指定のDirectoryが存在するか判別
directory_path = Directory("G:\My Drive\BNN\RevitDynamoData\配布用\Chapter5\5-6\SubDirectionary\SubSubDirectionary")
directoryExists = FileSystem.DirectoryExists(path=directory_path)

# group: 指定のDirectoryが存在するか判別
code_block_6 = CodeBlock { "C://Subdirectory"; }
directoryExists_2 = FileSystem.DirectoryExists(path=code_block_6)

# group: Directoryを削除
code_block_7 = CodeBlock { "C://Test//Subdirectory//SubSubdirectory//Move"; }
boolean_3 = BoolSelector(false)
deleteDirectory = FileSystem.DeleteDirectory(path=code_block_7, recursive=boolean_3)

# group: 指定Directory内のコンテンツを取得（下の階層も取得）
directory_path_2 = Directory("G:\My Drive\BNN\RevitDynamoData\配布用\Chapter5\5-6\SubDirectionary")
directory_from_path_2 = DirectoryObject(path=directory_path_2)
boolean_4 = BoolSelector(true)
getDirectoryContents = FileSystem.GetDirectoryContents(directory=directory_from_path_2, includeSubdirectories=boolean_4)
watch_2 = Watch(getDirectoryContents.files)
watch_3 = Watch(getDirectoryContents.directories)

# group: 指定Directory内のコンテンツを取得（指定した階層のみ取得）
directory_path_3 = Directory("C:\Users\rhagi\Desktop\Subdirectory\SubSubdirectory")
directory_from_path_3 = DirectoryObject(path=directory_path_3)
code_block_8 = CodeBlock { "*.txt"; }
boolean_5 = BoolSelector(true)
getDirectoryContents_2 = FileSystem.GetDirectoryContents(directory=directory_from_path_3, searchString=code_block_8, includeSubdirectories=boolean_5)
watch_4 = Watch(getDirectoryContents_2.directories)
watch_5 = Watch(getDirectoryContents_2.files)
