# Dynamo graph 5-7_ファイルの操作.dyn (Dynamo 2.12.0.5650)

# group: 指定ファイルが存在するか判別
file_path = Filename("C:\Users\rhagi\Desktop\Test\Test.txt")
fileExists = FileSystem.FileExists(path=file_path)

# group: テキストファイルの新規作成
code_block = CodeBlock { "..//Test//create.txt"; }
code_block_2 = CodeBlock { "TestTestTest"; }
writeText = FileSystem.WriteText(filePath=code_block, text=code_block_2)

# group: テキストファイルに上書き
code_block_3 = CodeBlock { "..//Test//create.txt"; }
code_block_4 = CodeBlock { "TestTestTest-ChangeText"; }
writeText_2 = FileSystem.WriteText(filePath=code_block_3, text=code_block_4)

# group: テキストファイルを読み込む
code_block_5 = CodeBlock { "..//Test//create.txt"; }
readText = FileSystem.ReadText(file=code_block_5)
watch = Watch(readText)

# group: CSVファイルの作成
code_block_6 = CodeBlock { "..//Test//create.csv"; }
code_block_7 = CodeBlock { "Dummy"; }
exportCSV = Data.ExportCSV(filePath=code_block_6, data=code_block_7)

# group: Excelファイルの作成
directory_path = Directory("G:\My Drive\BNN\RevitDynamoData\配布用\Chapter5\5-7\Test")
code_block_8 = CodeBlock { "sample2.xlsx"; }
combinePath = FileSystem.CombinePath(string0=directory_path, string1=code_block_8)
code_block_9 = CodeBlock { "Sheet1"; "Dummy"; 0; }
boolean = BoolSelector(true)
exportExcel = Data.ExportExcel(filePath=combinePath, sheetName=code_block_9.out0, startRow=code_block_9.out2, startColumn=code_block_9.out2, data=code_block_9.out1, overWrite=boolean)

# group: ファイルの拡張子を変換
file_path_2 = Filename("..\..\..\Desktop\Test\Test2.txt")
code_block_10 = CodeBlock { "csv"; }
changePathExtension = FileSystem.ChangePathExtension(path=file_path_2, newExtension=code_block_10)

# group: ファイルの移動
file_path_3 = Filename("..\..\..\Desktop\Test\Test3.txt")
directory_path_2 = Directory("C:\Users\rhagi\Desktop\Subdirectory")
fileName = FileSystem.FileName(path=file_path_3)
combinePath_2 = FileSystem.CombinePath(string0=directory_path_2, string1=fileName)
boolean_2 = BoolSelector(false)
moveFile = FileSystem.MoveFile(path=file_path_3, newPath=combinePath_2, overwrite=boolean_2)

# group: ファイルの複製
file_path_4 = Filename("..\..\..\Desktop\Test\Test4.txt")
file_from_path = FileObject(path=file_path_4)
directory_path_3 = Directory("C:\Users\rhagi\Desktop\Subdirectory")
fileName_2 = FileSystem.FileName(path=file_path_4)
combinePath_3 = FileSystem.CombinePath(string0=directory_path_3, string1=fileName_2)
boolean_3 = BoolSelector(false)
copyFile = FileSystem.CopyFile(file=file_from_path, destinationPath=combinePath_3, overwrite=boolean_3)

# group: ファイルの削除
file_path_5 = Filename("..\..\..\Desktop\Test\Test5.txt")
deleteFile = FileSystem.DeleteFile(path=file_path_5)
