# Dynamo graph 6-1-1_CoordinatesPointPlaneVector.dyn "6-1-1_" (Dynamo 2.12.0.5650)

# group: 6-1-1 Coordinates / Point / Plane /
code_block = CodeBlock { 5; 15; 0; }
byCoordinates = Point.ByCoordinates(x=code_block.out0, y=code_block.out1, z=code_block.out2)
byOriginVectors = CoordinateSystem.ByOriginVectors()
byOriginVectors_2 = CoordinateSystem.ByOriginVectors()
XY = Plane.XY()
XZ = Plane.XZ()
YZ = Plane.YZ()
byOriginNormal = Plane.ByOriginNormal()

# group: 6-1-1 Vector
code_block_2 = CodeBlock { a = Point.ByCoordinates(0,0,0); b = Point.ByCoordinates(2,5,0); }
byTwoPoints = Vector.ByTwoPoints(start=code_block_2.a, end=code_block_2.b)
code_block_3 = CodeBlock { 10; 3; 5; }
byCoordinates_2 = Vector.ByCoordinates(x=code_block_3.out0, y=code_block_3.out1, z=code_block_3.out2)
normalized = Vector.Normalized(vector=byCoordinates_2)
code_block_4 = CodeBlock { 10; -3; 5; }
byCoordinates_3 = Vector.ByCoordinates(x=code_block_4.out0, y=code_block_4.out1, z=code_block_4.out2)
code_block_5 = CodeBlock { -2; 8; 5; }
byCoordinates_4 = Vector.ByCoordinates(x=code_block_5.out0, y=code_block_5.out1, z=code_block_5.out2)
add = Vector.Add(vector=byCoordinates_3, vectorToAdd=byCoordinates_4)
watch = Watch(add)
code_block_6 = CodeBlock { 10; -3; 5; }
byCoordinates_5 = Vector.ByCoordinates(x=code_block_6.out0, y=code_block_6.out1, z=code_block_6.out2)
code_block_7 = CodeBlock { -2; 8; 5; }
byCoordinates_6 = Vector.ByCoordinates(x=code_block_7.out0, y=code_block_7.out1, z=code_block_7.out2)
subtract = Vector.Subtract(vector=byCoordinates_5, vectorToSubtract=byCoordinates_6)
watch_2 = Watch(subtract)
code_block_8 = CodeBlock { 10; -3; 5; }
byCoordinates_7 = Vector.ByCoordinates(x=code_block_8.out0, y=code_block_8.out1, z=code_block_8.out2)
code_block_9 = CodeBlock { -4; 10; 8; }
byCoordinates_8 = Vector.ByCoordinates(x=code_block_9.out0, y=code_block_9.out1, z=code_block_9.out2)
cross = Vector.Cross(vector=byCoordinates_7, cross=byCoordinates_8)
code_block_10 = CodeBlock { 10; -3; 5; }
byCoordinates_9 = Vector.ByCoordinates(x=code_block_10.out0, y=code_block_10.out1, z=code_block_10.out2)
code_block_11 = CodeBlock { 10; -3; 5; }
byCoordinates_10 = Vector.ByCoordinates(x=code_block_11.out0, y=code_block_11.out1, z=code_block_11.out2)
dot = Vector.Dot(vector=byCoordinates_9, vec=byCoordinates_10)
ZAxis = Vector.ZAxis()
code_block_12 = CodeBlock { 2000; }
scale = Vector.Scale(vector=ZAxis, scale_factor=code_block_12)

# group: Vector Dot
code_block_13 = CodeBlock { 10; -3; 5; }
byCoordinates_11 = Vector.ByCoordinates(x=code_block_13.out0, y=code_block_13.out1, z=code_block_13.out2)
normalized_2 = Vector.Normalized(vector=byCoordinates_11)
code_block_14 = CodeBlock { 10; -3; 5; }
byCoordinates_12 = Vector.ByCoordinates(x=code_block_14.out0, y=code_block_14.out1, z=code_block_14.out2)
normalized_3 = Vector.Normalized(vector=byCoordinates_12)
dot_2 = Vector.Dot(vector=normalized_2, vec=normalized_3)
code_block_15 = CodeBlock { 10; -3; 5; }
byCoordinates_13 = Vector.ByCoordinates(x=code_block_15.out0, y=code_block_15.out1, z=code_block_15.out2)
normalized_4 = Vector.Normalized(vector=byCoordinates_13)
code_block_16 = CodeBlock { -4; 10; 8; }
byCoordinates_14 = Vector.ByCoordinates(x=code_block_16.out0, y=code_block_16.out1, z=code_block_16.out2)
normalized_5 = Vector.Normalized(vector=byCoordinates_14)
dot_3 = Vector.Dot(vector=normalized_4, vec=normalized_5)
code_block_17 = CodeBlock { 10; -3; 5; }
byCoordinates_15 = Vector.ByCoordinates(x=code_block_17.out0, y=code_block_17.out1, z=code_block_17.out2)
normalized_6 = Vector.Normalized(vector=byCoordinates_15)
code_block_18 = CodeBlock { 4; 5; 8; }
byCoordinates_16 = Vector.ByCoordinates(x=code_block_18.out0, y=code_block_18.out1, z=code_block_18.out2)
normalized_7 = Vector.Normalized(vector=byCoordinates_16)
dot_4 = Vector.Dot(vector=normalized_6, vec=normalized_7)
