# Dynamo graph 6-1-2_Curves.dyn "6-1-2_" (Dynamo 2.12.0.5650)

# group: Arc
code_block = CodeBlock { a = Point.ByCoordinates(0,0,0); 20; 0; 135; Vector.ByCoordinates(0,0,1); }
byCenterPointRadiusAngle = Arc.ByCenterPointRadiusAngle(center=code_block.a, radius=code_block.out1, startAngle=code_block.out2, endAngle=code_block.out3, normal=code_block.out4)

# group: Ellipse Arc
XY = Plane.XY()
code_block_2 = CodeBlock { 20; 10; 45; 180; }
byPlaneRadiiAngles = EllipseArc.ByPlaneRadiiAngles(plane=XY, xRadius=code_block_2.out0, yRadius=code_block_2.out1, startAngle=code_block_2.out2, sweepAngle=code_block_2.out3)

# group: PolyCurve
code_block_3 = CodeBlock()
# ---------- code_block_3.designscript (5 lines) ----------
a = Point.ByCoordinates(0,0,0);
b = Point.ByCoordinates(2,5,0);
c = Point.ByCoordinates(6,-5,0);
d = Point.ByCoordinates(16,3,0);
[a,b,c,d];
# ----------------------------------------
boolean = BoolSelector(true)
byPoints = PolyCurve.ByPoints(points=code_block_3.out4, connectLastToFirst=boolean)

# group: Ellipse
code_block_4 = CodeBlock { a = Point.ByCoordinates(0,0,0); 20; 10; }
byOriginRadii = Ellipse.ByOriginRadii(origin=code_block_4.a, xAxisRadius=code_block_4.out1, yAxisRadius=code_block_4.out2)

# group: Polygon
code_block_5 = CodeBlock()  # same code as code_block_3
byPoints_2 = Polygon.ByPoints(points=code_block_5.out4)

# group: NurbsCurve
code_block_6 = CodeBlock()  # same code as code_block_3
byControlPoints = NurbsCurve.ByControlPoints(points=code_block_6.out4)

# group: Circle
code_block_7 = CodeBlock { a = Point.ByCoordinates(0,0,0); 20; }
byCenterPointRadius = Circle.ByCenterPointRadius(centerPoint=code_block_7.a, radius=code_block_7.out1)

# group: Line
code_block_8 = CodeBlock { a = Point.ByCoordinates(0,0,0); b = Point.ByCoordinates(2,5,0); }
byStartPointEndPoint = Line.ByStartPointEndPoint(startPoint=code_block_8.a, endPoint=code_block_8.b)
