# Dynamo graph 6-1-3_Surfaces.dyn (Dynamo 2.12.0.5650)

# group: PolySurface
XY = Plane.XY()
byWidthLength = Rectangle.ByWidthLength(plane=XY)
YAxis = Vector.YAxis()
code_block = CodeBlock { 1; }
translate = Geometry.Translate(geometry=byWidthLength, direction=YAxis, distance=code_block)
list_create = List.Create(item0=byWidthLength, item1=translate)
byPatch = Surface.ByPatch(closedCurve=list_create)
byJoinedSurfaces = PolySurface.ByJoinedSurfaces(surfaces=byPatch)

# group: NurbsSurface
code_block_2 = CodeBlock { 0..10; }
byCoordinates = Point.ByCoordinates(x=code_block_2, y=code_block_2, lacing=CrossProduct)
byControlPoints = NurbsSurface.ByControlPoints(controlVertices=byCoordinates)

# group: Surface
XY_2 = Plane.XY()
code_block_3 = CodeBlock { 5; }
byWidthLength_2 = Rectangle.ByWidthLength(plane=XY_2, width=code_block_3, length=code_block_3)
byPatch_2 = Surface.ByPatch(closedCurve=byWidthLength_2)
