# Dynamo graph 6-1-4_Solid.dyn (Dynamo 2.12.0.5650)

# group: Sphere/Cubic/Cylinder/Cone
byPointsRadius = Cone.ByPointsRadius()
byPointsRadius_2 = Cylinder.ByPointsRadius()
byLengths = Cuboid.ByLengths()
byCenterPointRadius = Sphere.ByCenterPointRadius()

# group: Slid.ByLoft
byWidthLength = Rectangle.ByWidthLength()
ZAxis = Vector.ZAxis()
code_block = CodeBlock { 2; }
translate = Geometry.Translate(geometry=byWidthLength, direction=ZAxis, distance=code_block)
XY = Plane.XY()
code_block_2 = CodeBlock { 45; }
rotate = Geometry.Rotate(geometry=translate, basePlane=XY, degrees=code_block_2)
list_create = List.Create(item0=byWidthLength, item1=rotate)
byLoft = Solid.ByLoft(crossSections=list_create)

# group: Solid.ByRevolve
XZ = Plane.XZ()
byWidthLength_2 = Rectangle.ByWidthLength(plane=XZ)
XAxis = Vector.XAxis()
code_block_3 = CodeBlock { 2; }
translate_2 = Geometry.Translate(geometry=byWidthLength_2, direction=XAxis, distance=code_block_3)
code_block_4 = CodeBlock { 275; }
byRevolve = Solid.ByRevolve(profile=translate_2, sweepAngle=code_block_4)

# group: Solid.ByUnion
byCenterPointRadius_2 = Sphere.ByCenterPointRadius()
XZ_2 = Plane.XZ()
byWidthLength_3 = Rectangle.ByWidthLength(plane=XZ_2)
byCoordinates = Point.ByCoordinates()
YAxis = Vector.YAxis()
code_block_5 = CodeBlock { 3; }
byStartPointDirectionLength = Line.ByStartPointDirectionLength(startPoint=byCoordinates, direction=YAxis, length=code_block_5)
bySweep = Solid.BySweep(profile=byWidthLength_3, path=byStartPointDirectionLength)
list_create_2 = List.Create(item0=byCenterPointRadius_2, item1=bySweep)
byUnion = Solid.ByUnion(solids=list_create_2)
