# Dynamo graph 6-1_Geometryとは.dyn (Dynamo 2.12.0.5650)

byCoordinates = Point.ByCoordinates()
code_block = CodeBlock { 2; 5; 0; }
byCoordinates_2 = Point.ByCoordinates(x=code_block.out0, y=code_block.out1, z=code_block.out2)
code_block_2 = CodeBlock { 6; -5; 0; }
byCoordinates_3 = Point.ByCoordinates(x=code_block_2.out0, y=code_block_2.out1, z=code_block_2.out2)
code_block_3 = CodeBlock { 16; 3; 0; }
byCoordinates_4 = Point.ByCoordinates(x=code_block_3.out0, y=code_block_3.out1, z=code_block_3.out2)
list_create = List.Create(item0=byCoordinates, item1=byCoordinates_2, item2=byCoordinates_3, item3=byCoordinates_4)
byPoints = PolyCurve.ByPoints(points=list_create)
byPoints_2 = Polygon.ByPoints()  # unwired: points
code_block_4 = CodeBlock { a = Point.ByCoordinates(0,0,0); 20; }
byCenterPointRadius = Circle.ByCenterPointRadius(centerPoint=code_block_4.a, radius=code_block_4.out1)
code_block_5 = CodeBlock { a = Point.ByCoordinates(0,0,0); 20; 0; 135; Vector.ByCoordinates(0,0,1); }
byCenterPointRadiusAngle = Arc.ByCenterPointRadiusAngle(center=code_block_5.a, radius=code_block_5.out1, startAngle=code_block_5.out2, endAngle=code_block_5.out3, normal=code_block_5.out4)
byControlPoints = NurbsCurve.ByControlPoints()  # unwired: points
XY = Plane.XY()
code_block_6 = CodeBlock { 20; 10; 45; 180; }
byPlaneRadiiAngles = EllipseArc.ByPlaneRadiiAngles(plane=XY, xRadius=code_block_6.out0, yRadius=code_block_6.out1, startAngle=code_block_6.out2, sweepAngle=code_block_6.out3)
byCoordinates_5 = Point.ByCoordinates()
code_block_7 = CodeBlock()
# ---------- code_block_7.designscript (5 lines) ----------
a = Point.ByCoordinates(0,0,0);
b = Point.ByCoordinates(2,5,0);
c = Point.ByCoordinates(6,-5,0);
d = Point.ByCoordinates(16,3,0);
[a,b,c,d];
# ----------------------------------------
code_block_8 = CodeBlock()  # same code as code_block_7
boolean = BoolSelector(true)
byPoints_3 = PolyCurve.ByPoints(points=code_block_8.out4, connectLastToFirst=boolean)  # frozen
code_block_9 = CodeBlock()  # same code as code_block_7
byPoints_4 = Polygon.ByPoints(points=code_block_9.out4)
code_block_10 = CodeBlock()  # same code as code_block_7
byControlPoints_2 = NurbsCurve.ByControlPoints(points=code_block_10.out4)
code_block_11 = CodeBlock { a = Point.ByCoordinates(0,0,0); b = Point.ByCoordinates(2,5,0); }
byStartPointEndPoint = Line.ByStartPointEndPoint(startPoint=code_block_11.a, endPoint=code_block_11.b)
code_block_12 = CodeBlock { a = Point.ByCoordinates(0,0,0); 20; 10; }
byOriginRadii = Ellipse.ByOriginRadii(origin=code_block_12.a, xAxisRadius=code_block_12.out1, yAxisRadius=code_block_12.out2)
byControlPoints_3 = NurbsCurve.ByControlPoints()  # unwired: points

# group: 6-1-1 Coordinates / Point / Plane /
code_block_13 = CodeBlock { 5; 15; 0; }
byCoordinates_6 = Point.ByCoordinates(x=code_block_13.out0, y=code_block_13.out1, z=code_block_13.out2)
byOriginVectors = CoordinateSystem.ByOriginVectors()
byOriginVectors_2 = CoordinateSystem.ByOriginVectors()
XY_2 = Plane.XY()
XZ = Plane.XZ()
YZ = Plane.YZ()
byOriginNormal = Plane.ByOriginNormal()

code_block_14 = CodeBlock { a = Point.ByCoordinates(0,0,0); b = Point.ByCoordinates(2,5,0); }
byTwoPoints = Vector.ByTwoPoints(start=code_block_14.a, end=code_block_14.b)
code_block_15 = CodeBlock { 10; 3; 5; }
byCoordinates_7 = Vector.ByCoordinates(x=code_block_15.out0, y=code_block_15.out1, z=code_block_15.out2)
normalized = Vector.Normalized(vector=byCoordinates_7)
code_block_16 = CodeBlock { 10; -3; 5; }
byCoordinates_8 = Vector.ByCoordinates(x=code_block_16.out0, y=code_block_16.out1, z=code_block_16.out2)
code_block_17 = CodeBlock { -2; 8; 5; }
byCoordinates_9 = Vector.ByCoordinates(x=code_block_17.out0, y=code_block_17.out1, z=code_block_17.out2)
add = Vector.Add(vector=byCoordinates_8, vectorToAdd=byCoordinates_9)
watch = Watch(add)
code_block_18 = CodeBlock { 10; -3; 5; }
byCoordinates_10 = Vector.ByCoordinates(x=code_block_18.out0, y=code_block_18.out1, z=code_block_18.out2)
code_block_19 = CodeBlock { -2; 8; 5; }
byCoordinates_11 = Vector.ByCoordinates(x=code_block_19.out0, y=code_block_19.out1, z=code_block_19.out2)
subtract = Vector.Subtract(vector=byCoordinates_10, vectorToSubtract=byCoordinates_11)
watch_2 = Watch(subtract)
code_block_20 = CodeBlock { 10; -3; 5; }
byCoordinates_12 = Vector.ByCoordinates(x=code_block_20.out0, y=code_block_20.out1, z=code_block_20.out2)
code_block_21 = CodeBlock { -4; 10; 8; }
byCoordinates_13 = Vector.ByCoordinates(x=code_block_21.out0, y=code_block_21.out1, z=code_block_21.out2)
cross = Vector.Cross(vector=byCoordinates_12, cross=byCoordinates_13)
code_block_22 = CodeBlock { 10; -3; 5; }
byCoordinates_14 = Vector.ByCoordinates(x=code_block_22.out0, y=code_block_22.out1, z=code_block_22.out2)
code_block_23 = CodeBlock { 10; -3; 5; }
byCoordinates_15 = Vector.ByCoordinates(x=code_block_23.out0, y=code_block_23.out1, z=code_block_23.out2)
dot = Vector.Dot(vector=byCoordinates_14, vec=byCoordinates_15)
code_block_24 = CodeBlock { 10; -3; 5; }
byCoordinates_16 = Vector.ByCoordinates(x=code_block_24.out0, y=code_block_24.out1, z=code_block_24.out2)
normalized_2 = Vector.Normalized(vector=byCoordinates_16)
code_block_25 = CodeBlock { 10; -3; 5; }
byCoordinates_17 = Vector.ByCoordinates(x=code_block_25.out0, y=code_block_25.out1, z=code_block_25.out2)
normalized_3 = Vector.Normalized(vector=byCoordinates_17)
dot_2 = Vector.Dot(vector=normalized_2, vec=normalized_3)
code_block_26 = CodeBlock { 10; -3; 5; }
byCoordinates_18 = Vector.ByCoordinates(x=code_block_26.out0, y=code_block_26.out1, z=code_block_26.out2)
normalized_4 = Vector.Normalized(vector=byCoordinates_18)
code_block_27 = CodeBlock { -4; 10; 8; }
byCoordinates_19 = Vector.ByCoordinates(x=code_block_27.out0, y=code_block_27.out1, z=code_block_27.out2)
normalized_5 = Vector.Normalized(vector=byCoordinates_19)
dot_3 = Vector.Dot(vector=normalized_4, vec=normalized_5)
code_block_28 = CodeBlock { 10; -3; 5; }
byCoordinates_20 = Vector.ByCoordinates(x=code_block_28.out0, y=code_block_28.out1, z=code_block_28.out2)
normalized_6 = Vector.Normalized(vector=byCoordinates_20)
code_block_29 = CodeBlock { 4; 5; 8; }
byCoordinates_21 = Vector.ByCoordinates(x=code_block_29.out0, y=code_block_29.out1, z=code_block_29.out2)
normalized_7 = Vector.Normalized(vector=byCoordinates_21)
dot_4 = Vector.Dot(vector=normalized_6, vec=normalized_7)
ZAxis = Vector.ZAxis()
code_block_30 = CodeBlock { 2000; }
scale = Vector.Scale(vector=ZAxis, scale_factor=code_block_30)
