# Dynamo graph 6-2-1_CurveParameter.dyn (Dynamo 2.12.0.5650)

# group: Curve Parameter
code_block = CodeBlock { 10; 180; }
byCenterPointRadiusAngle = Arc.ByCenterPointRadiusAngle(radius=code_block.out0, endAngle=code_block.out1)
code_block_2 = CodeBlock { 0..1..#8; }
pointAtParameter = Curve.PointAtParameter(curve=byCenterPointRadiusAngle, param=code_block_2)

# group: Curve Parameter
code_block_3 = CodeBlock { Autodesk.Point.ByCoordinates(10,10,10); }
code_block_4 = CodeBlock { 1; }
byCenterPointRadiusAngle_2 = Arc.ByCenterPointRadiusAngle(center=code_block_3, radius=code_block_4)
number_slider = DoubleSlider(0.6, range=0..1 step 0.1)
pointAtParameter_2 = Curve.PointAtParameter(curve=byCenterPointRadiusAngle_2, param=number_slider)
