# Dynamo graph 6-2-2_Curveのさまざまな分割.dyn (Dynamo 2.12.0.5650)

# group: Curve.PointAtEqualSegmentLength
select_model_element = DSModelElementSelection()  # 1 picked in the model
curves = Element.Curves(element=select_model_element)
code_block = CodeBlock { 12; }
pointsAtEqualSegmentLength = Curve.PointsAtEqualSegmentLength(curve=curves, divisions=code_block)

# group: Curve.PointAtEqualChordLength
select_model_element_2 = DSModelElementSelection()  # 1 picked in the model
curves_2 = Element.Curves(element=select_model_element_2)
code_block_2 = CodeBlock { 12; }
pointsAtEqualChordLength = Curve.PointsAtEqualChordLength(curve=curves_2, divisions=code_block_2)

# group: Curve.ParameterAtSegmentLength
select_model_element_3 = DSModelElementSelection()  # 1 picked in the model
curves_3 = Element.Curves(element=select_model_element_3)
length = Curve.Length(curve=curves_3)
startPoint = Curve.StartPoint(curve=curves_3)
code_block_3 = CodeBlock { 200; }
pointsAtSegmentLengthFromPoint = Curve.PointsAtSegmentLengthFromPoint(curve=curves_3, point=startPoint, segmentLength=code_block_3)

# group: Curve.ParameterAtChordLength
select_model_element_4 = DSModelElementSelection()  # 1 picked in the model
curves_4 = Element.Curves(element=select_model_element_4)
startPoint_2 = Curve.StartPoint(curve=curves_4)
code_block_4 = CodeBlock { 200; }
pointsAtChordLengthFromPoint = Curve.PointsAtChordLengthFromPoint(curve=curves_4, point=startPoint_2, chordLength=code_block_4)
length_2 = Curve.Length(curve=curves_4)
