# Dynamo graph 6-2-3_Curve上の点におけるパラメータ、法線、接線.dyn (Dynamo 2.12.0.5650)

# group: Tangent（接線）
select_model_element = DSModelElementSelection()  # 1 picked in the model
curves = Element.Curves(element=select_model_element)
code_block = CodeBlock { 12; }
pointsAtEqualSegmentLength = Curve.PointsAtEqualSegmentLength(curve=curves, divisions=code_block)
code_block_2 = CodeBlock(points=pointsAtEqualSegmentLength) { points; }
parameterAtPoint = Curve.ParameterAtPoint(curve=curves, point=pointsAtEqualSegmentLength)
tangentAtParameter = Curve.TangentAtParameter(curve=curves, param=parameterAtPoint)
code_block_3 = CodeBlock { 300; }
byStartPointDirectionLength = Line.ByStartPointDirectionLength(startPoint=code_block_2, direction=tangentAtParameter, length=code_block_3)
color_palette = ColorPalette({R: 0, G: 139, B: 139, A: 255})
byGeometryColor = Modifiers.GeometryColor.ByGeometryColor(geometry=byStartPointDirectionLength, color=color_palette)

# group: Normal（法線)
select_model_element_2 = DSModelElementSelection()  # 1 picked in the model
curves_2 = Element.Curves(element=select_model_element_2)
code_block_4 = CodeBlock { 12; }
pointsAtEqualSegmentLength_2 = Curve.PointsAtEqualSegmentLength(curve=curves_2, divisions=code_block_4)
code_block_5 = CodeBlock(points=pointsAtEqualSegmentLength_2) { points; }
parameterAtPoint_2 = Curve.ParameterAtPoint(curve=curves_2, point=pointsAtEqualSegmentLength_2)
normalAtParameter = Curve.NormalAtParameter(curve=curves_2, param=parameterAtPoint_2)
code_block_6 = CodeBlock { 300; }
byStartPointDirectionLength_2 = Line.ByStartPointDirectionLength(startPoint=code_block_5, direction=normalAtParameter, length=code_block_6)
color_palette_2 = ColorPalette({R: 0, G: 139, B: 139, A: 255})
byGeometryColor_2 = Modifiers.GeometryColor.ByGeometryColor(geometry=byStartPointDirectionLength_2, color=color_palette_2)

# group: Curve.ParameterAtPoint
select_model_element_3 = DSModelElementSelection()  # 1 picked in the model
curves_3 = Element.Curves(element=select_model_element_3)
code_block_7 = CodeBlock { 0..1..#10; }
pointAtParameter = Curve.PointAtParameter(curve=curves_3@L1, param=code_block_7)
