# Dynamo graph 6-2-4_Surface Parameter UV.dyn (Dynamo 2.12.0.5650)

# group: Surface.PointAtParameter
select_model_element = DSModelElementSelection()  # 1 picked in the model
curves = Element.Curves(element=select_model_element)
ZAxis = Vector.ZAxis()
code_block = CodeBlock { 2000; }
scale = Vector.Scale(vector=ZAxis, scale_factor=code_block)
extrude = Curve.Extrude(curve=curves, direction=scale)
code_block_2 = CodeBlock { 0.5; 0.5; }
pointAtParameter = Surface.PointAtParameter(surface=extrude, u=code_block_2.out0, v=code_block_2.out1, lacing=CrossProduct)

# group: Surface.GetIsoline
select_model_element_2 = DSModelElementSelection()  # 1 picked in the model
curves_2 = Element.Curves(element=select_model_element_2)
ZAxis_2 = Vector.ZAxis()
code_block_3 = CodeBlock { 2000; }
scale_2 = Vector.Scale(vector=ZAxis_2, scale_factor=code_block_3)
extrude_2 = Curve.Extrude(curve=curves_2, direction=scale_2)
code_block_4 = CodeBlock { 1; 0.5; }
getIsoline = Surface.GetIsoline(surface=extrude_2, isoDirection=code_block_4.out0, parameter=code_block_4.out1)

# group: Surface上にPointをGridで配置
select_model_element_3 = DSModelElementSelection()  # 1 picked in the model
curves_3 = Element.Curves(element=select_model_element_3)
ZAxis_3 = Vector.ZAxis()
code_block_5 = CodeBlock { 2000; }
scale_3 = Vector.Scale(vector=ZAxis_3, scale_factor=code_block_5)
extrude_3 = Curve.Extrude(curve=curves_3, direction=scale_3)
code_block_6 = CodeBlock { 0..1..#10; 0..1..#10; }
pointAtParameter_2 = Surface.PointAtParameter(surface=extrude_3, u=code_block_6.out0, v=code_block_6.out1, lacing=CrossProduct)
