# Dynamo graph 6-2-5_(ジオメトリのParameter).dyn (Dynamo 2.12.0.5650)

code_block = CodeBlock { [0,50,250,400,450]; }
byCoordinates = Point.ByCoordinates(z=code_block)
code_block_2 = CodeBlock { [50,50,150,50,50]; }
byCenterPointRadius = Circle.ByCenterPointRadius(centerPoint=byCoordinates, radius=code_block_2)
startPoint = Curve.StartPoint(curve=byCenterPointRadius)
code_block_3 = CodeBlock { 20; }
pointsAtEqualSegmentLength = Curve.PointsAtEqualSegmentLength(curve=byCenterPointRadius, divisions=code_block_3)
addItemToFront = List.AddItemToFront(item=startPoint@L1, list=pointsAtEqualSegmentLength@L2)
parameterAtPoint = Curve.ParameterAtPoint(curve=byCenterPointRadius, point=addItemToFront)
tangentAtParameter = Curve.TangentAtParameter(curve=byCenterPointRadius, param=parameterAtPoint)
code_block_4 = CodeBlock { 50; }
byStartPointDirectionLength = Line.ByStartPointDirectionLength(startPoint=addItemToFront, direction=tangentAtParameter, length=code_block_4)
transpose = List.Transpose(lists=byStartPointDirectionLength)
byLoft = Surface.ByLoft(crossSections=transpose)
