# Dynamo graph 6-2-5_Surface上の点におけるパラメータ、法線、UV.dyn (Dynamo 2.12.0.5650)

# group: Normal（法線）UV
select_model_element = DSModelElementSelection()  # 1 picked in the model
curves = Element.Curves(element=select_model_element)
ZAxis = Vector.ZAxis()
code_block = CodeBlock { 2000; }
scale = Vector.Scale(vector=ZAxis, scale_factor=code_block)
extrude = Curve.Extrude(curve=curves, direction=scale)
code_block_2 = CodeBlock { 0.5; }
getIsoline = Surface.GetIsoline(surface=extrude, parameter=code_block_2)
pointsAtEqualChordLength = Curve.PointsAtEqualChordLength(curve=getIsoline)
code_block_3 = CodeBlock(points=pointsAtEqualChordLength) { points; }
code_block_4 = CodeBlock(surface=extrude) { surface; }
UVParameterAtPoint = Surface.UVParameterAtPoint(surface=extrude, point=pointsAtEqualChordLength)
U = UV.U(uV=UVParameterAtPoint)
V = UV.V(uV=UVParameterAtPoint)
normalAtParameter = Surface.NormalAtParameter(surface=code_block_4, u=U, v=V)
code_block_5 = CodeBlock { 300; }
byStartPointDirectionLength = Line.ByStartPointDirectionLength(startPoint=code_block_3, direction=normalAtParameter, length=code_block_5)
color_palette = ColorPalette({R: 0, G: 139, B: 139, A: 255})
byGeometryColor = Modifiers.GeometryColor.ByGeometryColor(geometry=byStartPointDirectionLength, color=color_palette)

# group: Surface.UVParameterAtPoint
select_model_element_2 = DSModelElementSelection()  # 1 picked in the model
curves_2 = Element.Curves(element=select_model_element_2)
ZAxis_2 = Vector.ZAxis()
code_block_6 = CodeBlock { 2000; }
scale_2 = Vector.Scale(vector=ZAxis_2, scale_factor=code_block_6)
extrude_2 = Curve.Extrude(curve=curves_2, direction=scale_2)
code_block_7 = CodeBlock { 0.5; }
getIsoline_2 = Surface.GetIsoline(surface=extrude_2, parameter=code_block_7)
pointsAtEqualChordLength_2 = Curve.PointsAtEqualChordLength(curve=getIsoline_2)
UVParameterAtPoint_2 = Surface.UVParameterAtPoint(surface=extrude_2, point=pointsAtEqualChordLength_2)

# group: Tangent（接線）UV
select_model_element_3 = DSModelElementSelection()  # 1 picked in the model
curves_3 = Element.Curves(element=select_model_element_3)
ZAxis_3 = Vector.ZAxis()
code_block_8 = CodeBlock { 2000; }
scale_3 = Vector.Scale(vector=ZAxis_3, scale_factor=code_block_8)
extrude_3 = Curve.Extrude(curve=curves_3, direction=scale_3)
code_block_9 = CodeBlock { 0.5; }
getIsoline_3 = Surface.GetIsoline(surface=extrude_3, parameter=code_block_9)
pointsAtEqualChordLength_3 = Curve.PointsAtEqualChordLength(curve=getIsoline_3)
code_block_10 = CodeBlock(points=pointsAtEqualChordLength_3) { points; }
code_block_11 = CodeBlock(surface=extrude_3) { surface; }
UVParameterAtPoint_3 = Surface.UVParameterAtPoint(surface=extrude_3, point=pointsAtEqualChordLength_3)
U_2 = UV.U(uV=UVParameterAtPoint_3)
V_2 = UV.V(uV=UVParameterAtPoint_3)
tangentAtVParameter = Surface.TangentAtVParameter(surface=code_block_11, u=U_2, v=V_2)
code_block_12 = CodeBlock { 300; }
byStartPointDirectionLength_2 = Line.ByStartPointDirectionLength(startPoint=code_block_10, direction=tangentAtVParameter, length=code_block_12)
color_palette_2 = ColorPalette({R: 0, G: 139, B: 139, A: 255})
byGeometryColor_2 = Modifiers.GeometryColor.ByGeometryColor(geometry=byStartPointDirectionLength_2, color=color_palette_2)

# group: Normal（法線）Point
select_model_element_4 = DSModelElementSelection()  # 1 picked in the model
curves_4 = Element.Curves(element=select_model_element_4)
ZAxis_4 = Vector.ZAxis()
code_block_13 = CodeBlock { 2000; }
scale_4 = Vector.Scale(vector=ZAxis_4, scale_factor=code_block_13)
extrude_4 = Curve.Extrude(curve=curves_4, direction=scale_4)
code_block_14 = CodeBlock { 0.5; }
getIsoline_4 = Surface.GetIsoline(surface=extrude_4, parameter=code_block_14)
pointsAtEqualChordLength_4 = Curve.PointsAtEqualChordLength(curve=getIsoline_4)
code_block_15 = CodeBlock(points=pointsAtEqualChordLength_4) { points; }
code_block_16 = CodeBlock(surface=extrude_4) { surface; }
code_block_17 = CodeBlock { 300; }
color_palette_3 = ColorPalette({R: 0, G: 139, B: 139, A: 255})

normalAtPoint = Surface.NormalAtPoint(surface=code_block_16, point=pointsAtEqualChordLength_4)

# group (continued): Normal（法線）Point
byStartPointDirectionLength_3 = Line.ByStartPointDirectionLength(startPoint=code_block_15, direction=normalAtPoint, length=code_block_17)
byGeometryColor_3 = Modifiers.GeometryColor.ByGeometryColor(geometry=byStartPointDirectionLength_3, color=color_palette_3)
