# Dynamo graph 6-3-1_ジオメトリの変換操作.dyn (Dynamo 2.12.0.5650)

# group: Rotate
byLengths = Cuboid.ByLengths()
ZAxis = Vector.ZAxis()
code_block = CodeBlock { 0..10..#5; }
translate = Geometry.Translate(geometry=byLengths, direction=ZAxis, distance=code_block)
centroid = Solid.Centroid(solid=translate)
byOriginNormal = Plane.ByOriginNormal(origin=centroid)
count = List.Count(list=centroid)
code_block_2 = CodeBlock(count=count) { 0..100..#count; }
rotate = Geometry.Rotate(geometry=translate, basePlane=byOriginNormal, degrees=code_block_2)

# group: Translate
byCenterPointRadius = Sphere.ByCenterPointRadius()
ZAxis_2 = Vector.ZAxis()
code_block_3 = CodeBlock { 5; }
translate_2 = Geometry.Translate(geometry=byCenterPointRadius, direction=ZAxis_2, distance=code_block_3)
byCenterPointRadius_2 = Sphere.ByCenterPointRadius()
ZAxis_3 = Vector.ZAxis()
code_block_4 = CodeBlock { 0..10..#5; }
translate_3 = Geometry.Translate(geometry=byCenterPointRadius_2, direction=ZAxis_3, distance=code_block_4)

# group: Mirror
code_block_5 = CodeBlock { 2; }
byCoordinates = Point.ByCoordinates(y=code_block_5)
byLengths_2 = Cuboid.ByLengths(origin=byCoordinates)
XZ = Plane.XZ()
mirror = Geometry.Mirror(geometry=byLengths_2, mirrorPlane=XZ)

# group: Scale
byLengths_3 = Cuboid.ByLengths()
ZAxis_4 = Vector.ZAxis()
code_block_6 = CodeBlock { 0..10..#5; }
translate_4 = Geometry.Translate(geometry=byLengths_3, direction=ZAxis_4, distance=code_block_6)
centroid_2 = Solid.Centroid(solid=translate_4)
byOriginNormal_2 = Plane.ByOriginNormal(origin=centroid_2)
count_2 = List.Count(list=centroid_2)
code_block_7 = CodeBlock(count=count_2) { 0..100..#count; }
rotate_2 = Geometry.Rotate(geometry=translate_4, basePlane=byOriginNormal_2, degrees=code_block_7)
count_3 = List.Count(list=rotate_2)
code_block_8 = CodeBlock(count=count_3) { 1..2..#count; }
scale = Geometry.Scale(geometry=rotate_2, plane=byOriginNormal_2, xamount=code_block_8, yamount=code_block_8, zamount=code_block_8)
