# Dynamo graph 6-3-2_ジオメトリの厚み付け_オフセット.dyn (Dynamo 2.12.0.5650)

# group: CurveOffset
select_model_element = DSModelElementSelection()  # 1 picked in the model
geometry = Element.Geometry(element=select_model_element)
code_block = CodeBlock { -200; }
offset = Curve.Offset(curve=geometry, distance=code_block)

# group: SurfaceOffset
code_block_2 = CodeBlock { 500; }
byWidthLength = Rectangle.ByWidthLength(width=code_block_2, length=code_block_2)
byPatch = Surface.ByPatch(closedCurve=byWidthLength)
code_block_3 = CodeBlock { 200; }
offset_2 = Surface.Offset(surface=byPatch, distance=code_block_3)

# group: PolyCurve.ByThickeningCurve
select_model_element_2 = DSModelElementSelection()  # 1 picked in the model
geometry_2 = Element.Geometry(element=select_model_element_2)
code_block_4 = CodeBlock { 200; }
ZAxis = Vector.ZAxis()
byThickeningCurve = PolyCurve.ByThickeningCurve(curve=geometry_2, thickness=code_block_4, nor=ZAxis)

# group: SurfaceThicken
code_block_5 = CodeBlock { 500; }
byWidthLength_2 = Rectangle.ByWidthLength(width=code_block_5, length=code_block_5)
byPatch_2 = Surface.ByPatch(closedCurve=byWidthLength_2)
code_block_6 = CodeBlock { 200; }
boolean = BoolSelector(true)
thicken = Surface.Thicken(surface=byPatch_2, thickness=code_block_6, both_sides=boolean)
