# Dynamo graph 6-3_Topology.dyn (Dynamo 2.12.0.5650)

# group: トポロジー
byLengths = Cuboid.ByLengths()
edges = Topology.Edges(topology=byLengths)
vertices = Topology.Vertices(topology=byLengths)
faces = Topology.Faces(topology=byLengths)

# group: Edge.AdjacentFaces / Edge.StartVertices / Edge.EndVertices
byLengths_2 = Cuboid.ByLengths()
edges_2 = Topology.Edges(topology=byLengths_2)
endVertex = Edge.EndVertex(edge=edges_2)
startVertex = Edge.StartVertex(edge=edges_2)
adjacentFaces = Edge.AdjacentFaces(edge=edges_2)
curveGeometry = Edge.CurveGeometry(edge=edges_2)

# group: Topology.Edges / Edge.CurveGeometry
byLengths_3 = Cuboid.ByLengths()
edges_3 = Topology.Edges(topology=byLengths_3)
curveGeometry_2 = Edge.CurveGeometry(edge=edges_3)

# group: Solid.Fillet
byLengths_4 = Cuboid.ByLengths()
edges_4 = Topology.Edges(topology=byLengths_4)
code_block = CodeBlock { 0.3; }
fillet = Solid.Fillet(solid=byLengths_4, edges=edges_4, radius=code_block)

# group: Topology.Vertices / Vertex.PointGeometry
byLengths_5 = Cuboid.ByLengths()
vertices_2 = Topology.Vertices(topology=byLengths_5)
pointGeometry = Vertex.PointGeometry(vertex=vertices_2)

# group: Face.Vertices / Face.Edges
byLengths_6 = Cuboid.ByLengths()
faces_2 = Topology.Faces(topology=byLengths_6)
surfaceGeometry = Face.SurfaceGeometry(face=faces_2)
edges_5 = Face.Edges(face=faces_2)
vertices_3 = Face.Vertices(face=faces_2)

# group: Vertex.AdjacentEdges / Vertex.AdjacentFaces
byLengths_7 = Cuboid.ByLengths()
vertices_4 = Topology.Vertices(topology=byLengths_7)
pointGeometry_2 = Vertex.PointGeometry(vertex=vertices_4)
adjacentEdges = Vertex.AdjacentEdges(vertex=vertices_4)
adjacentFaces_2 = Vertex.AdjacentFaces(vertex=vertices_4)
