# Dynamo graph 6-4_ジオメトリの交差.dyn (Dynamo 2.12.0.5650)

# group: DoIntersect
code_block = CodeBlock { 2; }
byCoordinates = Point.ByCoordinates(y=code_block)
byLengths = Cuboid.ByLengths(origin=byCoordinates)
code_block_2 = CodeBlock { 1; 1; }
byCoordinates_2 = Point.ByCoordinates(y=code_block_2.out0, z=code_block_2.out1)
byCenterPointRadius = Sphere.ByCenterPointRadius(centerPoint=byCoordinates_2)
doesIntersect = Geometry.DoesIntersect(geometry=byLengths, other=byCenterPointRadius)

# group: Geometry.ClosestPointTo
code_block_3 = CodeBlock { -3; 2; }
byCoordinates_3 = Point.ByCoordinates(y=code_block_3.out0, z=code_block_3.out1)
code_block_4 = CodeBlock { 2; }
byCoordinates_4 = Point.ByCoordinates(y=code_block_4)
byLengths_2 = Cuboid.ByLengths(origin=byCoordinates_4)
byCenterPointRadius_2 = Sphere.ByCenterPointRadius(centerPoint=byCoordinates_3)
closestPointTo = Geometry.ClosestPointTo(geometry=byLengths_2, other=byCenterPointRadius_2)
byStartPointEndPoint = Line.ByStartPointEndPoint(startPoint=byCoordinates_3, endPoint=closestPointTo)

# group: DistanceTo
code_block_5 = CodeBlock { 2; }
byCoordinates_5 = Point.ByCoordinates(y=code_block_5)
byLengths_3 = Cuboid.ByLengths(origin=byCoordinates_5)
code_block_6 = CodeBlock { -3; 2; }
byCoordinates_6 = Point.ByCoordinates(y=code_block_6.out0, z=code_block_6.out1)
byCenterPointRadius_3 = Sphere.ByCenterPointRadius(centerPoint=byCoordinates_6)
distanceTo = Geometry.DistanceTo(geometry=byLengths_3, other=byCenterPointRadius_3)
watch = Watch(distanceTo)

# group: IntersectAll
code_block_7 = CodeBlock { 2; }
byCoordinates_7 = Point.ByCoordinates(y=code_block_7)
byLengths_4 = Cuboid.ByLengths(origin=byCoordinates_7)
code_block_8 = CodeBlock { 1; 1; }
byCoordinates_8 = Point.ByCoordinates(y=code_block_8.out0, z=code_block_8.out1)
byCenterPointRadius_4 = Sphere.ByCenterPointRadius(centerPoint=byCoordinates_8)
code_block_9 = CodeBlock { 1; 0; }
byCoordinates_9 = Point.ByCoordinates(x=code_block_9.out0, y=code_block_9.out0, z=code_block_9.out1)
byCenterPointRadius_5 = Sphere.ByCenterPointRadius(centerPoint=byCoordinates_9)
list_create = List.Create(item0=byCenterPointRadius_4, item1=byCenterPointRadius_5)
intersectAll = Geometry.IntersectAll(geometry=byLengths_4, others=list_create)

# group: Split
code_block_10 = CodeBlock { 2; }
byCoordinates_10 = Point.ByCoordinates(y=code_block_10)
byLengths_5 = Cuboid.ByLengths(origin=byCoordinates_10)
code_block_11 = CodeBlock { 1; 1; }
byCoordinates_11 = Point.ByCoordinates(y=code_block_11.out0, z=code_block_11.out1)
byCenterPointRadius_6 = Sphere.ByCenterPointRadius(centerPoint=byCoordinates_11)
split = Geometry.Split(geometry=byLengths_5, other=byCenterPointRadius_6)
code_block_12 = CodeBlock(list=split) { list[0]; list[1]; }
watch_3d = Watch3D(code_block_12.out0)
watch_3d_2 = Watch3D(code_block_12.out1)

# group: Trim
code_block_13 = CodeBlock { 1; }
byCoordinates_12 = Point.ByCoordinates(y=code_block_13)
code_block_14 = CodeBlock { 4; }
byLengths_6 = Cuboid.ByLengths(origin=byCoordinates_12, length=code_block_14)
XZ = Plane.XZ()
trim = Geometry.Trim(geometry=byLengths_6, other=XZ, pick=byCoordinates_12)
watch_3d_3 = Watch3D(trim)

# group: Geometry.Intersect
code_block_15 = CodeBlock { 6; }
byWidthLength = Rectangle.ByWidthLength(width=code_block_15)
byPatch = Surface.ByPatch(closedCurve=byWidthLength)
byCenterPointRadius_7 = Circle.ByCenterPointRadius()
intersect = Geometry.Intersect(geometry=byPatch, other=byCenterPointRadius_7)
watch_3d_4 = Watch3D(intersect)

# group: BoundingBox
code_block_16 = CodeBlock { 100; -20; 20; 42; 24; }
randomList = Math.RandomList(amount=code_block_16.out0, value1=code_block_16.out1, value2=code_block_16.out2, seed=code_block_16.out3)
randomList_2 = Math.RandomList(amount=code_block_16.out0, value1=code_block_16.out1, value2=code_block_16.out2, seed=code_block_16.out4)
byCoordinates_13 = Point.ByCoordinates(x=randomList, y=randomList_2)
code_block_17 = CodeBlock { 10; }
byCenterPointRadius_8 = Sphere.ByCenterPointRadius(radius=code_block_17)
byGeometry = BoundingBox.ByGeometry(geom=byCenterPointRadius_8)
contains = BoundingBox.Contains(boundingBox=byGeometry, point=byCoordinates_13)
filterByBoolMask = List.FilterByBoolMask(list=byCoordinates_13, mask=contains)
byCenterPointRadius_9 = Sphere.ByCenterPointRadius(centerPoint=filterByBoolMask.in)
toCuboid = BoundingBox.ToCuboid(boundingBox=byGeometry)

# group: Polygon.ContainmentTest
code_block_18 = CodeBlock { 100; -20; 20; 42; 24; }
randomList_3 = Math.RandomList(amount=code_block_18.out0, value1=code_block_18.out1, value2=code_block_18.out2, seed=code_block_18.out3)
randomList_4 = Math.RandomList(amount=code_block_18.out0, value1=code_block_18.out1, value2=code_block_18.out2, seed=code_block_18.out4)
byCoordinates_14 = Point.ByCoordinates(x=randomList_3, y=randomList_4)
code_block_19 = CodeBlock { 10; }
byWidthLength_2 = Rectangle.ByWidthLength(width=code_block_19, length=code_block_19)
containmentTest = Polygon.ContainmentTest(polygon=byWidthLength_2, point=byCoordinates_14)
filterByBoolMask_2 = List.FilterByBoolMask(list=byCoordinates_14, mask=containmentTest)
byCenterPointRadius_10 = Sphere.ByCenterPointRadius(centerPoint=filterByBoolMask_2.in)

# group: Union
code_block_20 = CodeBlock { 2; }
byCoordinates_15 = Point.ByCoordinates(y=code_block_20)
byLengths_7 = Cuboid.ByLengths(origin=byCoordinates_15)
code_block_21 = CodeBlock { 1; 1; }
byCoordinates_16 = Point.ByCoordinates(y=code_block_21.out0, z=code_block_21.out1)
byCenterPointRadius_11 = Sphere.ByCenterPointRadius(centerPoint=byCoordinates_16)
list_create_2 = List.Create(item0=byLengths_7, item1=byCenterPointRadius_11)
byUnion = Solid.ByUnion(solids=list_create_2)

# group: DifferenceAll
code_block_22 = CodeBlock { 2; }
byCoordinates_17 = Point.ByCoordinates(y=code_block_22)
byLengths_8 = Cuboid.ByLengths(origin=byCoordinates_17)
code_block_23 = CodeBlock { 1; 1; }
byCoordinates_18 = Point.ByCoordinates(y=code_block_23.out0, z=code_block_23.out1)
byCenterPointRadius_12 = Sphere.ByCenterPointRadius(centerPoint=byCoordinates_18)
differenceAll = Solid.DifferenceAll(solid=byLengths_8, others=byCenterPointRadius_12)
