# Dynamo graph 6-6_テッセレーション.dyn "6-4_Tessellation" (Dynamo 2.12.0.5650)
# packages: spring nodes 204.1.0

# group: Delaunay.ByParametersOnSurface
code_block = CodeBlock { 1000; }
byWidthLength = Rectangle.ByWidthLength(width=code_block, length=code_block)
byPatch = Surface.ByPatch(closedCurve=byWidthLength)
code_block_2 = CodeBlock { 50; 0; 1; }
integer_slider = IntegerSlider(81, range=0..100 step 1)
randomList = Math.RandomList(amount=code_block_2.out0, value1=code_block_2.out1, value2=code_block_2.out2, seed=integer_slider)
integer_slider_2 = IntegerSlider(66, range=0..100 step 1)
randomList_2 = Math.RandomList(amount=code_block_2.out0, value1=code_block_2.out1, value2=code_block_2.out2, seed=integer_slider_2)
pointAtParameter = Surface.PointAtParameter(surface=byPatch, u=randomList, v=randomList_2, lacing=Longest)
UVParameterAtPoint = Surface.UVParameterAtPoint(surface=byPatch, point=pointAtParameter)
byParametersOnSurface = Tessellation.Delaunay.ByParametersOnSurface(uvs=UVParameterAtPoint, face=byPatch)

# group: ConvexHull
select_model_elements = DSModelElementsSelection()  # 9 picked in the model
geometry = Element.Geometry(element=select_model_elements)
startPoint = Curve.StartPoint(curve=geometry)
flatten = List.Flatten(list=startPoint)
code_block_3 = CodeBlock { 500; }
ꟿ_points_convexhull2d = Custom[ꟿ Points.ConvexHull2D](points=flatten, elevation=code_block_3)  # package spring nodes
byPoints = Polygon.ByPoints(points=ꟿ_points_convexhull2d)

# group: Voronoi.ByParametersOnSurface
code_block_4 = CodeBlock { 1000; }
byWidthLength_2 = Rectangle.ByWidthLength(width=code_block_4, length=code_block_4)
byPatch_2 = Surface.ByPatch(closedCurve=byWidthLength_2)
code_block_5 = CodeBlock { 50; 0; 1; }
integer_slider_3 = IntegerSlider(81, range=0..100 step 1)
randomList_3 = Math.RandomList(amount=code_block_5.out0, value1=code_block_5.out1, value2=code_block_5.out2, seed=integer_slider_3)
integer_slider_4 = IntegerSlider(66, range=0..100 step 1)
randomList_4 = Math.RandomList(amount=code_block_5.out0, value1=code_block_5.out1, value2=code_block_5.out2, seed=integer_slider_4)
pointAtParameter_2 = Surface.PointAtParameter(surface=byPatch_2, u=randomList_3, v=randomList_4, lacing=Longest)
UVParameterAtPoint_2 = Surface.UVParameterAtPoint(surface=byPatch_2, point=pointAtParameter_2)
byParametersOnSurface_2 = Tessellation.Voronoi.ByParametersOnSurface(uvs=UVParameterAtPoint_2, face=byPatch_2)
