# Dynamo graph ParametricTower.dyn (Dynamo 2.10.1.3976)
# packages: Ampersand 2019.12.31

# group: Input
code_block = CodeBlock {  }

# group: Generate
code_block_2 = CodeBlock {  }

# group: Tranform
code_block_3 = CodeBlock {  }

# group: Parameter
code_block_4 = CodeBlock {  }

# group: Preview
code_block_5 = CodeBlock {  }

# group: Create Ellipse
code_block_6 = CodeBlock { 4500; 6000; }
byPlaneRadii = Ellipse.ByPlaneRadii(xAxisRadius=code_block_6.out0, yAxisRadius=code_block_6.out1)

# group: Z方向へ移動
ZAxis = Vector.ZAxis()
code_block_7 = CodeBlock { 0..50000..4500; }
translate = Geometry.Translate(geometry=byPlaneRadii, direction=ZAxis, distance=code_block_7)

# group: Sinに応じてスケールする
XY = Plane.XY()
count = List.Count(list=translate)
code_block_8 = CodeBlock(count=count) { 0..180..#count; }
code_block_9 = CodeBlock(x=code_block_8) { 1+Math.Sin(x); }
scale = Geometry.Scale(geometry=translate, plane=XY, xamount=code_block_9, yamount=code_block_9)

# group: 回転する
XY_2 = Plane.XY()
count_2 = List.Count(list=scale)
code_block_10 = CodeBlock(count=count_2) { 0..90..#count; }
rotate = Geometry.Rotate(geometry=scale, basePlane=XY_2, degrees=code_block_10)

# group: アウトラインをオフセットして、点へ分割し、Transposeする
flatten = List.Flatten(list=rotate)
code_block_11 = CodeBlock { -1000; }
offset = Curve.Offset(curve=flatten, distance=code_block_11)
startPoint = Curve.StartPoint(curve=offset)
pointsAtEqualSegmentLength = Curve.PointsAtEqualSegmentLength(curve=offset)
addItemToFront = List.AddItemToFront(item=startPoint@L1, list=pointsAtEqualSegmentLength@@L2)
transpose = List.Transpose(lists=addItemToFront@L3)

# group: 柱用のPolyCurve
byPoints = PolyCurve.ByPoints(points=transpose)

# group: Levelをつくる
count_3 = List.Count(list=code_block_7)
code_block_12 = CodeBlock(count=count_3) { 1..count; }
string_from_object = FromObject(object=code_block_12)
code_block_13 = CodeBlock { "FL"; }
add = string_from_object + code_block_13
byElevationAndName = Level.ByElevationAndName(elevation=code_block_7, name=add)

# group: 柱をつくる
explode = Geometry.Explode(geometry=byPoints)
code_block_14 = CodeBlock(levels=byElevationAndName) { levels; }
family_types = FamilyTypes("コンクリート-円形-柱:750")
columnByCurve = StructuralFraming.ColumnByCurve(curve=explode@L2, level=code_block_14, structuralColumnType=family_types)

# group: 床のアウトラインをつくるために、NurbsからPolyCurveへ
code_block_15 = CodeBlock { 0..1..#20; }
pointAtParameter = Curve.PointAtParameter(curve=flatten@L1, param=code_block_15)
code_block_16 = CodeBlock { 1; }
dropItems = List.DropItems(list=pointAtParameter@L2, amount=code_block_16)
boolean = BoolSelector(true)
byPoints_2 = PolyCurve.ByPoints(points=dropItems@L2, connectLastToFirst=boolean)

# group: 床をつくる
code_block_17 = CodeBlock { 100; }
offset_2 = Curve.Offset(curve=byPoints_2, distance=code_block_17)
floor_types = FloorTypes("一般 300 mm")
code_block_18 = CodeBlock(levels=byElevationAndName) { levels; }
byOutlineTypeAndLevel = Floor.ByOutlineTypeAndLevel(outline=offset_2@L1, floorType=floor_types, level=code_block_18@L1)

code_block_19 = CodeBlock(baselines=flatten) { baselines; }

# group: サーフェスをつくる
byLoft = Surface.ByLoft(crossSections=code_block_19)

# group: UCount
integer_slider = IntegerSlider(15, range=15..25 step 1)

# group: Uのアイソカーブを取得する
code_block_20 = CodeBlock { 0; }
code_block_21 = CodeBlock(uCount=integer_slider) { 0..1..#uCount; }
getIsoline = Surface.GetIsoline(surface=byLoft, isoDirection=code_block_20, parameter=code_block_21)

# group: VCount
integer_slider_2 = IntegerSlider(40, range=15..50 step 1)

# group: アイソカーブを分割
code_block_22 = CodeBlock(vCount=integer_slider_2) { 0..1..#vCount; }
pointAtParameter_2 = Curve.PointAtParameter(curve=getIsoline@L1, param=code_block_22)
code_block_23 = CodeBlock { 1; }
dropItems_2 = List.DropItems(list=pointAtParameter_2@L2, amount=code_block_23)

# group: 点をクワッド用に並び替え
code_block_24 = CodeBlock { "True"; }
pointgrid_toquadsets = Custom[[&] PointGrid.ToQuadSets](pointGrid=dropItems_2, wrap=code_block_24)  # package Ampersand; Create groups of 4 items describing the "cells" of a rectangular grid of data. In the case of a grid of points, the output will be the set of points describing the corners of 4-pointed panels.

# group: 確認用
byPoints_3 = Polygon.ByPoints(points=pointgrid_toquadsets@L2)

# group: AdaptiveComponentを配置
family_types_2 = FamilyTypes("panel_ac_Glass:panel_ac_Glass")
byPoints_4 = AdaptiveComponent.ByPoints(points=pointgrid_toquadsets, familyType=family_types_2)

# group: 平面図、天伏図をつくる
byLevel = FloorPlanView.ByLevel(level=byElevationAndName)
byLevel_2 = CeilingPlanView.ByLevel(level=byElevationAndName)
