# Dynamo graph StructuralFraming.dyn (Dynamo 2.10.1.3976)

# group: ジオメトリの取得
select_model_element = DSModelElementSelection()  # 1 picked in the model
geometry = Element.Geometry(element=select_model_element)

# group: サーフェスだけを取り出す判定
string_from_object = FromObject(obj=geometry)
code_block = CodeBlock { "Surface"; }
equals = List.Equals(objectA=string_from_object, objectB=code_block, lacing=Longest)

# group: Surface
filterByBoolMask = List.FilterByBoolMask(list=geometry, mask=equals)
code_block_2 = CodeBlock(surface=filterByBoolMask.in) { surface; }

# group: Curve
select_model_elements = DSModelElementsSelection()  # 34 picked in the model

# group: Curvesだけを取り出す判定
getCategory = Element.GetCategory(element=select_model_elements)
string_from_object_2 = FromObject(object=getCategory)
code_block_3 = CodeBlock { "線分"; }
equals_2 = List.Equals(objectA=string_from_object_2, objectB=code_block_3, lacing=Longest)
filterByBoolMask_2 = List.FilterByBoolMask(list=select_model_elements, mask=equals_2)

# group: Curves
geometry_2 = Element.Geometry(element=filterByBoolMask_2.in)

# group: CurveをSurfaceにProject
ZAxis = Vector.ZAxis()
projectInputOnto = Surface.ProjectInputOnto(surface=code_block_2, geometryToProject=geometry_2@L2, projectionDirection=ZAxis, lacing=CrossProduct)

# group: Curve Simplyfy
code_block_4 = CodeBlock { 1000; }
simplify = Curve.Simplify(curve=projectInputOnto, tolerance=code_block_4)
flatten = List.Flatten(list=simplify)

# group: 構造フレームをつくる
levels = Levels("レベル 2")
structural_framing_types = StructuralFramingTypes("H300x150x6.5x9")
beamByCurve = StructuralFraming.BeamByCurve(curve=flatten@L2, level=levels, structuralFramingType=structural_framing_types)

# group: Parameter 回転角度
code_block_5 = CodeBlock { "回転 角度"; }
code_block_6 = CodeBlock { 0; }
setParameterByName = Element.SetParameterByName(element=beamByCurve, parameterName=code_block_5, value=code_block_6)

# group: Parameter ｚ位置合わせ
code_block_7 = CodeBlock { "z 位置合わせ"; }
getParameterValueByName = Element.GetParameterValueByName(element=setParameterByName, parameterName=code_block_7)
code_block_8 = CodeBlock { 0; }
setParameterByName_2 = Element.SetParameterByName(element=setParameterByName, parameterName=code_block_7, value=code_block_8)

# group: Parameter ｚオフセット値
code_block_9 = CodeBlock { "z オフセット値"; }
getParameterValueByName_2 = Element.GetParameterValueByName(element=setParameterByName_2, parameterName=code_block_9)
code_block_10 = CodeBlock { -100; }
setParameterByName_3 = Element.SetParameterByName(element=setParameterByName_2, parameterName=code_block_9, value=code_block_10)

# group: Parameter
code_block_11 = CodeBlock {  }

# group: Preview
code_block_12 = CodeBlock {  }

# group: Tranform
code_block_13 = CodeBlock {  }

# group: Generate
code_block_14 = CodeBlock {  }

# group: Input
code_block_15 = CodeBlock {  }
