# Dynamo graph WavingLight.dyn (Dynamo 2.12.0.5650)

# group: 天井を選択し、ジオメトリを取得
select_model_element = DSModelElementSelection()  # 1 picked in the model
geometry = Element.Geometry(element=select_model_element)

# group: 下の面を取り出す
explode = Geometry.Explode(geometry=geometry)
normalAtParameter = Surface.NormalAtParameter(surface=explode)
Z = Vector.Z(vector=normalAtParameter)
code_block = CodeBlock(z=Z) { z==-1?true:false; }
filterByBoolMask = List.FilterByBoolMask(list=explode, mask=code_block)

# group: Surfaceのパラメータから点を取得
code_block_2 = CodeBlock { [0,1]; }
getIsoline = Surface.GetIsoline(surface=filterByBoolMask.in, isoDirection=code_block_2, lacing=Longest)
length = Curve.Length(curve=getIsoline@L1)
code_block_3 = CodeBlock { 600; }
code_block_4 = CodeBlock(list=length, length=code_block_3) { u = list[0]; v = list[1]; uNum = Math.Round(u/length); vNum = Math.Round(v/length); }
code_block_5 = CodeBlock(uNum=code_block_4.uNum, vNum=code_block_4.vNum) { 0.1..0.9..#uNum; 0.1..0.9..#vNum; }
pointAtParameter = Surface.PointAtParameter(surface=filterByBoolMask.in, u=code_block_5.out0, v=code_block_5.out1, lacing=CrossProduct)

# group: ファミリインスタンスを配置
family_types = FamilyTypes("GEL-LightingFixture-ペンダントライト:White")
flatten = List.Flatten(list=pointAtParameter)
python_script = Python(IN[0]=select_model_element, IN[1]=family_types, IN[2]=flatten)  # IronPython2
# ---------- python_script.python (37 lines) ----------
import clr

clr.AddReference("RevitServices")
import RevitServices
from RevitServices.Persistence import DocumentManager
from RevitServices.Transactions import TransactionManager
doc = DocumentManager.Instance.CurrentDBDocument

clr.AddReference("RevitAPI")
import Autodesk

clr.AddReference("RevitNodes")
import Revit
clr.ImportExtensions(Revit.Elements)
clr.ImportExtensions(Revit.GeometryConversion)

def tolist(obj1):
	if hasattr(obj1,"__iter__"): return obj1
	else: return [obj1]

host = UnwrapElement((IN[0]))
ftype = UnwrapElement(IN[1])
fpts = UnwrapElement(tolist(IN[2]))

OUT = []

TransactionManager.Instance.EnsureInTransaction(doc)

for pt in fpts:
	p = pt.ToXyz(True)
	try:
		level = doc.GetElement(host.LevelId)
		nf = doc.Create.NewFamilyInstance(p,ftype,host,level,Autodesk.Revit.DB.Structure.StructuralType.NonStructural)
		OUT.append(nf)
	except:
		OUT.append(None)
TransactionManager.Instance.TransactionTaskDone()
# ----------------------------------------

# group: 高さの数値リスト
code_block_6 = CodeBlock(point=flatten) { z= Math.Sin(Math.RemapRange(point.X,0,360))*Math.Cos(Math.RemapRange(point.Y,0,360)); }
code_block_7 = CodeBlock { 500; 1500; }
remapRange = Math.RemapRange(numbers=code_block_6, newMin=code_block_7.out0, newMax=code_block_7.out1)

# group: パラメータを変更
code_block_8 = CodeBlock { "GEL-DownrodLength"; }
setParameterByName = Element.SetParameterByName(element=python_script, parameterName=code_block_8, value=remapRange)

# group: Preview
code_block_9 = CodeBlock {  }

# group: Parameter
code_block_10 = CodeBlock {  }

# group: Tranform
code_block_11 = CodeBlock {  }

# group: Generate
code_block_12 = CodeBlock {  }

# group: Input
code_block_13 = CodeBlock {  }

# group: ライトの長さを確認
code_block_14 = CodeBlock(points=flatten) { points; }
ZAxis = Vector.ZAxis()
reverse = Vector.Reverse(vector=ZAxis)
byStartPointDirectionLength = Line.ByStartPointDirectionLength(startPoint=code_block_14, direction=reverse, length=remapRange)
