# Dynamo graph RandomOpening.dyn (Dynamo 2.10.1.3976)

# group: 窓開口のファミリタイプの要素を取得
family_types = FamilyTypes("窓開口:窓開口")
all_elements_of_family_type = ElementsOfFamilyType(Family_Type=family_types)

# group: Elements
code_block = CodeBlock(elements=all_elements_of_family_type) { elements; }

# group: 開口寸法パターンをつくる
code_block_2 = CodeBlock { 100..500..25; }

# group: ランダムシード
integer_slider = IntegerSlider(94, range=0..100 step 1)

# group: ランダムの数値のリストをつくる
count = List.Count(list=all_elements_of_family_type)
code_block_3 = CodeBlock { 0; 1; }
randomList = Math.RandomList(amount=count, value1=code_block_3.out0, value2=code_block_3.out1, seed=integer_slider)
count_2 = List.Count(list=code_block_2)
remapRange = Math.RemapRange(numbers=randomList, newMax=count_2)
round = Math.Round(number=remapRange)
code_block_4 = CodeBlock(list=code_block_2, index=round) { list[index-1]; }

# group: パラメータ幅
code_block_5 = CodeBlock { "GEL-Width"; }
setParameterByName = Element.SetParameterByName(element=code_block, parameterName=code_block_5, value=code_block_4)

# group: パラメータ高さ
code_block_6 = CodeBlock { "GEL-Height"; }
setParameterByName_2 = Element.SetParameterByName(element=code_block, parameterName=code_block_6, value=code_block_4)

# group: Parameter
code_block_7 = CodeBlock {  }

# group: Preview
code_block_8 = CodeBlock {  }

# group: Tranform
code_block_9 = CodeBlock {  }

# group: Generate
code_block_10 = CodeBlock {  }

# group: Input
code_block_11 = CodeBlock {  }
