# Dynamo graph ImageMapping.dyn (Dynamo 2.10.1.3976)
# packages: Ampersand 2019.12.31

# group: モデル線
select_model_element = DSModelElementSelection()  # 1 picked in the model; graph input
select_model_element_2 = DSModelElementSelection()  # 1 picked in the model; graph input

# group: Curve情報を取得
create = List.Create(item0=select_model_element, item1=select_model_element_2)
curves = Element.Curves(element=create)

# group: Loftする
flatten = List.Flatten(list=curves)
byLoft = Surface.ByLoft(crossSections=flatten)

# group: u
u = IntegerSlider(10, range=10..20 step 1)

# group: アイソカーブを取得
code_block = CodeBlock(u=u) { 0..1..#u; }
getIsoline = Surface.GetIsoline(surface=byLoft, parameter=code_block)

# group: v
v = IntegerSlider(30, range=10..30 step 1)

# group: 分割して、点リストをつくる
code_block_2 = CodeBlock(v=v) { 0..1..#v; }
pointAtParameter = Curve.PointAtParameter(curve=getIsoline, param=code_block_2, lacing=CrossProduct)
pointgrid_toquadsets = Custom[[&] PointGrid.ToQuadSets](pointGrid=pointAtParameter)  # package Ampersand; Create groups of 4 items describing the "cells" of a rectangular grid of data. In the case of a grid of points, the output will be the set of points describing the corners of 4-pointed panels.

# group: アダプティブパネルを生成
family_types = FamilyTypes("Simple_Panel_ac:Simple_Panel_ac")  # graph input
byPoints = AdaptiveComponent.ByPoints(points=pointgrid_toquadsets, familyType=family_types)  # frozen

# group: 画像を指定
file_path = Filename(".\gradient5.jpg")
file_from_path = FileObject(path=file_path)
readFromFile = Image.ReadFromFile(file=file_from_path)

# group: Image Preview
watch_image = WatchImageCore(image=readFromFile)

# group: 画像のピクセルを並び替え
code_block_3 = CodeBlock(u=u, v=v) { u-1; v-1; }
pixels = Image.Pixels(image=watch_image, xSamples=code_block_3.out1, ySamples=code_block_3.out0)
reverse = List.Reverse(list=pixels)
reverse_2 = List.Reverse(list=reverse@L2)

# group: Color
overrideColorInView = Element.OverrideColorInView(element=byPoints, color=reverse_2)

# group: Parameter
code_block_4 = CodeBlock {  }

# group: Preview
code_block_5 = CodeBlock {  }

# group: Tranform
code_block_6 = CodeBlock {  }

# group: Generate
code_block_7 = CodeBlock {  }

# group: Input
code_block_8 = CodeBlock {  }
