# Dynamo graph VisibilitySimulation.dyn (Dynamo 2.12.0.5650)

# group: ModelCurve
select_model_element = DSModelElementSelection()  # 1 picked in the model

# group: Circle Center
geometry = Element.Geometry(element=select_model_element)
centerPoint = Circle.CenterPoint(circle=geometry)

# group: +Z 1600
ZAxis = Vector.ZAxis()
code_block = CodeBlock { 1600; }
translate = Geometry.Translate(geometry=centerPoint, direction=ZAxis, distance=code_block)

# group: 0-360
code_block_2 = CodeBlock { 0..360..0.5; }
code_block_3 = CodeBlock { 1; }
dropItems = List.DropItems(list=code_block_2, amount=code_block_3)

# group: SphericalCoordinates
byOrigin = CoordinateSystem.ByOrigin(origin=translate)
code_block_4 = CodeBlock { 90; }
code_block_5 = CodeBlock { 30; }
bySphericalCoordinates = Point.BySphericalCoordinates(coordinateSystem=byOrigin, phi=code_block_4, theta=dropItems, radius=code_block_5, lacing=Longest)

# group: 360 Vector
byTwoPoints = Vector.ByTwoPoints(start=translate, end=bySphericalCoordinates, lacing=Longest)
code_block_6 = CodeBlock { 1; }
views = Views("Visibility")
byOriginDirection = Revit.References.RayBounce.ByOriginDirection(origin=translate, direction=byTwoPoints, maxBounces=code_block_6, view=views, lacing=Longest)

# group: Create Polygon
lastItem = List.LastItem(list=byOriginDirection.points@L2)
pruneDuplicates = Point.PruneDuplicates(points=lastItem)
byPoints = Polygon.ByPoints(points=pruneDuplicates)

# group: FilledRegion
views_2 = Views("レベル 1")
explode = Geometry.Explode(geometry=byPoints)
select_filled_region_type = FilledRegionTypes()  # nothing selected
byCurves = FilledRegion.ByCurves(view=views_2, boundary=explode, regionType=select_filled_region_type)

# group: Preview
code_block_7 = CodeBlock {  }

# group: Parameter
code_block_8 = CodeBlock {  }

# group: Tranform
code_block_9 = CodeBlock {  }

# group: Generate
code_block_10 = CodeBlock {  }

# group: Input
code_block_11 = CodeBlock {  }
