# Dynamo graph SpaceAnalysis.dyn (Dynamo 2.12.0.5650)
# packages: SpaceAnalysis 0.4.0

# group: 周辺建物を取得
categories = Categories("OST_Mass")
all_elements_of_category = ElementsOfCategory(Category=categories)
geometry = Element.Geometry(element=all_elements_of_category)

# group: 下面だけをフィルタリング
explode = Geometry.Explode(geometry=geometry)
normalAtParameter = Surface.NormalAtParameter(surface=explode)
code_block = CodeBlock(vector=normalAtParameter) { vector.Z==-1?true:false; }
filterByBoolMask = List.FilterByBoolMask(list=explode, mask=code_block)

# group: Surfaceの外形
perimeterCurves = Surface.PerimeterCurves(surface=filterByBoolMask.in)

# group: BoundingBox
code_block_2 = CodeBlock(barriers=perimeterCurves) { barriers; }
flatten = List.Flatten(list=code_block_2)
byGeometry = BoundingBox.ByGeometry(geom=flatten)

# group: SpaceLatticeをつくる
code_block_3 = CodeBlock(BoundingBox=byGeometry) { BoundingBox; }
code_block_4 = CodeBlock(barriers=perimeterCurves) { barriers; }
approximateCurvesWithLines = Custom[Utils.ApproximateCurvesWithLines](curves=code_block_4)  # package SpaceAnalysis; Approximate Curves With Lines
code_block_5 = CodeBlock { 5000; }
byBoundingBoxAndLines = SpaceAnalysis.Core.SpaceLattice.ByBoundingBoxAndLines(boundingBox=code_block_3, barriers=approximateCurvesWithLines, resolution=code_block_5)

code_block_6 = CodeBlock(lattice=byBoundingBoxAndLines) { lattice; }

# group: Color List
color_palette = ColorPalette({R: 127, G: 127, B: 127, A: 198})
color_palette_2 = ColorPalette({R: 176, G: 196, B: 222, A: 255})
color_palette_3 = ColorPalette({R: 176, G: 224, B: 230, A: 255})
color_palette_4 = ColorPalette({R: 255, G: 250, B: 205, A: 255})
list_create = List.Create(item0=color_palette, item1=color_palette_2, item2=color_palette_3, item3=color_palette_4)

# group: モデル線を選択
select_model_element = DSModelElementSelection()  # 1 picked in the model
geometry_2 = Element.Geometry(element=select_model_element)

# group: Parameter
focal_point_parameter_along = DoubleSlider(0.5, range=0..1 step 0.01)  # "Focal point parameter along diagonal"

# group: 視点を設定
pointAtParameter = Curve.PointAtParameter(curve=geometry_2, param=focal_point_parameter_along)
code_block_7 = CodeBlock(focalPoint=pointAtParameter) { focalPoint; }

# group: VisibilityGrid
code_block_8 = CodeBlock(lattice=code_block_6) { lattice; }
code_block_9 = CodeBlock(focus=code_block_7) { focus; }
code_block_10 = CodeBlock { 1000000; }
bySpaceLatticeAndViewPoint = SpaceAnalysis.Visibility.ViewField.BySpaceLatticeAndViewPoint(spaceLattice=code_block_8, viewPoint=code_block_9, radius=code_block_10)
byViewField = SpaceAnalysis.Visibility.VisibilityGrid.ByViewField(viewField=bySpaceLatticeAndViewPoint)

# group: ValueAtPoint
code_block_11 = CodeBlock(lattice=code_block_6) { lattice; }
code_block_12 = CodeBlock { 0.25; 0.75; }
code_block_13 = CodeBlock(visibilityGrid=byViewField) { visibilityGrid; }
points = SpaceAnalysis.Core.SpaceLattice.Points(spaceLattice=code_block_11)
valueAtPoint = SpaceAnalysis.Visibility.VisibilityGrid.ValueAtPoint(visibilityGrid=code_block_13, point=points, lacing=Longest)
map = Math.Map(rangeMin=code_block_12.out0, rangeMax=code_block_12.out1, inputValue=valueAtPoint)

# group: VisibilityGridの表示
surface = SpaceAnalysis.Core.SpaceLattice.Surface(spaceLattice=code_block_11)
code_block_14 = CodeBlock(list=list_create) { 0..1..#List.Count(list); }
color_range = ColorRange(colors=list_create, indices=code_block_14, value=map)
bySurfaceColors = Modifiers.GeometryColor.BySurfaceColors(surface=surface, colors=color_range)

# group: 周辺建物外形
code_block_15 = CodeBlock(barriers=perimeterCurves) { barriers; }
color_palette_5 = ColorPalette({R: 100, G: 201, B: 237, A: 149})
byGeometryColor = Modifiers.GeometryColor.ByGeometryColor(geometry=code_block_15, color=color_palette_5)

# group: 終点
select_model_element_2 = DSModelElementSelection()  # 1 picked in the model
getLocation = Element.GetLocation(element=select_model_element_2)

# group: 最短距離をつくる
code_block_16 = CodeBlock(lattice=code_block_6) { lattice; }
code_block_17 = CodeBlock(focus=code_block_7) { focus; }
bySpaceLatticeAndEndPoint = SpaceAnalysis.Pathfinding.PathField.BySpaceLatticeAndEndPoint(spaceLattice=code_block_16, endPoint=code_block_17)
byPathField = SpaceAnalysis.Pathfinding.Route.ByPathField(pathField=bySpaceLatticeAndEndPoint, otherPoint=getLocation, lacing=Longest)
code_block_18 = CodeBlock { 10; }
curve = SpaceAnalysis.Pathfinding.Route.Curve(route=byPathField, tidyIterations=code_block_18)

# group: 最短経路表示
color_palette_6 = ColorPalette({R: 255, G: 69, B: 0, A: 255})
byGeometryColor_2 = Modifiers.GeometryColor.ByGeometryColor(geometry=curve, color=color_palette_6)

# group: Preview
code_block_19 = CodeBlock {  }

# group: Parameter
code_block_20 = CodeBlock {  }

# group: Tranform
code_block_21 = CodeBlock {  }

# group: Generate
code_block_22 = CodeBlock {  }

# group: Input
code_block_23 = CodeBlock {  }

# group: Process
code_block_24 = CodeBlock {  }
