# Dynamo graph DataVisualization.dyn (Dynamo 2.12.0.5650)
# packages: Archi-lab_Mandrill 2021.26.1

# group: Preview
code_block = CodeBlock {  }

# group: Parameter
code_block_2 = CodeBlock {  }

# group: Tranform
code_block_3 = CodeBlock {  }

# group: Generate
code_block_4 = CodeBlock {  }

# group: Process
code_block_5 = CodeBlock {  }

# group: Input
code_block_6 = CodeBlock {  }

# group: レベル1の部屋を取得
categories = Categories("OST_Rooms")
views = Views("レベル 1")
all_elements_of_category_in_view = ElementsOfCategoryInView(Category=categories, View=views)

# group: 部屋の面積でフィルタリング
area = Room.Area(room=all_elements_of_category_in_view)
code_block_7 = CodeBlock { 0; }
gt = area > code_block_7
filterByBoolMask = List.FilterByBoolMask(list=all_elements_of_category_in_view, mask=gt)

# group: チャートデータ、レジェンドデータをつくる
name = Room.Name(room=filterByBoolMask.in)
data = Legends.Legend.Data(Names=name)
area_2 = Room.Area(room=filterByBoolMask.in)
code_block_8 = CodeBlock(x=area_2) { Math.Round(x); }
data_2 = Charts.DonutChart.Data(Names=name, Values=code_block_8)

# group: Colors
color_palette = ColorPalette({R: 30, G: 144, B: 255, A: 255})
color_palette_2 = ColorPalette({R: 0, G: 191, B: 255, A: 255})
color_palette_3 = ColorPalette({R: 102, G: 205, B: 170, A: 255})
color_palette_4 = ColorPalette({R: 176, G: 224, B: 230, A: 255})
color_palette_5 = ColorPalette({R: 255, G: 192, B: 203, A: 255})
color_palette_6 = ColorPalette({R: 255, G: 99, B: 71, A: 255})
list_create = List.Create(item0=color_palette, item1=color_palette_2, item2=color_palette_3, item3=color_palette_4, item4=color_palette_5, item5=color_palette_6)

# group: カラーグラデーションをつくる
code_block_9 = CodeBlock(colors=list_create) { colors; }
code_block_10 = CodeBlock(list=code_block_9) { 0..1..#List.Count(list); }
code_block_11 = CodeBlock(rooms=filterByBoolMask.in) { rooms; }
code_block_12 = CodeBlock(list=code_block_11) { 0..1..#List.Count(list); }
color_range = ColorRange(colors=code_block_9, indices=code_block_10, value=code_block_12)

# group: レジェンドをつくる
code_block_13 = CodeBlock { 100; }
code_block_14 = CodeBlock { "Room Area"; }
style = Legends.Legend.Style(Colors=color_range, Width=code_block_13, Title=code_block_14)
create = Legends.Legend.Create(Data=data, Style=style)

# group: チャートをつくる
style_2 = Charts.DonutChart.Style(Colors=color_range)
chart = Charts.DonutChart.Chart(Data=data_2, Style=style_2)

# group: レポートをつくる
create_report = MandrillReportNode(Chart0=create, Chart1=chart)
report_window = MandrillWindowNodeModel(Report=create_report, IsWindowClosed=true, Message=""" Launch
Window""")

style_3 = Charts.DonutChart.Style()
